# Grasshopper definition 001Anemone.gh (Grasshopper 1.0.7)
# plug-ins: Anemone, Bifocals

curve = Curve(<curve referenced from the Rhino model>)
fast_loop_start = FastLoopStart(Iterations=Slider(12, range=0..100), Curve=curve)  # -> port, Counter, Curve
curve_2 = Curve(fast_loop_start.Curve)
explode = Explode(Curve=curve_2, Recursive=True)  # -> Segments, Vertices
point_on_curve = PointOnCurve(explode.Segments, parameter=0.225)
unit_z = UnitZ(Factor=Slider(5, range=0..10))
polyline = PolyLine(Vertices=point_on_curve, Closed=Toggle(True))
move = Move(Geometry=polyline, Motion=unit_z)  # -> Geometry, Transform
fast_loop_end = FastLoopEnd(port=fast_loop_start.port, Exit=False, Curve=move.Geometry, RecordData=True, TimeOutVal=0)  # -> flatten(Data)
unit_z_2 = UnitZ(Factor=1)
curve_3 = Curve([curve, fast_loop_end])
surface = Surface(curve_3)
extrude = Extrude(Base=surface, Direction=unit_z_2)
loft = Loft(Curves=curve_3, Options={Adjust=False, Closed=False, LoftEnds=0, LoftSimp=0, LoftType=0, Rebuild=10, Refit=0.01})

# ----
# Classic is Good for Animation
# (bonus Exit Loop script below)
number_slider = Slider(89, range=0..100)
curve_4 = Curve(<curve referenced from the Rhino model>)
loop_start = LoopStart(Repeat=number_slider, Trigger=Toggle(True), Data=curve_4)  # -> port, Counter, Data
curve_5 = Curve(loop_start.Data)
explode_2 = Explode(Curve=curve_5, Recursive=True)  # -> Segments, Vertices
panel = Panel(loop_start.Counter)
point_on_curve_2 = PointOnCurve(explode_2.Segments, parameter=0.225)
unit_z_3 = UnitZ(Factor=Slider(5, range=0..10))
polyline_2 = PolyLine(Vertices=point_on_curve_2, Closed=Toggle(True))
move_2 = Move(Geometry=polyline_2, Motion=unit_z_3)  # -> Geometry, Transform
area = Area(Geometry=move_2.Geometry)  # -> Area, Centroid
unit_z_4 = UnitZ(Factor=1)
smaller_than = SmallerThan(FirstNumber=area.Area, SecondNumber=Slider(23, range=-1..300))  # -> SmallerThan, OrEqualTo
loop_end = LoopEnd(
    port=loop_start.port,
    Exit=smaller_than.SmallerThan,
    Data=move_2.Geometry,
    TimeOutVal=0,
    pausedState=False,
    state="Constant & Record")  # -> flatten(Data)
curve_6 = Curve([curve_4, loop_end])
surface_2 = Surface(curve_6)
extrude_2 = Extrude(Base=surface_2, Direction=unit_z_4)
loft_2 = Loft(Curves=curve_6, Options={Adjust=False, Closed=False, LoftEnds=0, LoftSimp=0, LoftType=0, Rebuild=10, Refit=0.01})
custom_preview = CustomPreview(Geometry=loft_2, Material=ColourSwatch(SwatchColor=RGB(194, 56, 56)))
custom_preview_2 = CustomPreview(Geometry=extrude_2, Material=ColourSwatch(SwatchColor=RGB(174, 255, 255)))
