# Grasshopper definition 2.32_Robotic Toolpath Preview.gh (Grasshopper 1.0.7)
# plug-ins: Robots, FologramForGrasshopper

sync_parameters = SyncParameters(augmented_trigger_0_key=robot, augmented_trigger_1_key=toolpath_preview, componentVersion=1, num_augmented_triggers=2)
curve = Curve(<curve referenced from the Rhino model>)

# ---- group: Robot Configuration
robot = ValueList({"Bartlett-IRB120", "Bartlett-IRB1600", "Bartlett-KR6", "Bartlett-KR60"}, selected="Bartlett-KR6")
xy_plane = XYPlane(Origin=Point(0, 0, 0))
load_robot = LoadRobotSystem(Name=robot, Base=xy_plane)

# ----
divide_curve = DivideCurve(Curve=curve, Count=10, Kinks=False)  # -> Points, Tangents, Parameters
sync_object = SyncObject(
    GM=curve,
    AlwaysIncludeTextureCoordinates=False,
    Clickable=False,
    DefaultCurveThicknessMillimeters=2.5,
    DefaultGlossPercent=0,
    DefaultMaterialColor=RGB(255, 255, 255),
    DefaultSpecularPercent=0,
    Interactive=False,
    hasSerializedData=True)
plane_normal = PlaneNormal(Origin=divide_curve.Points, ZAxis=divide_curve.Tangents)
create_target = CreateTarget(Plane=plane_normal, IsCartesian=True)
create_program = CreateProgram(Name="DefaultProgram", RobotSystem=load_robot, Targets1=create_target, StepSize=1)  # -> Program, Code, Duration, Warnings, Errors
toolpath_preview = Slider(1, range=0..1)
program_simulation = ProgramSimulation(Program=create_program.Program, Time=toolpath_preview, Normalized=True)  # -> SystemMeshes, JointRotations, Plane, Index, Time, Program, Errors
cull_index = CullIndex(List=program_simulation.SystemMeshes, Indices=-1, Wrap=True)
sync_object_2 = SyncObject(
    GM=cull_index,
    AlwaysIncludeTextureCoordinates=False,
    Clickable=False,
    DefaultCurveThicknessMillimeters=2.5,
    DefaultGlossPercent=0,
    DefaultMaterialColor=RGB(255, 255, 255),
    DefaultSpecularPercent=0,
    Interactive=False,
    hasSerializedData=True)
