# Grasshopper definition 2.32_Robotic Toolpath Preview_v002CurveARRobotPath.gh (Grasshopper 1.0.7)
# plug-ins: Robots, Bifocals, FologramForGrasshopper

sync_parameters = SyncParameters(augmented_trigger_1_key=toolpath_preview, augmented_trigger_4_key=list, componentVersion=1, num_augmented_triggers=5)
curve = Curve(<curve referenced from the Rhino model>)

# ---- group: Robot Configuration
list = ValueList({"AA-KR60", "AA-KR30", "AA-KR60_KR30", "AARCH IRB120", "AARCH IRB6620", "AAU-Utzon-UR10", "Automata", "Bartlett-IRB120", "Bartlett-IRB1600", "Bartlett-KR6"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}, selected="Bartlett-KR6")
xy_plane = XYPlane(Origin=Point(0, 0, 0))
load_robot = LoadRobotSystem(Name=list, Base=xy_plane)

# ----
divide_curve = DivideCurve(Curve=curve, Count=10, Kinks=False)  # -> Points, Tangents, Parameters
sync_object = SyncObject(
    GM=curve,
    AlwaysIncludeTextureCoordinates=False,
    Clickable=False,
    DefaultCurveThicknessMillimeters=2.5,
    DefaultGlossPercent=0,
    DefaultMaterialColor=RGB(255, 255, 255),
    DefaultSpecularPercent=0,
    Interactive=False,
    hasSerializedData=True)
plane_normal = PlaneNormal(Origin=divide_curve.Points, ZAxis=divide_curve.Tangents)
create_target = CreateTarget(Plane=plane_normal, IsCartesian=True)
create_program = CreateProgram(Name="DefaultProgram", RobotSystem=load_robot, Targets1=create_target, StepSize=1)  # -> Program, Code, Duration, Warnings, Errors
toolpath_preview = Slider(0.85, range=0..1)
program_simulation = ProgramSimulation(Program=create_program.Program, Time=toolpath_preview, Normalized=True)  # -> SystemMeshes, JointRotations, Plane, Index, Time, Program, Errors
cull_index = CullIndex(List=program_simulation.SystemMeshes, Indices=-1, Wrap=True)
sync_object_2 = SyncObject(
    GM=cull_index,
    AlwaysIncludeTextureCoordinates=False,
    Clickable=False,
    DefaultCurveThicknessMillimeters=2.5,
    DefaultGlossPercent=0,
    DefaultMaterialColor=RGB(255, 255, 255),
    DefaultSpecularPercent=0,
    Interactive=False,
    hasSerializedData=True)
