# Grasshopper definition 2.34_Robotic Aruco Tracking.gh (Grasshopper 1.0.7)
# plug-ins: Robots, Fologram For Grasshopper Utilities, FologramForGrasshopper

sync_parameters = SyncParameters(augmented_trigger_0_key=robot, augmented_trigger_2_key=run_simulation, componentVersion=1, num_augmented_triggers=7)

# ---- group: Create Aruco Planes
connected_devices = ConnectedDevices(device_filter=3, hasSerializedData=True)
track_markers = TrackMarkers(Device=connected_devices, hasSerializedData=True, marker_output_type=16, marker_trackable_size=45, update_mode=2)
data_recorder = DataRecorder(track_markers, DataLimit=-10, RecordData=True)
panel = Panel("""0
1""")
list_item = ListItem(List=reverse(data_recorder), Index=panel, Wrap=True)  # -> reverse(Item)
rectangle = Rectangle(Plane=list_item, XSize=Domain(-20, 20), YSize=Domain(-20, 20), Radius=0)  # -> Rectangle, Length
plane = Plane(list_item)
mesh_plane = MeshPlane(Boundary=rectangle.Rectangle, WidthCount=1, HeightCount=1)  # -> Mesh, Area
set_global_value = SetGlobalValue(DisplayPlanes=plane)
sync_object = SyncObject(
    GM=mesh_plane.Mesh,
    AlwaysIncludeTextureCoordinates=False,
    Clickable=False,
    DefaultCurveThicknessMillimeters=2.5,
    DefaultGlossPercent=0,
    DefaultMaterialColor=RGB(255, 255, 255),
    DefaultSpecularPercent=0,
    Interactive=False,
    hasSerializedData=True)

# ---- group: Robot Configuration
robot = ValueList({"Bartlett-IRB120", "Bartlett-IRB1600", "Bartlett-KR6", "Bartlett-KR60", "Bartlett-UR10"}, selected="Bartlett-KR6")
xy_plane = XYPlane(Origin=Point(0, 0, 0))
rotate = Rotate(Geometry=xy_plane, Angle=3.141592654, Plane=PlaneXY(0, 0, 0))  # -> Geometry, Transform
load_robot = LoadRobotSystem(Name=robot, Base=rotate.Geometry)

# ---- group: Toolpath Configuration
get_global_value = GetGlobalValue(IsDynamicUpdate=True)
create_target = CreateTarget(Plane=get_global_value, IsCartesian=True)

# ----
run_simulation = Button()

# ---- group: Run Simulation
create_program = CreateProgram(Name="DefaultProgram", RobotSystem=load_robot, Targets1=create_target, StepSize=1)  # -> Program, Code, Duration, Warnings, Errors
timer = Timer(TimerInterval=50, Target=counter)
counter = Counter(Reset=run_simulation)
program_simulation = ProgramSimulation(Program=create_program.Program, Time=expr("x / 20", counter), Normalized=True)  # -> SystemMeshes, JointRotations, Plane, Index, Time, Program, Errors
list_item_2 = ListItem(List=program_simulation.SystemMeshes, Index=[0, 3, 6], Wrap=True)
list_item_3 = ListItem(List=program_simulation.SystemMeshes, Index=[1, 2, 4, 5], Wrap=True)
sync_object_2 = SyncObject(
    GM=list_item_2,
    AlwaysIncludeTextureCoordinates=False,
    Clickable=False,
    DefaultCurveThicknessMillimeters=2.5,
    DefaultGlossPercent=0,
    DefaultMaterialColor=RGB(54, 54, 54),
    DefaultSpecularPercent=0,
    Interactive=False,
    hasSerializedData=True)
sync_object_3 = SyncObject(
    GM=list_item_3,
    AlwaysIncludeTextureCoordinates=False,
    Clickable=False,
    DefaultCurveThicknessMillimeters=2.5,
    DefaultGlossPercent=0,
    DefaultMaterialColor=RGB(222, 152, 0),
    DefaultSpecularPercent=0,
    Interactive=False,
    hasSerializedData=True)

# ----
state_gate = StateGate(States=run_simulation)

# ---- group: Update Aruco Planes
get_global_value_2 = GetGlobalValue(IsDynamicUpdate=False)  # disabled
set_global_value_2 = SetGlobalValue(SimulationPlanes=get_global_value_2)  # disabled
