# Grasshopper definition 2020HannahMorrison001.gh (Grasshopper 1.0.7)
# plug-ins: Bifocals

circle = Circle(Plane=PlaneXY(0, 0, 0), Radius=Slider(36, range=0..100))
unit_z = UnitZ(Factor=Slider(84, range=0..100))
number_slider = Slider(4, range=0..10)
move = Move(Geometry=circle, Motion=unit_z)  # -> Geometry, Transform
curve = Curve(reparameterize(circle))
divide_curve = DivideCurve(Curve=move.Geometry, Count=number_slider, Kinks=False)  # -> Points, Tangents, Parameters
divide_curve_2 = DivideCurve(Curve=curve, Count=number_slider, Kinks=False)  # -> Points, Tangents, Parameters
list_item = ListItem(List=divide_curve_2.Points, Index=0, Wrap=True)  # -> Item, Item1, Item2, Item3
rotate = Rotate(Geometry=divide_curve.Points, Angle=expr(".25*pi", 1.570796327), Plane=PlaneXY(0, 0, 0))  # -> Geometry, Transform
rotate_2 = Rotate(Geometry=divide_curve_2.Points, Angle=expr(".25*pi", 1.570796327), Plane=PlaneXY(0, 0, 0))  # -> Geometry, Transform
number_slider_2 = Slider(20, range=0..20)
number_slider_3 = Slider(22.03, range=0..30)
line = Line(StartPoint=rotate.Geometry, EndPoint=rotate_2.Geometry)
line_2 = Line(StartPoint=divide_curve_2.Points, EndPoint=divide_curve.Points)
construct_domain = ConstructDomain(DomainStart=expr("x/2", number_slider_2), DomainEnd=number_slider_2)
construct_plane = ConstructPlane(Origin=[list_item.Item, list_item.Item2], XAxis=Vector(1, 0, 0), YAxis=Vector(0, 1, 0))
line_3 = Line(StartPoint=divide_curve_2.Points, EndPoint=divide_curve.Points)
construct_domain_2 = ConstructDomain(DomainStart=expr("x/2", number_slider_3), DomainEnd=number_slider_3)
construct_plane_2 = ConstructPlane(Origin=[list_item.Item3, list_item.Item1], XAxis=Vector(1, 0, 0), YAxis=Vector(0, 1, 0))
list_item_2 = ListItem(List=line_2, Index=0, Wrap=True)  # -> Item, Item1, Item2, Item3
range = Range(Domain=construct_domain, Steps=Slider(1, range=0..1))
deconstruct_plane = DeconstructPlane(Plane=construct_plane)  # -> Origin, XAxis, YAxis, ZAxis
list_item_3 = ListItem(List=line_3, Index=0, Wrap=True)  # -> Item, Item1, Item2, Item3
range_2 = Range(Domain=construct_domain_2, Steps=Slider(1, range=0..1))
deconstruct_plane_2 = DeconstructPlane(Plane=construct_plane_2)  # -> Origin, XAxis, YAxis, ZAxis
line_sdl = LineSDL(Start=deconstruct_plane.Origin, Direction=deconstruct_plane.YAxis, Length=range)
line_sdl_2 = LineSDL(Start=deconstruct_plane_2.Origin, Direction=deconstruct_plane.XAxis, Length=range_2)
point_on_curve = PointOnCurve(list_item_2.Item, parameter=0.528)
point_on_curve_2 = PointOnCurve(list_item_2.Item2, parameter=0.729)
point_on_curve_3 = PointOnCurve(list_item_3.Item3, parameter=0.843)
point_on_curve_4 = PointOnCurve(list_item_3.Item1, parameter=0.817)
xz_plane = XZPlane(Origin=Point(0, 0, 0))
dispatch = Dispatch(List=line_sdl, DispatchPattern=[True, False])  # -> ListA, ListB
yz_plane = YZPlane(Origin=Point(0, 0, 0))
dispatch_2 = Dispatch(List=line_sdl_2, DispatchPattern=[True, False])  # -> ListA, ListB
mirror = Mirror(Geometry=dispatch.ListA, Plane=xz_plane)  # -> Geometry, Transform
mirror_2 = Mirror(Geometry=dispatch.ListB, Plane=xz_plane)  # -> Geometry, Transform
mirror_3 = Mirror(Geometry=dispatch_2.ListA, Plane=yz_plane)  # -> Geometry, Transform
mirror_4 = Mirror(Geometry=dispatch_2.ListB, Plane=yz_plane)  # -> Geometry, Transform
end_points = EndPoints(Curve=dispatch.ListA)  # -> Start, End
end_points_2 = EndPoints(Curve=mirror.Geometry)  # -> Start, End
end_points_3 = EndPoints(Curve=dispatch.ListB)  # -> Start, End
end_points_4 = EndPoints(Curve=mirror_2.Geometry)  # -> Start, End
end_points_5 = EndPoints(Curve=dispatch_2.ListA)  # -> Start, End
end_points_6 = EndPoints(Curve=mirror_3.Geometry)  # -> Start, End
end_points_7 = EndPoints(Curve=dispatch_2.ListB)  # -> Start, End
end_points_8 = EndPoints(Curve=mirror_4.Geometry)  # -> Start, End
merge = Merge(Data1=graft(end_points.End), Data2=graft(point_on_curve), Data3=graft(end_points_2.End))
merge_2 = Merge(Data1=graft(end_points_3.End), Data2=graft(point_on_curve_2), Data3=graft(end_points_4.End))
merge_3 = Merge(Data1=graft(end_points_5.End), Data2=graft(point_on_curve_3), Data3=graft(end_points_6.End))
merge_4 = Merge(Data1=graft(end_points_7.End), Data2=graft(point_on_curve_4), Data3=graft(end_points_8.End))
interpolate = Interpolate(Vertices=merge_2, Degree=3, Periodic=False, KnotStyle=1)  # -> Curve, Length, Domain
interpolate_2 = Interpolate(Vertices=merge, Degree=3, Periodic=False, KnotStyle=1)  # -> Curve, Length, Domain
interpolate_3 = Interpolate(Vertices=merge_3, Degree=3, Periodic=False, KnotStyle=1)  # -> Curve, Length, Domain
interpolate_4 = Interpolate(Vertices=merge_4, Degree=3, Periodic=False, KnotStyle=1)  # -> Curve, Length, Domain
loft = Loft(
    Curves=[circle, move.Geometry],
    Options={Adjust=False, Closed=False, LoftEnds=0, LoftSimp=0, LoftType=0, Rebuild=10, Refit=0.01})
unit_x = UnitX(Factor=Slider(12, range=0..100))
unit_x_2 = UnitX(Factor=Slider(12, range=0..100))
unit_y = UnitY(Factor=Slider(12, range=0..100))
unit_y_2 = UnitY(Factor=Slider(12, range=0..100))
extrude = Extrude(Base=interpolate_2.Curve, Direction=expr("-x", unit_x))
extrude_2 = Extrude(Base=interpolate.Curve, Direction=unit_x_2)
extrude_3 = Extrude(Base=interpolate_3.Curve, Direction=unit_y)
extrude_4 = Extrude(Base=interpolate_4.Curve, Direction=expr("-x", unit_y_2))
brep_brep = BrepBrep(BrepA=loft, BrepB=extrude)  # -> Curves, Points
brep_brep_2 = BrepBrep(BrepA=loft, BrepB=extrude_2)  # -> Curves, Points
brep_brep_3 = BrepBrep(BrepA=loft, BrepB=extrude_3)  # -> Curves, Points
brep_brep_4 = BrepBrep(BrepA=loft, BrepB=extrude_4)  # -> Curves, Points
end_points_9 = EndPoints(Curve=[brep_brep.Curves, brep_brep_2.Curves, brep_brep_3.Curves, brep_brep_4.Curves])  # -> Start, End
move_2 = Move(Geometry=end_points_9.Start, Motion=unit_z)  # -> Geometry, Transform
line_4 = Line(StartPoint=end_points_9.Start, EndPoint=move_2.Geometry)
merge_5 = Merge(
    Data1=brep_brep.Curves,
    Data2=brep_brep_2.Curves,
    Data3=brep_brep_3.Curves,
    Data4=brep_brep_4.Curves,
    Data5=line,
    Data6=line_4,
    Data7=curve,
    Data8=move.Geometry)
pipe = Pipe(Curve=merge_5, Radius=Slider(1, range=0..1), Caps=0)  # -> graft(Pipe)
panel = Panel(pipe)
