# Grasshopper definition ARFluidsMorel_v001.gh (Grasshopper 1.0.7)
# plug-ins: FlexHopper, Bifocals, FologramForGrasshopper

number_slider = Slider(45.21, range=10..200)
number_slider_2 = Slider(15.74, range=10..200)
number_slider_3 = Slider(5, range=1..20)
number_slider_4 = Slider(35, range=5..200)
number_slider_5 = Slider(160.84, range=10..200)
number_slider_6 = Slider(148.76, range=10..200)

# ----
# Particle Distance
dom = ConstructDomain(DomainStart=expr("x*-1", number_slider_2), DomainEnd=number_slider_2)
dom_2 = ConstructDomain(DomainStart=expr("x*-1", number_slider), DomainEnd=number_slider)
range = Range(Domain=dom_2, Steps=number_slider_4)
item = ListItem(List=range, Index=0, Wrap=True)  # -> Item, Item1
subtraction = Subtraction(A=item.Item1, B=item.Item)
abs = Absolute(Value=subtraction)
particle_distance = Number(abs)

# ----
# Generate Particles
division = Division(A=number_slider_2, B=particle_distance)
range_2 = Range(Domain=dom, Steps=expr("x*2", division))
series = Series(Start=particle_distance, Step=particle_distance, Count=number_slider_3)
pt = ConstructPoint(XCoordinate=graft(range), YCoordinate=range_2, ZCoordinate=0)  # -> flatten(Point)
Z = UnitZ(Factor=series)
move = Move(Geometry=pt, Motion=graft(Z))  # -> flatten(Geometry), Transform
lng = ListLength(List=move.Geometry)
panel = Panel(lng)

# ----
# Collision planes
panel_2 = Panel("""-1
0
1
0""")
panel_3 = Panel("""0
-1
0
1""")
multiplication = Multiplication(A=number_slider_6, B=panel_2)
multiplication_2 = Multiplication(A=number_slider_5, B=panel_3)
Y = UnitY(Factor=1)
X = UnitX(Factor=1)
Y_2 = UnitY(Factor=1)  # -> expr("x*-1", UnitVector)
X_2 = UnitX(Factor=1)  # -> expr("x*-1", UnitVector)
pt_2 = ConstructPoint(XCoordinate=multiplication, YCoordinate=multiplication_2, ZCoordinate=0)
merge = Merge(Data1=X, Data2=Y, Data3=X_2, Data4=Y_2)
pt_3 = Point(pt_2)
xy = XYPlane(Origin=Point(0, 0, 0))
pl = PlaneNormal(Origin=pt_3, ZAxis=merge)
collgeometry = FlexCollisionGeometry(CollisionPlanes=flatten([xy, pl]))

number_slider_7 = Slider(1, range=0..1)
toggle = BooleanToggle(True)

number_slider_8 = Slider(0, range=0..10)
number_slider_9 = Slider(0.025, range=0..10)
number_slider_10 = Slider(0, range=0..10)

particles = ParticlesFromPoints(Positions=move.Geometry, Masses=number_slider_7, SelfCollision=toggle, IsFluid=toggle)
scene = FlexScene(Particles=flatten(particles))
syncparams = SyncParameters(
    augmented_trigger_0_key=toggle_2,
    augmented_trigger_10_key=number_slider_10,
    augmented_trigger_11_key=number_slider_8,
    augmented_trigger_12_key=number_slider_7,
    augmented_trigger_13_key=toggle,
    augmented_trigger_14_key=number_slider_9,
    augmented_trigger_15_key=number_slider_13,
    augmented_trigger_1_key=button,
    augmented_trigger_2_key=number_slider_11,
    augmented_trigger_3_key=number_slider_12,
    augmented_trigger_4_key=number_slider,
    augmented_trigger_5_key=number_slider_2,
    augmented_trigger_6_key=number_slider_3,
    augmented_trigger_7_key=number_slider_4,
    augmented_trigger_8_key=number_slider_6,
    augmented_trigger_9_key=number_slider_5,
    componentVersion=1,
    num_augmented_triggers=16)

toggle_2 = BooleanToggle(False)
button = Button()

number_slider_11 = Slider(0.2, range=0..0.3)
parameters = FlexParametersFromValues(
    Gravity=Vector(0, 0, -9.81),
    Radius=expr("x*1.33333*2", particle_distance),
    SolidRestDistance=0.15,
    FluidRestDistance=expr("x*2", particle_distance),
    CollisionDistance=0.075,
    ParticleCollisionMargin=0.5,
    ShapeCollisionMargin=0.5,
    MaxSpeed=3.402823466e+38,
    MaxAcceleration=100,
    DynamicFriction=0,
    StaticFriction=0,
    ParticleFriction=0,
    Restitution=0,
    Adhesion=0,
    SleepThreshold=0,
    ShockPropagation=0,
    Dissipation=0,
    Damping=0,
    Fluid=True,
    Viscosity=number_slider_10,
    Cohesion=number_slider_9,
    SurfaceTension=number_slider_8,
    SolidPressure=1,
    FreeSurfaceDrag=0,
    Buoyancy=1,
    PlasticThreshold=0,
    PlasticCreep=0,
    Wind=Vector(0, 0, 0),
    Drag=0,
    Lift=0,
    RelaxationMode=True,
    RelaxationFactor=1)
opts = FlexSoverOptions(
    TimeStep=number_slider_11,
    SubSteps=3,
    NumIterations=3,
    SceneMode=0,
    FixedNumberOfIteration=-1,
    MemoryRequirements=[131072, 96, 65536, 65536, 65536, 65536, 65536, 196608, 131972],
    StabilityScale=1)
flex = FlexEngine(
    FlexParams=parameters,
    FlexCollisionGeometry=collgeometry,
    FlexScene=flatten(scene),
    FlexSolverOptions=opts,
    Reset=button,
    Go=toggle_2)  # -> FlexObject, Information
number_slider_12 = Slider(1, range=1..20)
number_slider_13 = Slider(0.83, range=0..10)
panel_4 = Panel(flex.Information)
allparts = GetAllParticles(FlexObject=flex.FlexObject, N=number_slider_12)  # -> Points, Vector
msphereex = MeshSphereEx(Base=allparts.Points, Radius=number_slider_13, Count=2)
cloud = CloudDisplay(
    Points=allparts.Points,
    Colours=graft(ColourSwatch(SwatchColor=RGB(255, 255, 255))),
    Size=particle_distance,
    SpriteType=0)
geo = Geometry(<mesh referenced from the Rhino model>)
mesh = Mesh(msphereex)
preview = CustomPreview(Geometry=msphereex, Shader=ColourSwatch(SwatchColor=RGBA(212, 212, 212, 47)))
sync = SyncObject(
    GM=geo,
    AlwaysIncludeTextureCoordinates=False,
    Clickable=False,
    DefaultCurveThicknessMillimeters=2.5,
    DefaultGlossPercent=0,
    DefaultMaterialColor=RGB(255, 255, 255),
    DefaultSpecularPercent=0,
    Interactive=False,
    hasSerializedData=True)
sync_2 = SyncObject(
    GM=msphereex,
    AlwaysIncludeTextureCoordinates=False,
    Clickable=False,
    DefaultCurveThicknessMillimeters=2.5,
    DefaultGlossPercent=0,
    DefaultMaterialColor=RGB(255, 255, 255),
    DefaultSpecularPercent=0,
    Interactive=False,
    hasSerializedData=True)
