# Grasshopper definition ARWickersonStudiosSurfaceEditZahner.gh (Grasshopper 1.0.7)
# plug-ins: Bifocals

optional_seed_for_jitter_node = Slider(25, range=0..100)
# Parameters to Play with!
uv_point_count = Slider(24, range=0..100)
width = Slider(8, range=0..10)
height_map = Slider(1.58, range=0..2)
thickness_of_zinc = Slider(0.86, range=0..10)

# ----
# Optional Gene Pool
# for Dispatch Pattern
gene_pool = GenePool(
    Decimals=0,
    Maximum=1,
    Minimum=0,
    Value=[0.1016146117, 0.1933914671, 0.3456139091, 0.2262482751, 0.8090761648, 0.700994063, 0.7747656041, 0.6660769669, 0.5805381199, 0.7147953914, 0.142950405, 0.9802292283, 0.3984209748, 0.9828869188, 0.6398813481, 0.3014300569, 0.9413660471, 0.9994444111, 0.4027517617, 0.6896884486, 0.9859922752, 1, 0.06265873558, 0.1751750192, 0.9995430089, 0.07104330746, 0.7308214846, 0.05193282899, 0.03949784163, 1])

rectangle = Rectangle(Plane=PlaneXY(0, 0, 0), XSize=uv_point_count, YSize=width, Radius=0)  # -> Rectangle, Length
divide_surface = DivideSurface(Surface=rectangle.Rectangle, UCount=uv_point_count, VCount=uv_point_count)  # -> flatten(Points), Normals, Parameters
construct_domain = ConstructDomain(DomainStart=0, DomainEnd=height_map)
dispatch = Dispatch(List=divide_surface.Points, DispatchPattern=gene_pool)  # -> ListA, ListB
surface_from_points = SurfaceFromPoints(Points=divide_surface.Points, UCount=expr("x+1", uv_point_count), Interpolate=False)
list_length = ListLength(List=dispatch.ListA)  # -> flatten(Length)
range = Range(Domain=construct_domain, Steps=expr("x-1", list_length))
unit_z = UnitZ(Factor=range)
unit_z_2 = UnitZ(Factor=thickness_of_zinc)

# ----
# Optional Jitter
# Node for
# SEED
jitter = Jitter(List=unit_z, Jitter=1, Seed=optional_seed_for_jitter_node)  # -> Values, Indices

point_deform = PointDeform(Geometry=surface_from_points, Points=dispatch.ListA, Motion=unit_z)

# ----
# Bake me in to RHINO!
extrude = Extrude(Base=point_deform, Direction=unit_z_2)
