# Grasshopper definition ClayExtrusion_v002.gh (Grasshopper 1.0.7)
# plug-ins: KUKA|prc - parametric robot control

number_slider = Slider(6, range=0..10)  # disabled
crv = Curve([<curve referenced from the Rhino model> x2])  # disabled
dim_u = Slider(1, range=0..100)
dim_v = Slider(21, range=0..100)
crv_2 = Curve(<curve referenced from the Rhino model>)
panel = Panel("""0
1""")
loft = Loft(Curves=crv, Options={Adjust=False, Closed=False, LoftEnds=0, LoftSimp=0, LoftType=0, Rebuild=10, Refit=0.01})  # disabled
Z = UnitZ(Factor=1)  # disabled
eval = EvaluateCurve(Curve=reparameterize(crv_2), Parameter=[Slider(0, range=0..1), Slider(1, range=0..1)])  # -> Point, Tangent, Angle
contour = Contour(Shape=loft, Point=Point(0, 0, 0), Direction=Z, Distance=number_slider)  # disabled
multiplication = Multiplication(A=dim_u, B=dim_v)
range = Range(Domain=Domain(0, 1), Steps=dim_u)
rev = ReverseList(List=range)
pl = PlaneNormal(Origin=eval.Point, ZAxis=eval.Tangent)
subtraction = Subtraction(A=multiplication, B="1")
split = SplitList(List=rev, Index="1")  # -> ListA, ListB
polygon = Polygon(
    Plane=pl,
    Radius=[Slider(100, range=0..100), Slider(58, range=0..100)],
    Segments=[Slider(5, range=0..10), Slider(3, range=0..10)],
    FilletRadius=0)  # -> Polygon, Length
range_2 = Range(Domain=Domain(0, 1), Steps=subtraction)
rev_2 = ReverseList(List=split.ListB)
swp1 = Sweep1(Rail=crv_2, Sections=polygon.Polygon, Miter=1)
dup = DuplicateData(Data=rev_2, Number=dim_v, Order=True)
debrep = DeconstructBrep(Brep=swp1)  # -> Faces, Edges, Vertices
pt = ConstructPoint(XCoordinate=range_2, YCoordinate=dup, ZCoordinate=0)
evalsrf = EvaluateSurface(Surface=reparameterize(debrep.Faces), Point=graft(pt))  # -> Point, Normal, UDirection, VDirection, Frame
pline = PolyLine(Closed=False)
pt_2 = Point(Point(118.2418033, 365.6487876, 55.07248368))
deplane = DeconstructPlane(Plane=evalsrf.Frame)  # -> Origin, XAxis, YAxis, ZAxis
pl_2 = PlaneNormal(Origin=deplane.Origin, ZAxis=deplane.XAxis)
spindle = GenericSpindleKUKAPrc(ToolLength=100, ToolDiameter=10, ToolNumber=6)
orient_pln = OrientPlaneKUKAPrc(Plane=pl_2, OrientPoint=pt_2)
number_slider_2 = Slider(0.2258813, range=0..1)
lin_move = LINearMovementKUKAPrc(TargetAsPlane=orient_pln, extaxenabled=False, interpolation="C_DIS")  # -> flatten(KUKAPrcCommand)
kr6_10_r900 = AgilusKR610R900Robot(infiniterot=False)
play = KUKAPrcPlay(Loop=False, Reset=Toggle(True), savedtime=38.19444896)
kuka_prc = KUKAPrcCORE(
    SimulationSlider=play,
    KUKAPrcCommands=lin_move,
    Tool=spindle,
    Robot=kr6_10_r900,
    PRC_BaseExpose=False,
    PRC_SaveNameExpose=False,
    PRCsettings="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")  # -> RobotGeometry, AnalysisOutput
