# Grasshopper definition ClothSimulation_v002.gh (Grasshopper 1.0.7)
# plug-ins: FlexHopper, Weaverbird

# ----
# CAREFUL!
# go slow one this one
# complexity grows
# quadratically with increased level
number_slider = Slider(4, range=1..15)

# ----
# CAREFUL!
# go slow one this one
# complexity grows
# quadratically with increased level
number_slider_2 = Slider(3, range=1..15)  # disabled

mesh = Mesh(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)  # disabled
wbtriangles = WeaverbirdsSplitTrianglesSubdivision(MeshCurves=mesh, Level=number_slider_2)  # disabled
tri = Triangulate(Mesh=wbtriangles)  # -> Mesh, Count; disabled
number_slider_3 = Slider(52.6, range=0..100)  # disabled
number_slider_4 = Slider(0, range=0..100)  # disabled
weld = WeldMesh(Mesh=tri.Mesh, Angle=3.141592654)  # disabled
mesh_2 = Mesh(weld)  # disabled
anchors = Point([Point(-15, -15, 0), Point(15, -15, 0), Point(15, 15, 0), Point(-15, 15, 0)])  # disabled
vec = VectorXYZ(XComponent=number_slider_4, YComponent=0, ZComponent=number_slider_3)  # -> Vector, Length; disabled
move = Move(Geometry=mesh_2, Motion=graft(vec.Vector))  # -> flatten(Geometry), Transform; disabled
move_2 = Move(Geometry=anchors, Motion=graft(vec.Vector))  # -> Geometry, Transform; disabled
item = ListItem(List=move_2.Geometry, Index=[0, 1, 2], Wrap=True)  # disabled

mesh_3 = Mesh(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)
wbtriangles_2 = WeaverbirdsSplitTrianglesSubdivision(MeshCurves=mesh_3, Level=number_slider)
tri_2 = Triangulate(Mesh=wbtriangles_2)  # -> Mesh, Count
weld_2 = WeldMesh(Mesh=tri_2.Mesh, Angle=3.141592654)
vec_2 = VectorXYZ(XComponent=Slider(0, range=0..100), YComponent=0, ZComponent=Slider(53.4, range=0..100))  # -> Vector, Length
mesh_4 = Mesh(weld_2)
anchors_2 = Point([Point(-15, -15, 0), Point(15, -15, 0), Point(15, 15, 0), Point(-15, 15, 0)])
move_3 = Move(Geometry=mesh_4, Motion=graft(vec_2.Vector))  # -> flatten(Geometry), Transform
move_4 = Move(Geometry=anchors_2, Motion=graft(vec_2.Vector))  # -> Geometry, Transform
item_2 = ListItem(List=move_4.Geometry, Index=[0, 1, 2], Wrap=True)

number_slider_5 = Slider(0.1, range=0..1)
number_slider_6 = Slider(0.12, range=0..1)
number_slider_7 = Slider(0.198, range=0..1)

go = BooleanToggle(True)
reset = Button()

# ----
# Right click me to save
# params to .xml
# Alternatively use
# "FlexParameters from .xml file"
# which is more neat
# Play with me!
number_slider_8 = Slider(-1.97, range=-20..20)
vec_3 = VectorXYZ(XComponent=Slider(-1.58, range=-20..20), YComponent=number_slider_8, ZComponent=Slider(-1.75, range=-20..20))  # -> Vector, Length
vec_4 = VectorXYZ(XComponent=Slider(-4.43, range=-10..10), YComponent=0, ZComponent=Slider(-8.48, range=-10..10))  # -> Vector, Length
parameters = FlexParametersFromValues(
    Gravity=vec_4.Vector,
    Radius=number_slider_6,
    SolidRestDistance=expr("x*0.8", number_slider_6),
    FluidRestDistance=expr("x*0.9", number_slider_6),
    CollisionDistance=0.075,
    ParticleCollisionMargin=expr("x/2", 0.5),
    ShapeCollisionMargin=0.5,
    MaxSpeed=3.402823466e+38,
    MaxAcceleration=1000,
    DynamicFriction=number_slider_7,
    StaticFriction=number_slider_7,
    ParticleFriction=expr("x*0.2", number_slider_7),
    Restitution=0,
    Adhesion=0,
    SleepThreshold=0,
    ShockPropagation=0,
    Dissipation=0,
    Damping=0,
    Fluid=True,
    Viscosity=0,
    Cohesion=Slider(31.151, range=0..100),
    SurfaceTension=0,
    SolidPressure=1,
    FreeSurfaceDrag=0,
    Buoyancy=1,
    PlasticThreshold=0,
    PlasticCreep=0,
    Wind=vec_3.Vector,
    Drag=Slider(0.603, range=0..1),
    Lift=Slider(0.099, range=0..1),
    RelaxationMode=True,
    RelaxationFactor=1)

item_3 = ListItem(List=move_4.Geometry, Index=[3, 1], Wrap=True)

opts = FlexSoverOptions(
    TimeStep=Slider(0.02, range=0..0.2),
    SubSteps=Slider(5, range=1..30),
    NumIterations=Slider(5, range=1..10),
    SceneMode=0,
    FixedNumberOfIteration=-1,
    MemoryRequirements=[131072, 96, 65536, 65536, 65536, 65536, 65536, 196608, 131972],
    StabilityScale=1)

params = FlexParametersFromXmlFile()
demesh = DeconstructMesh(Mesh=move.Geometry)  # -> Vertices, Faces, Colours, Normals; disabled
pt = ConstructPoint(XCoordinate=0, YCoordinate=0, ZCoordinate=Slider(38.92, range=0..50))

number_slider_9 = Slider(0.775, range=0..1)  # disabled

cloth = ClothFromMesh(
    ClothMeshes=move_3.Geometry,
    Masses=Slider(0.32, range=0..1),
    StretchStiffness=Slider(0.97, range=0..1),
    BendingStiffness=Slider(0.18, range=0..1),
    SelfCollision=False,
    PreTension=1,
    Anchors=item_2,
    GroupIndex="0")
sph = Sphere(Base=pt, Radius=Slider(9.583, range=0..30))

xy = XYPlane(Origin=Point(0, 0, 0))
collgeometry = FlexCollisionGeometry(CollisionPlanes=flatten(xy), CollisionSpheres=flatten(sph))

item_4 = ListItem(List=move_2.Geometry, Index=[3, 1], Wrap=True)  # disabled
cp = ClosestPoint(Point=item_4, Cloud=demesh.Vertices)  # -> ClosestPoint, CPIndex, Distance; disabled
panel = Panel("""0
143""")  # disabled
number_slider_10 = Slider(-0.25, range=-3..10)  # disabled
scene = FlexScene(Cloths=flatten(cloth))
number_slider_11 = Slider(1, range=0..3)  # disabled
medges = MeshEdges(Mesh=move.Geometry)  # -> NakedEdges, InteriorEdges, NonManifoldEdges; disabled
panel_2 = Panel(cp.CPIndex)  # disabled
springs = ConstraintsSprings(SpringPairIndices=panel, TargetSpringLength=number_slider_10)  # disabled
panel_3 = Panel(scene)
number_slider_12 = Slider(11.081, range=0..100)  # disabled
len = Length(Curve=medges.InteriorEdges)  # disabled
flex = FlexEngine(
    FlexParams=parameters,
    FlexCollisionGeometry=collgeometry,
    FlexScene=flatten(scene),
    FlexSolverOptions=opts,
    Reset=reset,
    Go=go)  # -> FlexObject, Information
number_slider_13 = Slider(7, range=1..10)  # disabled
number_slider_14 = Slider(7, range=1..10)  # disabled
panel_4 = Panel("0")  # disabled
number_slider_15 = Slider(0, range=0..2)  # disabled
cloth_2 = ClothFromMesh(
    ClothMeshes=move.Geometry,
    StretchStiffness=1,
    BendingStiffness=0,
    SelfCollision=False,
    PreTension=1,
    Anchors=item,
    GroupIndex=panel_4)  # disabled
avr = Average(Input=len)  # disabled
panel_5 = Panel(avr)  # disabled
multiplication = Multiplication(A=panel_5, B=number_slider_11)  # disabled
pt_2 = ConstructPoint(XCoordinate=0, YCoordinate=0, ZCoordinate=0)  # disabled
number_slider_16 = Slider(1, range=0..1)  # disabled
panel_6 = Panel("0")  # disabled
panel_7 = Panel("1")  # disabled
vec_5 = VectorXYZ(XComponent=0, YComponent=number_slider_12, ZComponent=0)  # -> Vector, Length; disabled
panel_8 = Panel(flex.Information)
allsprings = GetAllSprings(FlexObject=flex.FlexObject, N=1)

# ----
# Enable me if you need me
# as I slow down simulation
number_slider_17 = Slider(22, range=1..100)
allsprings_2 = GetAllSprings(FlexObject=flex.FlexObject, N=number_slider_17)
preview = CustomPreview(Geometry=allsprings_2, Shader=ColourSwatch(SwatchColor=RGB(255, 255, 255)))

anchor = ConstraintsAnchors(AnchorIndex=panel_6)  # disabled
particles = ParticlesFromPoints(Points=pt_2, GroupIndex=panel_7)  # disabled
parameters_2 = FlexParametersFromValues(
    Gravity=Vector(0, 0, -9.81),
    Radius=multiplication,
    SolidRestDistance=multiplication,
    FluidRestDistance=0.1,
    CollisionDistance=0.075,
    ParticleCollisionMargin=0.5,
    ShapeCollisionMargin=0.5,
    MaxSpeed=3.402823466e+38,
    MaxAcceleration=100,
    DynamicFriction=0,
    StaticFriction=0,
    ParticleFriction=0,
    Restitution=0,
    Adhesion=0,
    SleepThreshold=0,
    ShockPropagation=0,
    Dissipation=0,
    Damping=0,
    Fluid=True,
    Viscosity=0,
    Cohesion=0.025,
    SurfaceTension=0,
    SolidPressure=1,
    FreeSurfaceDrag=0,
    Buoyancy=1,
    PlasticThreshold=0,
    PlasticCreep=0,
    Wind=vec_5.Vector,
    Drag=number_slider_16,
    Lift=number_slider_16,
    RelaxationMode=True,
    RelaxationFactor=1)  # disabled
opts_2 = FlexSolverOptions(
    TimeStep=0.01666666667,
    SubSteps=number_slider_13,
    NumIterations=number_slider_14,
    SceneMode=number_slider_15,
    FixedNumberOfIteration=-1,
    MemoryRequirements=[131072, 96, 65536, 65536, 65536, 65536, 65536, 196608, 131972],
    StabilityScale=1)  # disabled
material = CreateMaterial(Diffuse=RGB(255, 105, 180), Specular=RGB(255, 255, 255), Emission=RGB(0, 0, 0), Transparency=0, Shine=0)
scene_2 = FlexScene(Particles=flatten(particles), Cloths=flatten(cloth_2), LocalConstraints=flatten([anchor, springs]))  # disabled
button = Button()  # disabled
toggle = BooleanToggle(False)  # disabled

# ----
# Enable me if you need me
# as I slow down simulation
cloths = GetCloths(FlexObject=flex.FlexObject, N=Slider(1, range=0..10), ClothObject=cloth, PreviewMaterial=material)  # -> Points, Vector, Meshes; disabled

multiplication_2 = Multiplication(A=cloths.Vector, B=Slider(0.01, range=0..0.01))
pt_3 = Point(cloths.Points)
flex_2 = FlexEngine(FlexParams=parameters_2, FlexScene=flatten(scene_2), FlexSolverOptions=opts_2, Reset=button, Go=toggle)  # -> FlexObject, Information; disabled
bake = InstantBake(Objects=flatten(cloths.Meshes), LayerName="Default", MaterialName=material, ClearLayer=False)
vdis = VectorDisplay(Anchor=cloths.Vector, Vector=multiplication_2)
panel_9 = Panel(flex_2.Information)  # disabled
cloths_2 = GetCloths(FlexObject=flex_2.FlexObject, N=1, ClothObject=cloth_2)  # -> Points, Vector, Meshes; disabled
allsprings_3 = GetAllSprings(FlexObject=flex_2.FlexObject, N=1)  # disabled
