# Grasshopper definition ClothTube_v001.gh (Grasshopper 1.0.7)
# plug-ins: FlexHopper, Kangaroo2 Components

number_slider = Slider(20, range=0..50)
number_slider_2 = Slider(40, range=0.0001..70)
number_slider_3 = Slider(20, range=0..50)  # disabled
number_slider_4 = Slider(40, range=0.0001..70)  # disabled
pt = ConstructPoint(XCoordinate=expr("x*-1", number_slider_2), YCoordinate=0, ZCoordinate=number_slider)
pt_2 = ConstructPoint(XCoordinate=number_slider_2, YCoordinate=0, ZCoordinate=number_slider)
yz = YZPlane(Origin=[pt_2, pt])
pt_3 = ConstructPoint(XCoordinate=expr("x*-1", number_slider_4), YCoordinate=0, ZCoordinate=number_slider_3)  # disabled
pt_4 = ConstructPoint(XCoordinate=number_slider_4, YCoordinate=0, ZCoordinate=number_slider_3)  # disabled
yz_2 = YZPlane(Origin=[pt_4, pt_3])  # disabled
number_slider_5 = Slider(18, range=0..25)
number_slider_6 = Slider(22, range=0..25)
ellipse = Ellipse(
    Plane=yz,
    Radius1=[Slider(25, range=0..50), Slider(15, range=0..50)],
    Radius2=[Slider(15, range=0..50), Slider(25, range=0..50)])  # -> Ellipse, Focus1, Focus2
avr = Average(Input=[pt_2, pt])
number_slider_7 = Slider(15, range=0..50)  # disabled
number_slider_8 = Slider(25, range=0..50)  # disabled
number_slider_9 = Slider(25, range=0..50)  # disabled
number_slider_10 = Slider(15, range=0..50)  # disabled
addition = Addition(A=number_slider_5, B=number_slider_6)
reset = Button()  # disabled
go = BooleanToggle(False)  # disabled
equals = Equality(FirstNumber=addition, SecondNumber=addition)  # -> Equality, Inequality
divide = DivideCurve(Curve=ellipse.Ellipse, Count=Slider(50, range=0..50), Kinks=False)  # -> Points, Tangents, Parameters
pipe = Pipe(Curve=ellipse.Ellipse, Radius=0.5, Caps=0)  # -> flatten(Pipe)
ellipse_2 = Ellipse(Plane=yz_2, Radius1=[number_slider_9, number_slider_10], Radius2=[number_slider_7, number_slider_8])  # -> Ellipse, Focus1, Focus2; disabled
bang = ExplodeTree(Data=divide.Points)  # -> Branch0, Branch1
rec = DataRecorder(equals.Equality, DataLimit=-10, RecordData=True)
number_slider_11 = Slider(13.691, range=1..100)  # disabled
preview = CustomPreview(Geometry=pipe, Shader=ColourSwatch(SwatchColor=RGB(161, 161, 161)))
bool = Boolean(invert(rec))
loft = Loft(
    Curves=ellipse_2.Ellipse,
    Options={Adjust=False, Closed=False, LoftEnds=0, LoftSimp=0, LoftType=0, Rebuild=10, Refit=0.01})  # disabled
item = ListItem(List=bang.Branch0, Index=number_slider_5, Wrap=True)
item_2 = ListItem(List=bang.Branch1, Index=number_slider_6, Wrap=True)
loft_2 = Loft(Curves=ellipse.Ellipse, Options={Adjust=False, Closed=False, LoftEnds=0, LoftSimp=0, LoftType=0, Rebuild=10, Refit=0.01})
number_slider_12 = Slider(50, range=1..50)
int = Integer(bool)
avr_2 = Average(Input=flatten(divide.Points))
avr_3 = Average(Input=flatten([item, item_2]))
custom_mesh_settings = SettingsCustom(
    StitchSeams=True,
    SimplePlanes=False,
    Refine=True,
    MinCount=16,
    MaxCount=400,
    AspectRatio=20,
    MaxDistance=0,
    MaxAngle=20,
    MinEdge=0,
    MaxEdge=number_slider_11)  # disabled
ma = MassAddition(Input=int)  # -> Result, PartialResults
mesh = MeshBrep(Brep=loft, Settings=custom_mesh_settings)  # disabled
mesh_uv = MeshSurface(Surface=loft_2, UCount=number_slider_12, VCount=number_slider_12, Overhang=True, Equalize=False)
vec2pt = Vector2Pt(PointA=avr_2, PointB=avr_3, Unitize=True)  # -> Vector, Length
tri = Triangulate(Mesh=mesh)  # -> Mesh, Count; disabled
panel = Panel(ma.Result)
multiplication = Multiplication(A=vec2pt.Vector, B=Slider(25.502, range=0..50))
tri_2 = Triangulate(Mesh=mesh_uv)  # -> Mesh, Count
weld = WeldMesh(Mesh=tri_2.Mesh, Angle=3.141592654)
weld_2 = WeldMesh(Mesh=tri.Mesh, Angle=3.141592654)  # disabled
move = Move(Geometry=avr_3, Motion=multiplication)  # -> Geometry, Transform
demesh = DeconstructMesh(Mesh=weld_2)  # -> Vertices, Faces, Colours, Normals; disabled
merge = Merge(Data1=flatten(item), Data2=flatten(move.Geometry), Data3=flatten(item_2))
number_slider_13 = Slider(0.001, range=0..1)  # disabled
demesh_2 = DeconstructMesh(Mesh=weld)  # -> Vertices, Faces, Colours, Normals
nv = NakedVertices(Mesh=weld)  # -> ClothedIndex, NakedIndex, ClothedPts, NakedPts
intcrv = Interpolate(Vertices=merge, Degree=3, Periodic=False, KnotStyle=1)  # -> Curve, Length, Domain
deface = DeconstructFace(Face=demesh_2.Faces)  # -> CornerA, CornerB, CornerC, CornerD
crv_cp = CurveClosestPoint(Point=demesh.Vertices, Curve=graft(ellipse_2.Ellipse))  # -> Point, Parameter, Distance; disabled
cloth = ClothFromMesh(
    ClothMeshes=weld,
    StretchStiffness=1,
    BendingStiffness=0,
    SelfCollision=Toggle(False),
    PreTension=1,
    Anchors=nv.NakedPts,
    GroupIndex=panel)
lng = ListLength(List=demesh.Vertices)  # disabled
pt_5 = ConstructPoint(XCoordinate=0, YCoordinate=0, ZCoordinate=Slider(33.763, range=0..100))
merge_2 = Merge(Data1=graft(deface.CornerA), Data2=graft(deface.CornerB), Data3=graft(deface.CornerC))  # -> simplify(Result)
panel_2 = Panel(merge_2)
smaller = SmallerThan(FirstNumber=crv_cp.Distance, SecondNumber=number_slider_13)  # -> SmallerThan, OrEqualTo; disabled
series = Series(Start=0, Step=1, Count=lng)  # disabled
division = Division(A=intcrv.Length, B=2)
dispatch = Dispatch(List=demesh.Vertices, DispatchPattern=smaller.SmallerThan)  # -> ListA, ListB; disabled
int_2 = Integer(series)  # disabled
triangles = ConstraintsTriangles(TriangleIndices=merge_2)
springs = SpringSystemFromLinesMeshes(
    Springs=weld,
    TargetSpringLength=Slider(-0.761, range=-2..2),
    SpringStiffness=Slider(0.501, range=0..1),
    SelfCollision=Toggle(False),
    Anchors=nv.NakedPts,
    GroupIndex=panel)
sph = Sphere(Base=pt_5, Radius=Slider(16.663, range=0..100))
number_slider_14 = Slider(0.3, range=0..1)  # disabled
number_slider_15 = Slider(0.775, range=0..1)  # disabled
number_slider_16 = Slider(0, range=0..1)  # disabled
dispatch_2 = Dispatch(List=int_2, DispatchPattern=smaller.SmallerThan)  # -> flatten(ListA), ListB; disabled
panel_3 = Panel(Slider(3.76, range=0..20))
number_slider_17 = Slider(-1000, range=-1000..20)  # disabled
number_slider_18 = Slider(0, range=-10000..20)  # disabled
opts = FlexSolverOptions(
    TimeStep=0.01666666667,
    SubSteps=Slider(9, range=1..20),
    NumIterations=Slider(9, range=1..20),
    SceneMode=Slider(0, range=0..100),
    FixedNumberOfIteration=-1,
    MemoryRequirements=[131072, 96, 65536, 65536, 65536, 65536, 65536, 196608, 131972],
    StabilityScale=1)
number_slider_19 = Slider(0, range=-20..20)  # disabled
collgeometry = FlexCollisionGeometry(CollisionSpheres=flatten(sph))
scene = FlexScene(Cloths=flatten(cloth))
toggle = BooleanToggle(False)  # disabled
vec = VectorXYZ(XComponent=0, YComponent=Slider(48.826, range=0..1000), ZComponent=0)  # -> Vector, Length

panel_4 = Panel("0")  # disabled
cloth_2 = ClothFromMesh(
    ClothMeshes=weld_2,
    Masses=number_slider_14,
    StretchStiffness=number_slider_15,
    BendingStiffness=number_slider_16,
    SelfCollision=toggle,
    PreTension=1,
    Anchors=dispatch.ListA,
    GroupIndex=panel_4)  # disabled

vec_2 = VectorXYZ(XComponent=number_slider_17, YComponent=number_slider_18, ZComponent=number_slider_19)  # -> Vector, Length; disabled
parameters = FlexParametersFromValues(
    Gravity=Vector(0, 0, -9.81),
    Radius=panel_3,
    SolidRestDistance=panel_3,
    FluidRestDistance=0.1,
    CollisionDistance=0.075,
    ParticleCollisionMargin=0.5,
    ShapeCollisionMargin=0.5,
    MaxSpeed=3.402823466e+38,
    MaxAcceleration=100,
    DynamicFriction=0,
    StaticFriction=0,
    ParticleFriction=0,
    Restitution=0,
    Adhesion=0,
    SleepThreshold=0,
    ShockPropagation=0,
    Dissipation=0,
    Damping=0,
    Fluid=True,
    Viscosity=0,
    Cohesion=0.025,
    SurfaceTension=0,
    SolidPressure=1,
    FreeSurfaceDrag=0,
    Buoyancy=1,
    PlasticThreshold=0,
    PlasticCreep=0,
    Wind=vec.Vector,
    Drag=Slider(0.814, range=0..100),
    Lift=Slider(0.778, range=0..1),
    RelaxationMode=True,
    RelaxationFactor=1)

# ----
# Right click me to save
# params to .xml
# Alternatively use
# "FlexParameters from .xml file"
# which is more neat
# Play with me!
number_slider_20 = Slider(0, range=-10..10)  # disabled
number_slider_21 = Slider(-9.81, range=-10..10)  # disabled
number_slider_22 = Slider(0.107, range=0..1)  # disabled
number_slider_23 = Slider(0.07, range=0..1)  # disabled
vec_3 = VectorXYZ(XComponent=number_slider_20, YComponent=0, ZComponent=number_slider_21)  # -> Vector, Length; disabled
parameters_2 = FlexParametersFromValues(
    Gravity=vec_3.Vector,
    Radius=0.15,
    SolidRestDistance=0.075,
    FluidRestDistance=0.1,
    CollisionDistance=0.075,
    ParticleCollisionMargin=0.5,
    ShapeCollisionMargin=0.5,
    MaxSpeed=3.402823466e+38,
    MaxAcceleration=1000,
    DynamicFriction=0,
    StaticFriction=0,
    Restitution=0,
    Adhesion=0,
    SleepThreshold=0,
    ShockPropagation=0,
    Dissipation=0,
    Damping=0,
    Fluid=True,
    Viscosity=0,
    Cohesion=0.025,
    SurfaceTension=0,
    SolidPressure=1,
    FreeSurfaceDrag=0,
    Buoyancy=1,
    PlasticThreshold=0,
    PlasticCreep=0,
    Wind=vec_2.Vector,
    Drag=number_slider_22,
    Lift=number_slider_23,
    RelaxationMode=True,
    RelaxationFactor=1)  # disabled

flex = FlexEngine(
    FlexParams=parameters,
    FlexCollisionGeometry=collgeometry,
    FlexScene=flatten(scene),
    FlexSolverOptions=opts,
    Reset=Button(),
    Go=Toggle(True))  # -> FlexObject, Information
number_slider_24 = Slider(8, range=2..50)  # disabled
number_slider_25 = Slider(10, range=2..50)  # disabled
number_slider_26 = Slider(1, range=0..2)  # disabled
cloths = GetCloths(FlexObject=flex.FlexObject, N=1, ClothObject=cloth)  # -> Points, Vector, Meshes
scene_2 = FlexScene(Cloths=flatten(cloth_2))  # disabled
opts_2 = FlexSolverOptions(
    TimeStep=0.02,
    SubSteps=number_slider_24,
    NumIterations=number_slider_25,
    SceneMode=number_slider_26,
    FixedNumberOfIteration=-1,
    MemoryRequirements=[131072, 96, 65536, 65536, 65536, 65536, 65536, 196608, 131972],
    StabilityScale=1)  # disabled
msphereex = MeshSphereEx(Base=cloths.Points, Radius=expr("x*0.5", panel_3), Count=5)  # disabled
flex_2 = FlexEngine(FlexParams=parameters_2, FlexScene=flatten(scene_2), FlexSolverOptions=opts_2, Reset=reset, Go=go)  # -> FlexObject, Information; disabled
swatch = ColourSwatch(SwatchColor=RGB(255, 255, 255))  # disabled
material = CreateMaterial(Diffuse=swatch, Specular=RGB(255, 255, 255), Emission=RGB(0, 0, 0), Transparency=0, Shine=0)  # disabled
cloths_2 = GetCloths(FlexObject=flex_2.FlexObject, N=0, ClothObject=cloth_2, PreviewMaterial=material)  # -> Points, Vector, Meshes; disabled
