# Grasshopper definition December25th2019WickersonStudios.gh (Grasshopper 1.0.7)
# plug-ins: Bifocals

number_slider = Slider(8, range=1..14)
rectangle = Rectangle(Plane=PlaneXY(0, 0, 0), XSize=number_slider, YSize=number_slider, Radius=0)  # -> Rectangle, Length
boundary_surfaces = BoundarySurfaces(Edges=rectangle.Rectangle)
divide_surface = DivideSurface(Surface=boundary_surfaces, UCount=10, VCount=10)  # -> Points, Normals, Parameters
construct_domain = ConstructDomain(DomainStart=Slider(0.46, range=0..1), DomainEnd=Slider(10, range=0..10))
list_length = ListLength(List=divide_surface.Points)
range = Range(Domain=construct_domain, Steps=expr("x-1", list_length))  # -> flatten(Range)
construct_domain_2 = ConstructDomain(DomainStart=0, DomainEnd=1)
jitter = Jitter(List=range, Jitter=1, Seed=2)  # -> Values, Indices
unit_z = UnitZ(Factor=jitter.Values)
range_2 = Range(Domain=construct_domain_2, Steps=10)
move = Move(Geometry=graft(divide_surface.Points), Motion=graft(unit_z))  # -> flatten(Geometry), Transform
construct_point = ConstructPoint(XCoordinate=graft(range_2), YCoordinate=range_2, ZCoordinate=0)
surface_from_points = SurfaceFromPoints(Points=move.Geometry, UCount=list_length, Interpolate=False)  # -> flatten(Surface)
evaluate_surface = EvaluateSurface(Surface=reparameterize(flatten(surface_from_points)), Point=flatten(construct_point))  # -> Point, Normal, Frame
deconstruct_brep = DeconstructBrep(Brep=surface_from_points)  # -> Faces, Edges, Vertices
move_2 = Move(Geometry=evaluate_surface.Point, Motion=evaluate_surface.Normal)  # -> Geometry, Transform
surface_from_points_2 = SurfaceFromPoints(Points=move_2.Geometry, UCount=list_length, Interpolate=False)  # -> flatten(Surface)
deconstruct_brep_2 = DeconstructBrep(Brep=surface_from_points_2)  # -> Faces, Edges, Vertices
list_item = ListItem(List=deconstruct_brep.Edges, Index=0, Wrap=True)  # -> Item, Item1, Item2, Item3
list_item_2 = ListItem(List=deconstruct_brep_2.Edges, Index=0, Wrap=True)  # -> Item, Item1, Item2, Item3
geometry = Geometry(list_item_2.Item1)
geometry_2 = Geometry(list_item.Item1)
geometry_3 = Geometry(list_item_2.Item)
geometry_4 = Geometry(list_item.Item)
geometry_5 = Geometry(list_item_2.Item2)
geometry_6 = Geometry(list_item.Item2)
geometry_7 = Geometry(list_item_2.Item3)
geometry_8 = Geometry(list_item.Item3)
geometry_9 = Geometry(surface_from_points)
geometry_10 = Geometry(surface_from_points_2)
loft = Loft(
    Curves=[geometry_2, geometry],
    Options={Adjust=False, Closed=False, LoftEnds=0, LoftSimp=0, LoftType=0, Rebuild=10, Refit=0.01})  # -> flatten(Loft)
loft_2 = Loft(
    Curves=[geometry_6, geometry_5],
    Options={Adjust=False, Closed=False, LoftEnds=0, LoftSimp=0, LoftType=0, Rebuild=10, Refit=0.01})  # -> flatten(Loft)
loft_3 = Loft(
    Curves=[geometry_8, geometry_7],
    Options={Adjust=False, Closed=False, LoftEnds=0, LoftSimp=0, LoftType=0, Rebuild=10, Refit=0.01})  # -> flatten(Loft)
loft_4 = Loft(
    Curves=[geometry_4, geometry_3],
    Options={Adjust=False, Closed=False, LoftEnds=0, LoftSimp=0, LoftType=0, Rebuild=10, Refit=0.01})  # -> flatten(Loft)

list_item_3 = ListItem(List=geometry_9, Index=0, Wrap=True)
list_item_4 = ListItem(List=geometry_10, Index=0, Wrap=True)

list_item_5 = ListItem(List=loft_4, Index=0, Wrap=True)
list_item_6 = ListItem(List=loft, Index=0, Wrap=True)
list_item_7 = ListItem(List=loft_2, Index=0, Wrap=True)
list_item_8 = ListItem(List=loft_3, Index=0, Wrap=True)

brep_join = BrepJoin(Breps=[list_item_3, list_item_4, list_item_5, list_item_6, list_item_7, list_item_8])  # -> Breps, Closed
