# Grasshopper definition FluidsMorels_v002.gh (Grasshopper 1.0.7)
# plug-ins: FlexHopper, FologramForGrasshopper

number_slider = Slider(35.867, range=0.001..200)
number_slider_2 = Slider(3, range=1..5)
dom = ConstructDomain(DomainStart=expr("x*-1", number_slider), DomainEnd=number_slider)
range = Range(Domain=dom, Steps=expr("x-1", number_slider_2))
random = Random(Range=Domain(0, 1), Number=expr("x*x*x*3", number_slider_2), Seed=2)
partition = PartitionList(List=random, Size=3)
addition = Addition(A=range, B=number_slider)
pt = ConstructPoint(XCoordinate=range, YCoordinate=graft(range), ZCoordinate=0)
Z = UnitZ(Factor=addition)
item = ListItem(List=partition, Index=0, Wrap=True)  # -> Item, Item1, Item2
move = Move(Geometry=flatten(pt), Motion=graft(Z))  # -> flatten(Geometry), Transform
vec = VectorXYZ(XComponent=item.Item, YComponent=item.Item1, ZComponent=item.Item2)  # -> flatten(Vector), Length
pl = PlaneNormal(Origin=move.Geometry, ZAxis=vec.Vector)

number_slider_3 = Slider(-1, range=-3.1415..3.1416)
xz = XZPlane(Origin=Point(0, 0, 0))
yz = YZPlane(Origin=Point(0, 0, 0))
rotate = Rotate(Geometry=xz, Angle=number_slider_3, Plane=yz)  # -> Geometry, Transform
vec_2 = VectorXYZ(XComponent=0, YComponent="100", ZComponent=0)  # -> Vector, Length
move_2 = Move(Geometry=rotate.Geometry, Motion=vec_2.Vector)  # -> Geometry, Transform
rotate_2 = Rotate(Geometry=move_2.Geometry, Angle=[0, 1.570796327, 3.141592654, 4.71238898], Plane=PlaneXY(0, 0, 0))  # -> Geometry, Transform

number_slider_4 = Slider(59.294, range=0..300)
xy = XYPlane(Origin=Point(0, 0, 0))

# ----
# Colliding Boxes
number_slider_5 = Slider(10.8, range=0..50)
box = CenterBox(Base=pl, X=number_slider_5, Y=number_slider_5, Z=number_slider_5)  # disabled

pln = Plane([rotate_2.Geometry, xy])

# ----
# ACTIVATE ME!
toggle = BooleanToggle(True)
number_slider_6 = Slider(34.8, range=0..500)
number_slider_7 = Slider(2, range=0..3)
number_slider_8 = Slider(3, range=1..100)
number_slider_9 = Slider(37.9308, range=0..50)
number_slider_10 = Slider(102.976, range=0..300)
timer = Timer(TimerInterval=1000, Target=fountain)
item_2 = ListItem(List=pln, Index=number_slider_7, Wrap=True)
vec_3 = VectorXYZ(XComponent=0, YComponent=number_slider_10, ZComponent=number_slider_4)  # -> Vector, Length
move_3 = Move(Geometry=item_2, Motion=vec_3.Vector)  # -> Geometry, Transform
cir = Circle(Plane=move_3.Geometry, Radius=expr("x/2", number_slider_6))
fountain = ParticleFountain(
    OriginPlane=move_3.Geometry,
    ParticleCount=number_slider_8,
    Diameter=number_slider_6,
    RandomDirectionRange=0,
    Velocity=number_slider_9,
    RandomPositions=toggle)  # -> Points, Velocities

panel = Panel(fountain.Points)
mesh = Mesh(<mesh referenced from the Rhino model>)
toggle_2 = BooleanToggle(True)
toggle_3 = BooleanToggle(False)
orient = Orient(Geometry=mesh, Source=PlaneXY(0, 0, 0), Target=pl)  # -> Geometry, Transform
number_slider_11 = Slider(10, range=0.01..20)
number_slider_12 = Slider(8, range=0.01..10)
number_slider_13 = Slider(10, range=0..30)
number_slider_14 = Slider(4, range=0..10)
number_slider_15 = Slider(0, range=0..10)
particles = ParticlesFromPoints(Positions=fountain.Points, Velocities=fountain.Points, SelfCollision=toggle_2, IsFluid=toggle_3)
syncparams = SyncParameters(
    augmented_trigger_0_key=toggle_4,
    augmented_trigger_10_key=number_slider_18,
    augmented_trigger_11_key=number_slider_3,
    augmented_trigger_12_key=number_slider_12,
    augmented_trigger_13_key=number_slider_13,
    augmented_trigger_14_key=preview_spheres,
    augmented_trigger_15_key=number_slider_15,
    augmented_trigger_16_key=detail,
    augmented_trigger_17_key=toggle_3,
    augmented_trigger_18_key=number_slider_6,
    augmented_trigger_19_key=toggle,
    augmented_trigger_1_key=button,
    augmented_trigger_20_key=number_slider_8,
    augmented_trigger_21_key=number_slider_10,
    augmented_trigger_22_key=number_slider_9,
    augmented_trigger_23_key=number_slider_7,
    augmented_trigger_24_key=number_slider_16,
    augmented_trigger_25_key=number_slider_4,
    augmented_trigger_2_key=number_slider_17,
    augmented_trigger_3_key=number_slider_5,
    augmented_trigger_4_key=flip_faces,
    augmented_trigger_5_key=number_slider_11,
    augmented_trigger_6_key=toggle_2,
    augmented_trigger_7_key=number_slider_14,
    augmented_trigger_8_key=number_slider_2,
    augmented_trigger_9_key=number_slider,
    componentVersion=1,
    num_augmented_triggers=27)
sync = SyncObject(
    GM=orient.Geometry,
    AlwaysIncludeTextureCoordinates=False,
    Clickable=False,
    DefaultCurveThicknessMillimeters=2.5,
    DefaultGlossPercent=0,
    DefaultMaterialColor=RGB(255, 255, 255),
    DefaultSpecularPercent=0,
    Interactive=False,
    hasSerializedData=True)

# ----
# SCENEMODE MATTERS
number_slider_16 = Slider(1, range=0..2)

number_slider_17 = Slider(0.04, range=1e-05..0.2)
parameters = FlexParametersFromValues(
    Gravity=Vector(0, 0, -9.81),
    Radius=number_slider_11,
    SolidRestDistance=0.15,
    FluidRestDistance=number_slider_12,
    CollisionDistance=number_slider_14,
    ParticleCollisionMargin=number_slider_13,
    ShapeCollisionMargin=number_slider_15,
    MaxSpeed=3.402823466e+38,
    MaxAcceleration=100,
    DynamicFriction=0,
    StaticFriction=0,
    ParticleFriction=0,
    Restitution=0,
    Adhesion=0,
    SleepThreshold=0,
    ShockPropagation=0,
    Dissipation=0,
    Damping=0,
    Fluid=True,
    Viscosity=0,
    Cohesion=0.025,
    SurfaceTension=0,
    SolidPressure=1,
    FreeSurfaceDrag=0,
    Buoyancy=1,
    PlasticThreshold=0,
    PlasticCreep=0,
    Wind=Vector(0, 0, 0),
    Drag=0,
    Lift=0,
    RelaxationMode=True,
    RelaxationFactor=1)
collgeometry = FlexCollisionGeometry(CollisionPlanes=flatten(pln), CollisionBoxes=flatten(box), CollisionMeshes=flatten(orient.Geometry))
scene = FlexScene(Particles=flatten(particles))
opts = FlexSolverOptions(
    TimeStep=number_slider_17,
    SubSteps=3,
    NumIterations=3,
    SceneMode=number_slider_16,
    FixedNumberOfIteration=-1,
    MemoryRequirements=[131072, 96, 65536, 65536, 65536, 65536, 65536, 196608, 131972],
    StabilityScale=1)
button = Button()
toggle_4 = BooleanToggle(False)
flex = FlexEngine(
    FlexParams=parameters,
    FlexCollisionGeometry=collgeometry,
    FlexScene=flatten(scene),
    FlexSolverOptions=opts,
    Reset=button,
    Go=toggle_4)  # -> FlexObject, Information
preview_spheres = BooleanToggle(False)
particles_2 = GetParticleDescription(FlexObject=flex.FlexObject, N=1)  # disabled
gate = StreamGate(Stream=flex.FlexObject, Gate=preview_spheres)  # -> Target0, Target1

# ----
# Visualisation
allparts = GetAllParticles(FlexObject=gate.Target0, N=1)  # -> Points, Vector
detail = Slider(6, range=2..8)
msphereex = MeshSphereEx(Base=allparts.Points, Radius=expr("x*0.5", number_slider_11), Count=3)
msphereex_2 = MeshSphereEx(Base=allparts.Points, Radius=expr("x*0.5", number_slider_12), Count=detail)  # disabled
swatch = ColourSwatch(SwatchColor=RGBA(255, 0, 0, 200))  # disabled
swatch_2 = ColourSwatch(SwatchColor=RGBA(255, 82, 82, 98))  # disabled
msphereex_3 = MeshSphereEx(Base=allparts.Points, Radius=number_slider_13, Count=detail)  # disabled
msphereex_4 = MeshSphereEx(Base=allparts.Points, Radius=number_slider_14, Count=detail)  # disabled
msphereex_5 = MeshSphereEx(Base=allparts.Points, Radius=number_slider_15, Count=detail)  # disabled
swatch_3 = ColourSwatch(SwatchColor=RGB(255, 251, 0))  # disabled
swatch_4 = ColourSwatch(SwatchColor=RGBA(255, 253, 122, 84))  # disabled
preview = CustomPreview(Geometry=msphereex, Shader=ColourSwatch(SwatchColor=RGBA(0, 187, 255, 0)))
preview_2 = CustomPreview(Geometry=msphereex_2, Shader=swatch)  # disabled
preview_3 = CustomPreview(Geometry=msphereex_3, Shader=swatch_2)  # disabled
preview_4 = CustomPreview(Geometry=msphereex_4, Shader=swatch_3)  # disabled
preview_5 = CustomPreview(Geometry=msphereex_5, Shader=swatch_4)  # disabled

allparts_2 = GetAllParticles(FlexObject=gate.Target0, N=1)  # -> Points, Vector
sync_2 = SyncObject(
    AlwaysIncludeTextureCoordinates=False,
    Clickable=False,
    DefaultCurveThicknessMillimeters=2.5,
    DefaultGlossPercent=0,
    DefaultMaterialColor=RGB(255, 255, 255),
    DefaultSpecularPercent=0,
    Interactive=False,
    hasSerializedData=True)
sync_3 = SyncObject(
    GM=msphereex,
    AlwaysIncludeTextureCoordinates=False,
    Clickable=False,
    DefaultCurveThicknessMillimeters=2.5,
    DefaultGlossPercent=0,
    DefaultMaterialColor=RGB(255, 255, 255),
    DefaultSpecularPercent=0,
    Interactive=False,
    hasSerializedData=True)
cloud = CloudDisplay(Points=allparts_2.Points, Colours=ColourSwatch(SwatchColor=RGB(58, 164, 240)), Size=2, SpriteType=0)

flip_faces = BooleanToggle(False)
number_slider_18 = Slider(100, range=0..200)
vec_4 = VectorXYZ(XComponent=expr("x*0.7", 0), YComponent=expr("x*0.7", 0), ZComponent=expr("x*0.7", 0))  # -> Vector, Length
msphereex_6 = MeshSphereEx(Base=PlaneXY(0, 0, 0), Radius=number_slider_18, Count=5)
move_4 = Move(Geometry=msphereex_6, Motion=vec_4.Vector)  # -> Geometry, Transform

# ----
# Triangulate & Clean Up
tri = Triangulate(Mesh=move_4.Geometry)  # -> Mesh, Count

weld = WeldMesh(Mesh=tri.Mesh, Angle=3.141592654)

# ----
# Flip Face Directions
demesh = DeconstructMesh(Mesh=weld)  # -> Vertices, Faces, Colours, Normals
deface = DeconstructFace(Face=demesh.Faces)  # -> CornerA, CornerB, CornerC, CornerD
triangle = MeshTriangle(CornerA=deface.CornerA, CornerB=deface.CornerC, CornerC=deface.CornerB)
conmesh = ConstructMesh(Vertices=demesh.Vertices, Faces=triangle)

filter = StreamFilter(Gate=flip_faces, Stream1=conmesh)

facen = FaceNormals(Mesh=filter)  # -> Centers, Normals
preview_6 = CustomPreview(Geometry=filter, Shader=ColourSwatch(SwatchColor=RGBA(0, 0, 0, 32)))
vdis = VectorDisplay(Anchor=facen.Centers, Vector=expr("x*10", facen.Normals))
