# Grasshopper definition FologramAR_test001_voo1.gh (Grasshopper 1.0.7)
# plug-ins: Fologram For Grasshopper Utilities

number_slider = Slider(20, range=0..100)
mesh_sphere = MeshSphere(Base=PlaneXY(0, 0, 0), Radius=Slider(15, range=0..100), UCount=number_slider, VCount=number_slider)
decimate_mesh = DecimateMesh(Meshes=mesh_sphere, Reduction=Slider(0.82, range=0..1))
