# Grasshopper definition FologramAR_test001_voo2.gh (Grasshopper 1.0.7)
# plug-ins: FologramForGrasshopper

number_slider = Slider(1386, range=0..3100)
number_slider_2 = Slider(6, range=0..10)
mesh = Mesh(<mesh referenced from the Rhino model>)
number_slider_3 = Slider(330, range=-1..360)
sync_parameters = SyncParameters(
    augmented_trigger_0_key=number_slider,
    augmented_trigger_1_key=number_slider_2,
    augmented_trigger_2_key=number_slider_3,
    componentVersion=1,
    num_augmented_triggers=3)
unit_z = UnitZ(Factor=1)
series = Series(Start=0, Step=number_slider, Count=number_slider_2)
radians = Radians(Degrees=number_slider_3)
unit_x = UnitX(Factor=series)
rotate_3d = Rotate3D(Geometry=mesh, Angle=radians, Center=Point(0, 0, 0), Axis=unit_z)  # -> Geometry, Transform
move = Move(Geometry=rotate_3d.Geometry, Motion=unit_x)  # -> Geometry, Transform
