# Grasshopper definition GenerateBrickWall_v001.gh (Grasshopper 1.0.7)
# plug-ins: Bifocals

no_bricks_wide = Slider(22, range=0..100)
depth_mm = Slider(1018, range=0..10000)

# ---- group: Brick
length = Slider(230, range=0..1000)
width = Slider(110, range=0..1000)
height = Slider(76, range=0..100)
rectangle = Rectangle(Plane=PlaneXY(0, 0, 0), XSize=length, YSize=width, Radius=0)  # -> Rectangle, Length
boxrec = BoxRectangle(Rectangle=rectangle.Rectangle, Height=height)

# ----
no_bricks_high = Slider(28, range=0..100)
dom = ConstructDomain(DomainStart=0, DomainEnd=depth_mm)
series = Series(Start=0, Step=expr("x*1.5", length), Count=no_bricks_wide)
random = Random(Range=dom, Number=no_bricks_wide, Seed=2)
culln = CullNth(List=series, CullFrequency=2)
culln_2 = CullNth(List=random, CullFrequency=2)
pt = ConstructPoint(XCoordinate=culln, YCoordinate=culln_2, ZCoordinate=0)
intcrv = Interpolate(Vertices=pt, Degree=3, Periodic=False, KnotStyle=1)  # -> Curve, Length, Domain
