# Grasshopper definition GenerateBrickWall_v002.gh (Grasshopper 1.0.7)
# plug-ins: Bifocals

# ---- group: rick
width = Slider(119, range=0..1000)
height = Slider(76, range=0..100)
length = Slider(268, range=0..1000)
rectangle = Rectangle(Plane=PlaneXY(0, 0, 0), XSize=length, YSize=width, Radius=0)  # -> Rectangle, Length
boxrec = BoxRectangle(Rectangle=rectangle.Rectangle, Height=height)
debrep = DeconstructBrep(Brep=boxrec)  # -> Faces, Edges, Vertices
item = ListItem(List=debrep.Faces, Index=4, Wrap=True)
area = Area(Geometry=item)  # -> Area, Centroid

# ----
no_bricks_wide = Slider(22, range=0..100)
no_bricks_high = Slider(40, range=0..100)
depth_mm = Slider(1018, range=0..10000)
dom = ConstructDomain(DomainStart=0, DomainEnd=depth_mm)
multiplication = Multiplication(A=depth_mm, B=length)
random = Random(Range=dom, Number=no_bricks_wide, Seed=multiplication)
random_2 = Random(Range=dom, Number=no_bricks_wide, Seed=2)
series = Series(Start=0, Step=expr("x*1.5", length), Count=no_bricks_wide)
culln = CullNth(List=random, CullFrequency=2)
culln_2 = CullNth(List=series, CullFrequency=2)
culln_3 = CullNth(List=random_2, CullFrequency=2)
pt = ConstructPoint(XCoordinate=culln_2, YCoordinate=culln, ZCoordinate=0)
pt_2 = ConstructPoint(XCoordinate=culln_2, YCoordinate=culln_3, ZCoordinate=0)
multiplication_2 = Multiplication(A=height, B=no_bricks_high)
intcrv = Interpolate(Vertices=pt_2, Degree=3, Periodic=False, KnotStyle=1)  # -> Curve, Length, Domain
intcrv_2 = Interpolate(Vertices=pt, Degree=3, Periodic=False, KnotStyle=1)  # -> Curve, Length, Domain
Z = UnitZ(Factor=multiplication_2)
move = Move(Geometry=intcrv_2.Curve, Motion=Z)  # -> Geometry, Transform
loft = Loft(
    Curves=[intcrv.Curve, move.Geometry],
    Options={Adjust=False, Closed=False, LoftEnds=0, LoftSimp=0, LoftType=0, Rebuild=10, Refit=0.01})
contour = Contour(Shape=loft, Point=Point(0, 0, 0), Direction=Vector(0, 0, 1), Distance=height)
hframes = HorizontalFrames(Curve=contour, Count=expr("x*2", no_bricks_wide))  # -> Frames, Parameters
orient = Orient(Geometry=boxrec, Source=area.Centroid, Target=hframes.Frames)  # -> flatten(Geometry), Transform
culln_4 = CullNth(List=orient.Geometry, CullFrequency=2)
