# Grasshopper definition January10tth2020WickersonStudiosCupola001.gh (Grasshopper 1.0.7)
# plug-ins: Bifocals

number_slider = Slider(0.3, range=0..1)
ellipse = Ellipse(Plane=PlaneXY(0, 0, 0), Radius1=number_slider, Radius2=Slider(1, range=0..1))  # -> Ellipse, Focus1, Focus2

pt = ConstructPoint(XCoordinate=0, YCoordinate=0, ZCoordinate=0)
X = UnitX(Factor=Slider(7, range=3..10))
neg = Negative(Value=X)
merge = Merge(Data1=X, Data2=neg)
move = Move(Geometry=pt, Motion=merge)  # -> Geometry, Transform
pi = Pi(Factor=Slider(0.06, range=-0.2..0.2))
pl = PlaneNormal(Origin=move.Geometry, ZAxis=X)
X_2 = UnitX(Factor=1)
Y = UnitY(Factor=1)
circle = CircleCNR(Center=move.Geometry, Normal=pl, Radius=Slider(8.07, range=0..10))  # -> flatten(Circle)
pt_2 = Point(graft(move.Geometry))
item = ListItem(List=circle, Index=Slider(0, range=0..1), Wrap=True)
item_2 = ListItem(List=circle, Index=Slider(1, range=0..1), Wrap=True)
line = LineSDL(Start=item, Direction=Y, Length=1)
line_2 = LineSDL(Start=item_2, Direction=Y, Length=1)
neg_2 = Negative(Value=pi)
rotax = RotateAxis(Geometry=item, Angle=pi, Axis=line)  # -> Geometry, Transform
rotax_2 = RotateAxis(Geometry=item_2, Angle=neg_2, Axis=line_2)  # -> Geometry, Transform
merge_2 = Merge(Data1=rotax.Geometry, Data2=rotax_2.Geometry)
crv = Curve(merge_2)
divide = DivideCurve(Curve=merge_2, Count=Slider(7, range=0..10), Kinks=False)  # -> Points, Tangents, Parameters
ln = Line(StartPoint=pt_2, EndPoint=divide.Points)

pframes = PerpFrames(Curve=[rotax_2.Geometry, rotax.Geometry], Count=10, Align=True)  # -> Frames, Parameters
orient = Orient(Geometry=ellipse.Ellipse, Source=PlaneXY(0, 0, 0), Target=pframes.Frames)  # -> Geometry, Transform
pipe = Pipe(Curve=ln, Radius=number_slider, Caps=Slider(1, range=0..1))  # -> flatten(Pipe)
loft = Loft(Curves=orient.Geometry, Options={Adjust=False, Closed=True, LoftEnds=0, LoftSimp=0, LoftType=0, Rebuild=10, Refit=0.01})  # -> flatten(Loft)

crv_2 = Curve(ellipse.Ellipse)
cir = Circle(Plane=PlaneXY(0, 0, 0), Radius=Slider(46, range=0..100))
flow = Flow(Geometry=crv, Base=cir, Target=crv_2, ReverseBase=False, ReverseTarget=False, Stretch=True, Rigid=False)
pipe_2 = Pipe(Curve=flow, Radius=1, Caps=0)

sunion = SolidUnion(Breps=[pipe, loft])
