# Grasshopper definition January12th2020WickersonStudios.gh (Grasshopper 1.0.7)
# plug-ins: Bifocals

number_slider = Slider(10, range=0..10)
number_slider_2 = Slider(8, range=0..30)
neg = Negative(Value=number_slider)
dom = ConstructDomain(DomainStart=number_slider, DomainEnd=neg)
range = Range(Domain=dom, Steps=number_slider_2)
neg_2 = Negative(Value=range)
division = Division(A=number_slider_2, B=Slider(2, range=0..10))
rectangle = Rectangle(Plane=PlaneXY(0, 0, 0), XSize=range, YSize=neg_2, Radius=0)  # -> Rectangle, Length
dom_2 = ConstructDomain(DomainStart=Slider(0.1, range=0..0.1), DomainEnd=Slider(0.1, range=-0.5..0.5))
Z = UnitZ(Factor=rectangle.Length)
move = Move(Geometry=rectangle.Rectangle, Motion=Z)  # -> Geometry, Transform
range_2 = Range(Domain=dom_2, Steps=Slider(6, range=0..10))
cpoly = ControlPolygon(Curve=move.Geometry)  # -> Polygon, Points
pi = Pi(Factor=range_2)
panel = Panel(cpoly.Polygon)
rotate = Rotate(Geometry=cpoly.Polygon, Angle=pi, Plane=PlaneXY(0, 0, 0))  # -> Geometry, Transform
eval = Evaluate(F="Contains(x,\"Invalid\")", x=panel)
# shins
dispatch = Dispatch(List=rotate.Geometry, DispatchPattern=eval)  # -> ListA, ListB
crv = Curve(dispatch.ListB)
split = SplitList(List=crv, Index=division)  # -> ListA, ListB
loft = Loft(Curves=split.ListA, Options={Adjust=False, Closed=False, LoftEnds=0, LoftSimp=0, LoftType=0, Rebuild=10, Refit=0.01})
loft_2 = Loft(Curves=split.ListB, Options={Adjust=False, Closed=False, LoftEnds=0, LoftSimp=0, LoftType=0, Rebuild=10, Refit=0.01})
cap = CapHoles(Brep=loft_2)
cap_2 = CapHoles(Brep=loft)
join = BrepJoin(Breps=[cap_2, cap])  # -> Breps, Closed

debrep = DeconstructBrep(Brep=join.Breps)  # -> Faces, Edges, Vertices

item = ListItem(List=debrep.Faces, Index=Slider(0, range=0..10), Wrap=True)  # -> Item, Item1

# ----
# thighs and feet
srf = Surface(item.Item)
srf_2 = Surface(item.Item1)
debrep_2 = DeconstructBrep(Brep=srf)  # -> Faces, Edges, Vertices
debrep_3 = DeconstructBrep(Brep=srf_2)  # -> Faces, Edges, Vertices
crv_2 = Curve(reparameterize(debrep_2.Edges))
crv_3 = Curve(reparameterize(debrep_3.Edges))
merge = Merge(Data1=crv_2, Data2=crv_3)  # -> graft(Result)
eval_2 = EvaluateCurve(Curve=merge, Parameter=Slider(0.5, range=0..1))  # -> Point, Tangent, Angle
rotate_2 = Rotate(Geometry=eval_2.Tangent, Angle=1.570796327, Plane=PlaneXY(0, 0, 0))  # -> Geometry, Transform
multiplication = Multiplication(A=rotate_2.Geometry, B=Slider(10, range=0..10))
neg_3 = Negative(Value=multiplication)
move_2 = Move(Geometry=merge, Motion=neg_3)  # -> Geometry, Transform
md_slider = MDSlider(SliderMode=0, slider_value=Point(0.5, 0.5, 0.5), x_domain=Domain(0, 1), y_domain=Domain(0, 1), z_domain=Domain(0, 1))
loft_3 = Loft(
    Curves=[move_2.Geometry, merge],
    Options={Adjust=False, Closed=False, LoftEnds=0, LoftSimp=0, LoftType=0, Rebuild=10, Refit=0.01})
evalsrf = EvaluateSurface(Surface=loft_3, Point=md_slider)  # -> Point, Normal, UDirection, VDirection, Frame
multiplication_2 = Multiplication(A=evalsrf.Normal, B=Slider(9.796, range=0..10))
extr = Extrude(Base=loft_3, Direction=multiplication_2)  # -> flatten(Extrusion)

geo = Geometry(flatten([extr, cap_2, cap]))
