# Grasshopper definition January15th2020WickersonStudiosOptimizationCupola002.gh (Grasshopper 1.0.7)
# plug-ins: Millipede

brep = Brep(<brep referenced from the Rhino model>)
brep_2 = Brep(<brep referenced from the Rhino model>)
brep_3 = Brep(<brep referenced from the Rhino model>)
brep_4 = Brep(<brep referenced from the Rhino model>)
brep_5 = Brep(<brep referenced from the Rhino model>)
mat = SupportType(X=Toggle(True), Y=Toggle(True), Z=Toggle(True), RX=Toggle(True), RY=Toggle(True), RZ=Toggle(True))
mat_2 = SupportType(X=Toggle(True), Y=Toggle(True), Z=Toggle(True), RX=Toggle(True), RY=Toggle(True), RZ=Toggle(True))
support = _3DSupportRegion(Boundary=brep_5, SupportType=mat, AmendExistingSupports=True)
boundary = _3DBoundaryRegion(Boundary=brep_4, IsVoid=False)
density = _3DDensityRegion(Boundary=brep_2, Density=0.01)
support_2 = _3DSupportRegion(Boundary=brep_3, SupportType=mat_2, AmendExistingSupports=True)
Z = UnitZ(Factor=Slider(1, range=0..1))
rev = Reverse(Vector=Z)
load = _3DLoadRegion(Boundary=brep, Load=rev)
mat_3 = Material(MaterialType=10)
topostruct_3d = Topostruct3DModel(ModelComponents=[boundary, density, load, mat_3, support_2, support], XResolution=Slider(50, range=0..100))  # -> FEModel, CellCentres, CellSize
topostruct_3d_solver = Topostruct3DSolver(
    FEModel=topostruct_3d.FEModel,
    SelfWeightCoefficient=Slider(1, range=0..1),
    OptimisationIterations=Slider(8, range=0..12),
    Smoothing=0.1,
    Penalization=3,
    TargetDensity=0.4,
    MinimumDensity=0.001,
    DeleteThreshold=0.5,
    PeriodicX=False,
    PeriodicY=False,
    PeriodicZ=False,
    LoadCase=0,
    AllCases=True)  # -> FEModel, MaxDeflection
multiplication = Multiplication(A=topostruct_3d_solver.MaxDeflection, B=Slider(1, range=1..3))
panel = Panel(topostruct_3d_solver.MaxDeflection)
_3d_iso_mesh = _3DIsoMesh(FEModel=topostruct_3d_solver.FEModel, Deflection=multiplication, IsoContourValue=0.5, ColorMode=4)
mesh = Mesh(_3d_iso_mesh)
