# Grasshopper definition January15tth2020WickersonStudiosCupolaCartAlgorithm001.gh (Grasshopper 1.0.7)

# ----
# Cupola Cart, Algorithm 001, Wickerson Studios, 2020
number_slider = Slider(6.214, range=3..7)

number_slider_2 = Slider(1.37, range=0..2)
ellipse = Ellipse(Plane=PlaneXY(0, 0, 0), Radius1=Slider(0.3, range=0..1), Radius2=number_slider_2)  # -> Ellipse, Focus1, Focus2
division = Division(A=number_slider_2, B=Slider(2, range=2..5))

Y = UnitY(Factor=1)
pt = ConstructPoint(XCoordinate=0, YCoordinate=0, ZCoordinate=0)
X = UnitX(Factor=number_slider)
neg = Negative(Value=X)
merge = Merge(Data1=X, Data2=neg)
move = Move(Geometry=pt, Motion=merge)  # -> Geometry, Transform
pl = PlaneNormal(Origin=move.Geometry, ZAxis=X)
circle = CircleCNR(Center=move.Geometry, Normal=pl, Radius=Slider(3.59, range=0..10))  # -> flatten(Circle)
pi = Pi(Factor=Slider(-0.06, range=-0.2..0.2))
item = ListItem(List=circle, Index="1", Wrap=True)
item_2 = ListItem(List=circle, Index="0", Wrap=True)
line = LineSDL(Start=item_2, Direction=Y, Length=1)
line_2 = LineSDL(Start=item, Direction=Y, Length=1)
neg_2 = Negative(Value=pi)
rotax = RotateAxis(Geometry=item_2, Angle=pi, Axis=line)  # -> Geometry, Transform
rotax_2 = RotateAxis(Geometry=item, Angle=neg_2, Axis=line_2)  # -> Geometry, Transform
merge_2 = Merge(Data1=rotax.Geometry, Data2=rotax_2.Geometry)
pt_2 = Point(graft(move.Geometry))
divide = DivideCurve(Curve=merge_2, Count=Slider(5, range=2..10), Kinks=False)  # -> Points, Tangents, Parameters
pframes = PerpFrames(Curve=[rotax_2.Geometry, rotax.Geometry], Count=10, Align=True)  # -> Frames, Parameters
ln = Line(StartPoint=pt_2, EndPoint=divide.Points)
orient = Orient(Geometry=ellipse.Ellipse, Source=PlaneXY(0, 0, 0), Target=pframes.Frames)  # -> Geometry, Transform
crv = Curve(merge_2)
pipe = Pipe(Curve=ln, Radius=division, Caps="1")  # -> flatten(Pipe)
loft = Loft(Curves=orient.Geometry, Options={Adjust=False, Closed=True, LoftEnds=0, LoftSimp=0, LoftType=0, Rebuild=10, Refit=0.01})  # -> flatten(Loft)
sunion = SolidUnion(Breps=[pipe, loft])

pt_3 = Point(pt_2)
pt_4 = Point(pt)
Z = UnitZ(Factor=Slider(3.97, range=-1..5))
split = SplitList(List=flatten(pt_3), Index=Slider(1, range=0..1))  # -> ListA, ListB
move_2 = Move(Geometry=pt_4, Motion=Z)  # -> Geometry, Transform
addition = Addition(A=number_slider, B="1")
arc = Arc3Pt(PointA=split.ListA, PointB=move_2.Geometry, PointC=split.ListB)  # -> Arc, Plane, Radius
number_slider_3 = Slider(0.8, range=0.5..1.5)
curvepoint = PointOnCurve(arc.Arc, parameter=0.5)
Y_2 = UnitY(Factor=addition)
neg_3 = Negative(Value=Y_2)
Z_2 = UnitZ(Factor=number_slider)
cir = Circle(Plane=curvepoint, Radius=number_slider)
line_3 = LineSDL(Start=pt_4, Direction=neg_3, Length=addition)
move_3 = Move(Geometry=cir, Motion=Z_2)  # -> Geometry, Transform
merge_3 = Merge(Data1=cir, Data2=move_3.Geometry)  # -> flatten(Result)
pipe_2 = Pipe(Curve=line_3, Radius=number_slider_3, Caps=0)
loft_2 = Loft(Curves=[cir, merge_3], Options={Adjust=False, Closed=False, LoftEnds=0, LoftSimp=0, LoftType=0, Rebuild=10, Refit=0.01})
neg_4 = Negative(Value=Slider(0.72, range=0..1))
offset = OffsetSurface(Surface=loft_2, Distance=neg_4, Retrim=True)
cap = CapHoles(Brep=loft_2)  # -> flatten(Brep)
cap_2 = CapHoles(Brep=offset)  # -> flatten(Brep)
Z_3 = UnitZ(Factor=Slider(2.49, range=1.1..3))
sdiff = SolidDifference(BrepsA=cap, BrepsB=cap_2)
move_4 = Move(Geometry=pipe_2, Motion=Z_3)  # -> Geometry, Transform
sdiff_2 = SolidDifference(BrepsA=sdiff, BrepsB=move_4.Geometry)

merge_4 = Merge(Data1=sdiff_2, Data2=sunion)
pipe_3 = Pipe(Curve=arc.Arc, Radius=number_slider_3, Caps=0)

number_slider_4 = Slider(2, range=0..100)  # disabled
cir_2 = Circle(Plane=PlaneXY(0, 0, 0), Radius=number_slider_4)  # disabled
crv_2 = Curve(ellipse.Ellipse)  # disabled
flow = Flow(Geometry=crv, Base=cir_2, Target=crv_2, ReverseBase=False, ReverseTarget=False, Stretch=True, Rigid=False)  # disabled
pipe_4 = Pipe(Curve=flow, Radius=1, Caps=0)  # disabled

geo = Geometry(pipe_3)
