# Grasshopper definition January16tth2020WickersonStudiosCupolaCartAlgorithm001.gh (Grasshopper 1.0.7)

scale_wheels = Slider(3.71, range=0..10)
rotate_wheels = Slider(0.08, range=0..0.21)
axle_arc_height = Slider(2, range=-1..2)
well_thickness = Slider(1.24, range=0.1..3)
# Cupola Cart, Algorithm 001, Wickerson Studios, 2020
scale_well_axle = Slider(3.364, range=3..4)
number_of_spokes = Slider(7, range=2..10)
wheelband_height = Slider(0.16, range=0..1)
wheelband_width = Slider(0.92, range=0..1)
spoke_thickness_factor = Slider(2.792, range=2..5)
axle_thickness = Slider(0.162, range=0..0.5)
tap_hole_height = Slider(3.06, range=3..5)
support_thickness = Slider(0.11, range=0.05..0.3)
support_count = Slider(6, range=0..10)

Z = UnitZ(Factor=axle_arc_height)
pt = ConstructPoint(XCoordinate=0, YCoordinate=0, ZCoordinate=0)
pt_2 = Point(pt)
move = Move(Geometry=pt_2, Motion=Z)  # -> Geometry, Transform
X = UnitX(Factor=scale_well_axle)
addition = Addition(A=scale_well_axle, B="5")
neg = Negative(Value=X)
Y = UnitY(Factor=addition)
merge = Merge(Data1=X, Data2=neg)
neg_2 = Negative(Value=Y)
move_2 = Move(Geometry=pt, Motion=merge)  # -> Geometry, Transform
Z_2 = UnitZ(Factor=scale_well_axle)
line = LineSDL(Start=pt_2, Direction=neg_2, Length=addition)
multiplication = Multiplication(A=axle_thickness, B="3")
pl = PlaneNormal(Origin=move_2.Geometry, ZAxis=X)
circle = CircleCNR(Center=move_2.Geometry, Normal=pl, Radius=scale_wheels)  # -> flatten(Circle)
pipe = Pipe(Curve=line, Radius=multiplication, Caps=0)
Y_2 = UnitY(Factor=1)
neg_3 = Negative(Value=well_thickness)
pi = Pi(Factor=rotate_wheels)
item = ListItem(List=circle, Index="1", Wrap=True)
item_2 = ListItem(List=circle, Index="0", Wrap=True)
ellipse = Ellipse(Plane=PlaneXY(0, 0, 0), Radius1=wheelband_height, Radius2=wheelband_width)  # -> Ellipse, Focus1, Focus2
division = Division(A=wheelband_width, B=spoke_thickness_factor)
line_2 = LineSDL(Start=item, Direction=Y_2, Length=1)
line_3 = LineSDL(Start=item_2, Direction=Y_2, Length=1)
neg_4 = Negative(Value=pi)
Z_3 = UnitZ(Factor=tap_hole_height)
rotax = RotateAxis(Geometry=item_2, Angle=pi, Axis=line_3)  # -> Geometry, Transform
rotax_2 = RotateAxis(Geometry=item, Angle=neg_4, Axis=line_2)  # -> Geometry, Transform
move_3 = Move(Geometry=pipe, Motion=Z_3)  # -> Geometry, Transform
cap = CapHoles(Brep=move_3.Geometry)
merge_2 = Merge(Data1=rotax.Geometry, Data2=rotax_2.Geometry)
pt_3 = Point(graft(move_2.Geometry))
pt_4 = Point(pt_3)
split = SplitList(List=flatten(pt_4), Index="1")  # -> ListA, ListB
arc = Arc3Pt(PointA=split.ListA, PointB=move.Geometry, PointC=split.ListB)  # -> Arc, Plane, Radius
curvepoint = PointOnCurve(arc.Arc, parameter=0.5)
crv = Curve(reparameterize(arc.Arc))
curvepoint_2 = PointOnCurve(crv, parameter=0.75)
curvepoint_3 = PointOnCurve(crv, parameter=0.25)
cir = Circle(Plane=curvepoint, Radius=scale_well_axle)
pipe_2 = Pipe(Curve=arc.Arc, Radius=axle_thickness, Caps=0)
move_4 = Move(Geometry=cir, Motion=Z_2)  # -> Geometry, Transform
geo = Geometry(pipe_2)
merge_3 = Merge(Data1=cir, Data2=move_4.Geometry)  # -> flatten(Result)
merge_4 = Merge(Data1=curvepoint_3, Data2=curvepoint_2)  # -> graft(Result)
divide = DivideCurve(Curve=cir, Count=support_count, Kinks=False)  # -> Points, Tangents, Parameters
loft = Loft(Curves=[cir, merge_3], Options={Adjust=False, Closed=False, LoftEnds=0, LoftSimp=0, LoftType=0, Rebuild=10, Refit=0.01})
ln = Line(StartPoint=divide.Points, EndPoint=merge_4)
offset = OffsetSurface(Surface=loft, Distance=neg_3, Retrim=True)
cap_2 = CapHoles(Brep=loft)  # -> flatten(Brep)
cap_3 = CapHoles(Brep=offset)  # -> flatten(Brep)
pipe_3 = Pipe(Curve=ln, Radius=support_thickness, Caps=2)
cap_4 = CapHoles(Brep=pipe_3)
sdiff = SolidDifference(BrepsA=cap_2, BrepsB=cap_3)
sdiff_2 = SolidDifference(BrepsA=sdiff, BrepsB=cap)
divide_2 = DivideCurve(Curve=merge_2, Count=number_of_spokes, Kinks=False)  # -> Points, Tangents, Parameters
sunion = SolidUnion(Breps=[sdiff_2, cap_4])
pframes = PerpFrames(Curve=[rotax_2.Geometry, rotax.Geometry], Count=10, Align=True)  # -> Frames, Parameters
ln_2 = Line(StartPoint=pt_3, EndPoint=divide_2.Points)
orient = Orient(Geometry=ellipse.Ellipse, Source=PlaneXY(0, 0, 0), Target=pframes.Frames)  # -> Geometry, Transform
crv_2 = Curve(merge_2)

number_slider = Slider(2, range=0..100)  # disabled
cir_2 = Circle(Plane=PlaneXY(0, 0, 0), Radius=number_slider)  # disabled
crv_3 = Curve(ellipse.Ellipse)  # disabled
flow = Flow(Geometry=crv_2, Base=cir_2, Target=crv_3, ReverseBase=False, ReverseTarget=False, Stretch=True, Rigid=False)  # disabled
pipe_4 = Pipe(Curve=flow, Radius=1, Caps=0)  # disabled

pipe_5 = Pipe(Curve=ln_2, Radius=division, Caps="1")  # -> flatten(Pipe)
loft_2 = Loft(Curves=orient.Geometry, Options={Adjust=False, Closed=True, LoftEnds=0, LoftSimp=0, LoftType=0, Rebuild=10, Refit=0.01})  # -> flatten(Loft)
sunion_2 = SolidUnion(Breps=[pipe_5, loft_2])

# ----
# Bake Me!
merge_5 = Merge(Data1=sdiff_2, Data2=sunion_2, Data3=geo, Data4=sunion)
