# Grasshopper definition January16tth2020WickersonStudiosHamletsMillAlgorithm003.gh (Grasshopper 1.0.7)

# ----
# Optional Gene Pool
# for Dispatch Pattern
genes = GenePool(Decimals=0, Maximum=1, Minimum=0, Value=[0, 1, 1, 0, 1, 0, 1, 1, 1, 1])

number_slider = Slider(25, range=0..100)
cir = Circle(Plane=PlaneXY(0, 0, 0), Radius=Slider(8.92, range=0..30))
divide = DivideCurve(Curve=cir, Count=number_slider, Kinks=False)  # -> Points, Tangents, Parameters
pline = PolyLine(Vertices=divide.Points, Closed=Toggle(True))
explode = Explode(Curve=pline, Recursive=True)  # -> graft(Segments), Vertices
Z = UnitZ(Factor=Slider(5.76, range=0..10))
move = Move(Geometry=explode.Segments, Motion=Z)  # -> Geometry, Transform
md_slider = MDSlider(
    SliderMode=0,
    slider_value=Point(0.009755948695, 0, 0.5),
    x_domain=Domain(0, 1),
    y_domain=Domain(0, 1),
    z_domain=Domain(0, 1))
loft = Loft(
    Curves=[explode.Segments, move.Geometry],
    Options={Adjust=False, Closed=False, LoftEnds=0, LoftSimp=0, LoftType=0, Rebuild=10, Refit=0.01})
debrep = DeconstructBrep(Brep=loft)  # -> Faces, Edges, Vertices
evalsrf = EvaluateSurface(Surface=reparameterize(debrep.Faces), Point=md_slider)  # -> Point, Normal, UDirection, VDirection, Frame
item = ListItem(List=debrep.Edges, Index=Slider(1, range=0..1), Wrap=True)
sunion = SolidUnion()
neg = Negative(Value=evalsrf.Normal)
len = Length(Curve=item)
multiplication = Multiplication(A=neg, B=len)
extr = Extrude(Base=evalsrf.Frame, Direction=multiplication)
pi = Pi(Factor=Slider(0.5, range=0..1))
rotate = Rotate(Geometry=extr, Angle=pi, Plane=evalsrf.Point)  # -> flatten(Geometry), Transform
multiplication_2 = Multiplication(A=number_slider, B="2")
sunion_2 = SolidUnion(Breps=rotate.Geometry)
division = Division(A="360", B=multiplication_2)
rotate_2 = Rotate(Geometry=sunion_2, Angle=degrees(division), Plane=PlaneXY(0, 0, 0))  # -> Geometry, Transform
Z_2 = UnitZ(Factor=1)
move_2 = Move(Geometry=rotate_2.Geometry, Motion=Z_2)  # -> Geometry, Transform
sunion_3 = SolidUnion(Breps=[sunion_2, move_2.Geometry])
Z_3 = UnitZ(Factor=Slider(2, range=0..10))
arrlinear = LinearArray(Geometry=sunion_3, Direction=Z_3, Count=Slider(5, range=0..10))  # -> flatten(Geometry), Transform
sunion_4 = SolidUnion(Breps=arrlinear.Geometry)

number_slider_2 = Slider(3.94, range=0..30)
number_slider_3 = Slider(12, range=0..100)
pi_2 = Pi(Factor=1)
subtraction = Subtraction(A=number_slider_3, B=Slider(1, range=0..1))
division_2 = Division(A=number_slider_2, B=number_slider_3)
multiplication_3 = Multiplication(A=division_2, B=pi_2)
xz = XZPlane(Origin=Point(0, 0, 0))
pi_3 = Pi(Factor=division_2)
panel = Panel(multiplication_3)
deplane = DeconstructPlane(Plane=xz)  # -> Origin, XAxis, YAxis, ZAxis
ln = Line(StartPoint=deplane.Origin, EndPoint=deplane.YAxis)
number_slider_4 = Slider(0, range=0..10)
Z_4 = UnitZ(Factor=multiplication_3)

cir_2 = Circle(Plane=PlaneXY(0, 0, 0), Radius=number_slider_2)

hframes = HorizontalFrames(Curve=cir_2, Count=subtraction)  # -> Frames, Parameters
sph = Sphere(Base=hframes.Frames, Radius=multiplication_3)
rotax = RotateAxis(Geometry=sph, Angle=pi_3, Axis=ln)  # -> flatten(Geometry), Transform
move_3 = Move(Geometry=rotax.Geometry, Motion=Z_4)  # -> flatten(Geometry), Transform
sunion_5 = SolidUnion(Breps=[sph, move_3.Geometry])  # -> flatten(Result)

# ----
# Surface for Architecture Models
optional_seed_for_jitter_node = Slider(39, range=0..100)
uv_point_count = Slider(19, range=0..20)
height_map = Slider(8, range=0..8)
polygon = Polygon(Plane=PlaneXY(0, 0, 0), Radius=Slider(100, range=0..100), Segments="4", FilletRadius=0)  # -> Polygon, Length
sdivide = DivideSurface(Surface=polygon.Polygon, UCount=uv_point_count, VCount=uv_point_count)  # -> flatten(Points), Normals, Parameters
dispatch = Dispatch(List=sdivide.Points, DispatchPattern=genes)  # -> ListA, ListB
lng = ListLength(List=dispatch.ListA)  # -> flatten(Length)
dom = ConstructDomain(DomainStart=0, DomainEnd=height_map)
range = Range(Domain=dom, Steps=expr("x-1", lng))
Z_5 = UnitZ(Factor=range)
addition = Addition(A=uv_point_count, B="1")
srfgrid = SurfaceFromPoints(Points=sdivide.Points, UCount=addition, Interpolate=False)

# ----
# Optional
# Jitter
# Node
jitter = Jitter(List=Z_5, Jitter=1, Seed=optional_seed_for_jitter_node)  # -> Values, Indices

pdeform = PointDeform(Geometry=srfgrid, Points=dispatch.ListA, Motion=jitter.Values)
