# Grasshopper definition January16tth2020WickersonStudiosWheelBarrow002.gh (Grasshopper 1.0.7)
# plug-ins: Pufferfish

# Wheel Barrow Frame, Algorithm 002, Wickerson Studios, 2020
number_slider = Slider(3.527, range=3..4)
wheel_size = Slider(2, range=-0.52..2)
wheel_band_width = Slider(0.523, range=0..0.6)
wheel_band_thickness = Slider(0.115, range=0..0.3)
spoke_count = Slider(8, range=0..10)
spoke_thickness = Slider(4, range=2..4)
dom = ConstructDomain(DomainStart=Slider(0, range=0..10), DomainEnd=Slider(10, range=0..10))
range = Range(Domain=dom, Steps=Slider(36, range=0..100))
sin = Sine(Value=range)
cos = Cosine(Value=range)
multiplication = Multiplication(A=sin, B=Slider(0.43, range=0..1))
addition = Addition(A=multiplication, B=number_slider)
multiplication_2 = Multiplication(A=cos, B=Slider(0.41, range=0..1))
pt = ConstructPoint(XCoordinate=range, YCoordinate=addition, ZCoordinate=multiplication_2)
intcrv = Interpolate(Vertices=pt, Degree=3, Periodic=False, KnotStyle=1)  # -> Curve, Length, Domain
neg = Negative(Value=Slider(1, range=0..1))
neg_2 = Negative(Value=Slider(0.517, range=0..1))
end = EndPoints(Curve=intcrv.Curve)  # -> Start, End
vec = VectorXYZ(XComponent=neg_2, YComponent=0, ZComponent=neg)  # -> Vector, Length
pi = Pi(Factor=Slider(0.17, range=0..0.17))
pl = ConstructPlane(Origin=end.Start, XAxis=vec.Vector, YAxis=Vector(0, 1, 0))
genes = GenePool(Decimals=2, Maximum=0.75, Minimum=0, Value=[0.48, 0.56, 0.64, 0.7, 0.75])
Y = UnitY(Factor=1)
vdis = VectorDisplay(Anchor=end.Start, Vector=pl)
vdis_2 = VectorDisplay(Anchor=end.Start, Vector=vec.Vector)
rotate = Rotate(Geometry=intcrv.Curve, Angle=pi, Plane=pl)  # -> Geometry, Transform
pframe = PerpFrame(Curve=reparameterize(rotate.Geometry), Parameter=genes)
deplane = DeconstructPlane(Plane=pframe)  # -> Origin, XAxis, YAxis, ZAxis
xz = XZPlane(Origin=Point(0, 0, 0))
mirror = Mirror(Geometry=deplane.Origin, Plane=xz)  # -> Geometry, Transform
division = Division(A=wheel_band_width, B=spoke_thickness)
loft_opt = LoftOptions(Closed=Toggle(True), Adjust=False, Rebuild=0, Refit=0, Type=0)
ln = Line(StartPoint=deplane.Origin, EndPoint=mirror.Geometry)
crvmidpt = CurveMiddlePoint(Curve=ln, EvaluationType=False)  # -> Middle, Tangent, Parameter, Length
Z = UnitZ(Factor=Slider(0.51, range=0.05..2))
xz_2 = XZPlane(Origin=Point(0, 0, 0))
neg_3 = Negative(Value=Z)
mirror_2 = Mirror(Geometry=rotate.Geometry, Plane=xz_2)  # -> Geometry, Transform
move = Move(Geometry=crvmidpt.Middle, Motion=neg_3)  # -> Geometry, Transform
merge = Merge(Data1=rotate.Geometry, Data2=mirror_2.Geometry)
end_2 = EndPoints(Curve=merge)  # -> Start, End
split = SplitList(List=end_2.End, Index="1")  # -> ListA, ListB
ln_2 = Line(StartPoint=split.ListA, EndPoint=split.ListB)
midpt = CurveMiddle(Curve=ln_2)
pl_2 = ConstructPlane(Origin=midpt, XAxis=Vector(1, 0, 0), YAxis=Vector(0, 1, 0))
circle = CircleCNR(Center=pl_2, Normal=Y, Radius=wheel_size)
pframes = PerpFrames(Curve=circle, Count=spoke_count, Align=True)  # -> Frames, Parameters
deplane_2 = DeconstructPlane(Plane=pframes.Frames)  # -> Origin, XAxis, YAxis, ZAxis
ellipse = Ellipse(Plane=pframes.Frames, Radius1=wheel_band_thickness, Radius2=wheel_band_width)  # -> flatten(Ellipse), Focus1, Focus2
ln_3 = Line(StartPoint=deplane_2.Origin, EndPoint=midpt)
pipe = Pipe(Curve=ln_3, Radius=division, Caps="1")  # -> flatten(Pipe)
pipe_2 = Pipe(Curve=ln_2, Radius=wheel_band_width, Caps="1")  # -> flatten(Pipe)
loft = Loft(Curves=ellipse.Ellipse, Options=loft_opt)  # -> flatten(Loft)
arc = Arc3Pt(PointA=deplane.Origin, PointB=move.Geometry, PointC=mirror.Geometry)  # -> Arc, Plane, Radius

genes_2 = GenePool(Decimals=2, Maximum=1, Minimum=0, Value=[0, 0.07, 0.25, 0.41, 0.5, 0.68, 0.74, 0.83, 0.91, 1])
genes_3 = GenePool(Decimals=2, Maximum=1, Minimum=0, Value=[0.09, 0.03, 0.08, 0.13, 0.22, 0.26, 0.2, 0.17, 0.21, 0.18])
vpipe = PipeVariable(Curve=reparameterize(arc.Arc), Parameters=genes_2, Radii=genes_3, Caps="2")

genes_4 = GenePool(Decimals=2, Maximum=1, Minimum=0, Value=[0, 0.16, 0.34, 0.48, 0.62, 0.68, 0.74, 0.83, 0.91, 1])
genes_5 = GenePool(Decimals=2, Maximum=0.7, Minimum=0, Value=[0.196, 0.168, 0.217, 0.273, 0.336, 0.448, 0.49, 0.427, 0.371, 0.308])
vpipe_2 = PipeVariable(Curve=reparameterize(merge), Parameters=genes_4, Radii=genes_5, Caps="2")

cap = CapHoles(Brep=vpipe_2)  # -> flatten(Brep)
cap_2 = CapHoles(Brep=vpipe)  # -> flatten(Brep)
sunion = SolidUnion(Breps=[pipe, pipe_2, loft])
sunion_2 = SolidUnion(Breps=[cap, cap_2])
sunion_3 = SolidUnion(Breps=[sunion_2, sunion])
