# Grasshopper definition January17tth2020WickersonStudiosHamletsMillAlgorithm003.gh (Grasshopper 1.0.7)

# ----
# I little GEM test
number_slider = Slider(11.25, range=0..30)
number_slider_2 = Slider(12, range=0..100)
cir = Circle(Plane=PlaneXY(0, 0, 0), Radius=number_slider)
pi = Pi(Factor=1)
subtraction = Subtraction(A=number_slider_2, B=Slider(1, range=0..1))
division = Division(A=number_slider, B=number_slider_2)
hframes = HorizontalFrames(Curve=cir, Count=subtraction)  # -> Frames, Parameters
multiplication = Multiplication(A=division, B=pi)
xz = XZPlane(Origin=Point(0, 0, 0))
sph = Sphere(Base=hframes.Frames, Radius=multiplication)
pi_2 = Pi(Factor=division)
panel = Panel(multiplication)
deplane = DeconstructPlane(Plane=xz)  # -> Origin, XAxis, YAxis, ZAxis
ln = Line(StartPoint=deplane.Origin, EndPoint=deplane.YAxis)
rotax = RotateAxis(Geometry=sph, Angle=pi_2, Axis=ln)  # -> flatten(Geometry), Transform
Z = UnitZ(Factor=multiplication)
move = Move(Geometry=rotax.Geometry, Motion=Z)  # -> flatten(Geometry), Transform
sunion = SolidUnion(Breps=[sph, move.Geometry])  # -> flatten(Result)

# ----
# Hamlet's Mill Shell
number_slider_3 = Slider(50, range=0..100)
cir_2 = Circle(Plane=PlaneXY(0, 0, 0), Radius=Slider(30, range=0..30))
divide = DivideCurve(Curve=cir_2, Count=number_slider_3, Kinks=False)  # -> Points, Tangents, Parameters
pline = PolyLine(Vertices=divide.Points, Closed=Toggle(True))
md_slider = MDSlider(
    SliderMode=0,
    slider_value=Point(0.01463392304, 0.004878346513, 0.5),
    x_domain=Domain(0, 1),
    y_domain=Domain(0, 1),
    z_domain=Domain(0, 1))
explode = Explode(Curve=pline, Recursive=True)  # -> graft(Segments), Vertices
Z_2 = UnitZ(Factor=Slider(5.76, range=0..10))
move_2 = Move(Geometry=explode.Segments, Motion=Z_2)  # -> Geometry, Transform
loft = Loft(
    Curves=[explode.Segments, move_2.Geometry],
    Options={Adjust=False, Closed=False, LoftEnds=0, LoftSimp=0, LoftType=0, Rebuild=10, Refit=0.01})
debrep = DeconstructBrep(Brep=loft)  # -> Faces, Edges, Vertices
evalsrf = EvaluateSurface(Surface=reparameterize(debrep.Faces), Point=md_slider)  # -> Point, Normal, UDirection, VDirection, Frame
dom = ConstructDomain(DomainStart=Slider(0, range=0..1), DomainEnd=Slider(0.5, range=0..0.5))
number_slider_4 = Slider(0, range=0..100)
item = ListItem(List=debrep.Edges, Index="1", Wrap=True)
len = Length(Curve=item)
neg = Negative(Value=evalsrf.Normal)
multiplication_2 = Multiplication(A=neg, B=len)
extr = Extrude(Base=evalsrf.Frame, Direction=multiplication_2)  # -> flatten(Extrusion)
lng = ListLength(List=extr)  # -> flatten(Length)
range = Range(Domain=dom, Steps=expr("x-1", lng))
jitter = Jitter(List=range, Jitter=1, Seed=number_slider_4)  # -> Values, Indices
pi_3 = Pi(Factor=jitter.Values)
lng_2 = ListLength(List=extr)  # -> flatten(Length)
dom_2 = ConstructDomain(DomainStart=Slider(0, range=0..1), DomainEnd=Slider(0.5, range=0..0.5))
range_2 = Range(Domain=dom_2, Steps=expr("x-1", lng_2))
addition = Addition(A=number_slider_4, B="2")
pi_4 = Pi(Factor=pi_3)  # -> graft(Output)
jitter_2 = Jitter(List=range_2, Jitter=1, Seed=addition)  # -> Values, Indices
rotate = Rotate(Geometry=graft(extr), Angle=pi_4, Plane=evalsrf.Point)  # -> flatten(Geometry), Transform
pi_5 = Pi(Factor=jitter_2.Values)
multiplication_3 = Multiplication(A=number_slider_3, B="2")
sunion_2 = SolidUnion(Breps=rotate.Geometry)
pi_6 = Pi(Factor=pi_5)  # -> graft(Output)
lng_3 = ListLength(List=pi_3)
lng_4 = ListLength(List=pi_5)
division_2 = Division(A="360", B=multiplication_3)
panel_2 = Panel(lng_3)
rotate_2 = Rotate(Geometry=graft(extr), Angle=pi_6, Plane=evalsrf.Point)  # -> flatten(Geometry), Transform
panel_3 = Panel(lng_4)
rotate_3 = Rotate(Geometry=sunion_2, Angle=degrees(division_2), Plane=PlaneXY(0, 0, 0))  # -> Geometry, Transform
Z_3 = UnitZ(Factor=1)
move_3 = Move(Geometry=rotate_3.Geometry, Motion=Z_3)  # -> Geometry, Transform
sunion_3 = SolidUnion(Breps=rotate_2.Geometry)
sunion_4 = SolidUnion(Breps=[sunion_3, move_3.Geometry])
Z_4 = UnitZ(Factor="2")
arrlinear = LinearArray(Geometry=sunion_4, Direction=Z_4, Count=Slider(8, range=0..10))  # -> flatten(Geometry), Transform
sunion_5 = SolidUnion(Breps=arrlinear.Geometry)

# ----
# Optional Gene Pool
# for Dispatch Pattern
genes = GenePool(Decimals=0, Maximum=1, Minimum=0, Value=[0, 1, 1, 0, 1, 0, 1, 1, 1, 1])

# ----
# Surface for Architecture Models
optional_seed_for_jitter_node = Slider(39, range=0..100)
uv_point_count = Slider(19, range=0..20)
height_map = Slider(8, range=0..8)
polygon = Polygon(Plane=PlaneXY(0, 0, 0), Radius=Slider(100, range=0..100), Segments="4", FilletRadius=0)  # -> Polygon, Length
sdivide = DivideSurface(Surface=polygon.Polygon, UCount=uv_point_count, VCount=uv_point_count)  # -> flatten(Points), Normals, Parameters
dispatch = Dispatch(List=sdivide.Points, DispatchPattern=genes)  # -> ListA, ListB
lng_5 = ListLength(List=dispatch.ListA)  # -> flatten(Length)
dom_3 = ConstructDomain(DomainStart=0, DomainEnd=height_map)
range_3 = Range(Domain=dom_3, Steps=expr("x-1", lng_5))
Z_5 = UnitZ(Factor=range_3)
addition_2 = Addition(A=uv_point_count, B="1")
srfgrid = SurfaceFromPoints(Points=sdivide.Points, UCount=addition_2, Interpolate=False)

# ----
# Optional
# Jitter
# Node
jitter_3 = Jitter(List=Z_5, Jitter=1, Seed=optional_seed_for_jitter_node)  # -> Values, Indices

pdeform = PointDeform(Geometry=srfgrid, Points=dispatch.ListA, Motion=jitter_3.Values)
