# Grasshopper definition January17tth2020WickersonStudiosHamletsMillAlgorithm003B.gh (Grasshopper 1.0.7)

# ----
# Hamlet's Mill Shell
number_slider = Slider(50, range=0..100)
cir = Circle(Plane=PlaneXY(0, 0, 0), Radius=Slider(30, range=0..30))
divide = DivideCurve(Curve=cir, Count=number_slider, Kinks=False)  # -> Points, Tangents, Parameters
pline = PolyLine(Vertices=divide.Points, Closed=Toggle(True))
md_slider = MDSlider(
    SliderMode=0,
    slider_value=Point(0.01463392304, 0.004878346513, 0.5),
    x_domain=Domain(0, 1),
    y_domain=Domain(0, 1),
    z_domain=Domain(0, 1))
explode = Explode(Curve=pline, Recursive=True)  # -> graft(Segments), Vertices
Z = UnitZ(Factor=Slider(5.76, range=0..10))
move = Move(Geometry=explode.Segments, Motion=Z)  # -> Geometry, Transform
loft = Loft(
    Curves=[explode.Segments, move.Geometry],
    Options={Adjust=False, Closed=False, LoftEnds=0, LoftSimp=0, LoftType=0, Rebuild=10, Refit=0.01})
debrep = DeconstructBrep(Brep=loft)  # -> Faces, Edges, Vertices
evalsrf = EvaluateSurface(Surface=reparameterize(debrep.Faces), Point=md_slider)  # -> Point, Normal, UDirection, VDirection, Frame
dom = ConstructDomain(DomainStart=Slider(0, range=0..1), DomainEnd=Slider(0.5, range=0..0.5))
number_slider_2 = Slider(0, range=0..100)
item = ListItem(List=debrep.Edges, Index="1", Wrap=True)
len = Length(Curve=item)
neg = Negative(Value=evalsrf.Normal)
multiplication = Multiplication(A=neg, B=len)
extr = Extrude(Base=evalsrf.Frame, Direction=multiplication)  # -> flatten(Extrusion)
lng = ListLength(List=extr)  # -> flatten(Length)
range = Range(Domain=dom, Steps=expr("x-1", lng))
jitter = Jitter(List=range, Jitter=1, Seed=number_slider_2)  # -> Values, Indices
pi = Pi(Factor=jitter.Values)
lng_2 = ListLength(List=extr)  # -> flatten(Length)
dom_2 = ConstructDomain(DomainStart=Slider(0, range=0..1), DomainEnd=Slider(0.5, range=0..0.5))
range_2 = Range(Domain=dom_2, Steps=expr("x-1", lng_2))
addition = Addition(A=number_slider_2, B="2")
pi_2 = Pi(Factor=pi)  # -> graft(Output)
jitter_2 = Jitter(List=range_2, Jitter=1, Seed=addition)  # -> Values, Indices
rotate = Rotate(Geometry=graft(extr), Angle=pi_2, Plane=evalsrf.Point)  # -> flatten(Geometry), Transform
pi_3 = Pi(Factor=jitter_2.Values)
multiplication_2 = Multiplication(A=number_slider, B="2")
sunion = SolidUnion(Breps=rotate.Geometry)
pi_4 = Pi(Factor=pi_3)  # -> graft(Output)
lng_3 = ListLength(List=pi)
lng_4 = ListLength(List=pi_3)
division = Division(A="360", B=multiplication_2)
panel = Panel(lng_3)
rotate_2 = Rotate(Geometry=graft(extr), Angle=pi_4, Plane=evalsrf.Point)  # -> flatten(Geometry), Transform
panel_2 = Panel(lng_4)
rotate_3 = Rotate(Geometry=sunion, Angle=degrees(division), Plane=PlaneXY(0, 0, 0))  # -> Geometry, Transform
Z_2 = UnitZ(Factor=1)
move_2 = Move(Geometry=rotate_3.Geometry, Motion=Z_2)  # -> Geometry, Transform
sunion_2 = SolidUnion(Breps=rotate_2.Geometry)
sunion_3 = SolidUnion(Breps=[sunion_2, move_2.Geometry])
Z_3 = UnitZ(Factor="2")
arrlinear = LinearArray(Geometry=sunion_3, Direction=Z_3, Count=Slider(8, range=0..10))  # -> flatten(Geometry), Transform
sunion_4 = SolidUnion(Breps=arrlinear.Geometry)

# ----
# Optional Gene Pool
# for Dispatch Pattern
genes = GenePool(Decimals=0, Maximum=1, Minimum=0, Value=[0, 1, 1, 0, 1, 0, 1, 1, 1, 1])

item_2 = ListItem(List=flatten(evalsrf.Point), Index=Slider(63, range=0..100), Wrap=True)
pt = Point(item_2)
neg_2 = Negative(Value=evalsrf.Normal)
move_3 = Move(Geometry=pt, Motion=neg_2)  # -> graft(Geometry), Transform
brep = Brep(flatten(sunion_3))
rot3d = Rotate3D(Geometry=brep, Angle=1.570796327, Center=move_3.Geometry, Axis=evalsrf.Normal)  # -> Geometry, Transform

# ----
# Surface for Architecture Models
optional_seed_for_jitter_node = Slider(39, range=0..100)
uv_point_count = Slider(19, range=0..20)
height_map = Slider(8, range=0..8)
polygon = Polygon(Plane=PlaneXY(0, 0, 0), Radius=Slider(100, range=0..100), Segments="4", FilletRadius=0)  # -> Polygon, Length
sdivide = DivideSurface(Surface=polygon.Polygon, UCount=uv_point_count, VCount=uv_point_count)  # -> flatten(Points), Normals, Parameters
dispatch = Dispatch(List=sdivide.Points, DispatchPattern=genes)  # -> ListA, ListB
lng_5 = ListLength(List=dispatch.ListA)  # -> flatten(Length)
dom_3 = ConstructDomain(DomainStart=0, DomainEnd=height_map)
range_3 = Range(Domain=dom_3, Steps=expr("x-1", lng_5))
Z_4 = UnitZ(Factor=range_3)
addition_2 = Addition(A=uv_point_count, B="1")
srfgrid = SurfaceFromPoints(Points=sdivide.Points, UCount=addition_2, Interpolate=False)

# ----
# Optional
# Jitter
# Node
jitter_3 = Jitter(List=Z_4, Jitter=1, Seed=optional_seed_for_jitter_node)  # -> Values, Indices

pdeform = PointDeform(Geometry=srfgrid, Points=dispatch.ListA, Motion=jitter_3.Values)
