# Grasshopper definition January21nd2020WickersonStudiosCupolaCartAlgorithm001.gh (Grasshopper 1.0.7)
# plug-ins: Pufferfish

scale_wheels = Slider(6.79, range=0..10)
axle_arc_height = Slider(4, range=-1..4)
number_of_spokes = Slider(3, range=2..10)
well_thickness = Slider(3, range=0.1..3)
wheelband_height = Slider(0.84, range=0.2..1)
tap_hole_height = Slider(5, range=1..5)
spoke_thickness_factor = Slider(1, range=1..5)
support_thickness = Slider(0.3, range=0.05..0.3)
# Cupola Cart, Algorithm 001, Wickerson Studios, 2020
scale_well_axle = Slider(4, range=3..4)
axle_thickness = Slider(0.452, range=0..0.7)
support_count = Slider(4, range=0..10)
rotate_wheels = Slider(0.05, range=-0.1..1.11)
wheelband_width = Slider(0.45, range=0..3)

smokestack_height = Slider(5, range=1..11)
smokestackshape = Slider(3, range=0..10)
C = Slider(-3, range=-3..3.001)

dom = ConstructDomain(DomainStart="0", DomainEnd=smokestack_height)
range = Range(Domain=dom, Steps=smokestackshape)
Z = UnitZ(Factor=axle_arc_height)
sin = Sine(Value=range)
cos = Cosine(Value=range)
multiplication = Multiplication(A=sin, B=Slider(-3, range=-3..3.001))
multiplication_2 = Multiplication(A=cos, B=C)
pt = ConstructPoint(XCoordinate=0, YCoordinate=0, ZCoordinate=0)
pt_2 = Point(pt)
move = Move(Geometry=pt_2, Motion=Z)  # -> Geometry, Transform
X = UnitX(Factor=scale_well_axle)
addition = Addition(A=scale_well_axle, B="5")
pt_3 = ConstructPoint(XCoordinate=range, YCoordinate=multiplication, ZCoordinate=multiplication_2)
yz = YZPlane(Origin=Point(0, 0, 0))
neg = Negative(Value=X)
toggle = BooleanToggle(True)
Y = UnitY(Factor=addition)
md_slider = MDSlider(
    SliderMode=0,
    slider_value=Point(0.510215201, 0.5143611257, 0.5),
    x_domain=Domain(0, 1),
    y_domain=Domain(0, 1),
    z_domain=Domain(0, 1))
merge = Merge(Data1=X, Data2=neg)
neg_2 = Negative(Value=Y)
move_2 = Move(Geometry=pt, Motion=merge)  # -> Geometry, Transform
loft_opt = LoftOptions(Closed=toggle, Adjust=False, Rebuild=0, Refit=0, Type=0)
Z_2 = UnitZ(Factor=scale_well_axle)
line = LineSDL(Start=pt_2, Direction=neg_2, Length=addition)
multiplication_3 = Multiplication(A=axle_thickness, B="1.5")
pl = PlaneNormal(Origin=move_2.Geometry, ZAxis=X)
circle = CircleCNR(Center=move_2.Geometry, Normal=pl, Radius=scale_wheels)  # -> flatten(Circle)
pipe = Pipe(Curve=line, Radius=multiplication_3, Caps=0)
Y_2 = UnitY(Factor=1)
neg_3 = Negative(Value=well_thickness)
ellipse = Ellipse(Plane=PlaneXY(0, 0, 0), Radius1=wheelband_height, Radius2=wheelband_width)  # -> Ellipse, Focus1, Focus2
pi = Pi(Factor=rotate_wheels)
item = ListItem(List=circle, Index="1", Wrap=True)
item_2 = ListItem(List=circle, Index="0", Wrap=True)
division = Division(A=wheelband_width, B=spoke_thickness_factor)
line_2 = LineSDL(Start=item, Direction=Y_2, Length=1)
line_3 = LineSDL(Start=item_2, Direction=Y_2, Length=1)
neg_4 = Negative(Value=pi)
Z_3 = UnitZ(Factor=tap_hole_height)
rotax = RotateAxis(Geometry=item_2, Angle=pi, Axis=line_3)  # -> Geometry, Transform
rotax_2 = RotateAxis(Geometry=item, Angle=neg_4, Axis=line_2)  # -> Geometry, Transform
move_3 = Move(Geometry=pipe, Motion=Z_3)  # -> Geometry, Transform
cap = CapHoles(Brep=move_3.Geometry)
merge_2 = Merge(Data1=rotax.Geometry, Data2=rotax_2.Geometry)
pt_4 = Point(graft(move_2.Geometry))
pt_5 = Point(pt_4)
split = SplitList(List=flatten(pt_5), Index="1")  # -> ListA, ListB
arc = Arc3Pt(PointA=split.ListA, PointB=move.Geometry, PointC=split.ListB)  # -> Arc, Plane, Radius
curvepoint = PointOnCurve(arc.Arc, parameter=0.5)
crv = Curve(reparameterize(arc.Arc))
curvepoint_2 = PointOnCurve(crv, parameter=0.75)
curvepoint_3 = PointOnCurve(crv, parameter=0.25)
cir = Circle(Plane=curvepoint, Radius=scale_well_axle)
pipe_2 = Pipe(Curve=arc.Arc, Radius=axle_thickness, Caps=0)
move_4 = Move(Geometry=cir, Motion=Z_2)  # -> Geometry, Transform
crv_2 = Curve(reparameterize(move_4.Geometry))
pframes = PerpFrames(Curve=crv_2, Count=10, Align=True)  # -> graft(Frames), Parameters
xy = XYPlane(Origin=pframes.Frames)
orient = Orient(Geometry=pt_3, Source=yz, Target=xy)  # -> Geometry, Transform
intcrv = Interpolate(Vertices=orient.Geometry, Degree=3, Periodic=False, KnotStyle=1)  # -> flatten(Curve), Length, Domain
loft = Loft(Curves=intcrv.Curve, Options=loft_opt)
evalsrf = EvaluateSurface(Surface=loft, Point=md_slider)  # -> Point, Normal, UDirection, VDirection, Frame
cap_2 = CapHoles(Brep=pipe_2)
merge_3 = Merge(Data1=cir, Data2=move_4.Geometry)  # -> flatten(Result)
merge_4 = Merge(Data1=curvepoint_3, Data2=curvepoint_2)  # -> graft(Result)
divide = DivideCurve(Curve=cir, Count=support_count, Kinks=False)  # -> Points, Tangents, Parameters
rev = Reverse(Vector=evalsrf.Normal)
geo = Geometry(cap_2)
loft_2 = Loft(Curves=[cir, merge_3], Options={Adjust=False, Closed=False, LoftEnds=0, LoftSimp=0, LoftType=0, Rebuild=10, Refit=0.01})
ln = Line(StartPoint=divide.Points, EndPoint=merge_4)
offsrf = OffsetSurface(Surface=loft, Distance=rev, BothSides=toggle, CreateSolid=True)
offset = OffsetSurface(Surface=loft_2, Distance=neg_3, Retrim=True)
cap_3 = CapHoles(Brep=loft_2)  # -> flatten(Brep)
pipe_3 = Pipe(Curve=ln, Radius=support_thickness, Caps=2)
cap_4 = CapHoles(Brep=offset)  # -> flatten(Brep)
sdiff = SolidDifference(BrepsA=cap_3, BrepsB=cap_4)
cap_5 = CapHoles(Brep=pipe_3)
sdiff_2 = SolidDifference(BrepsA=sdiff, BrepsB=cap)
divide_2 = DivideCurve(Curve=merge_2, Count=number_of_spokes, Kinks=False)  # -> Points, Tangents, Parameters
sunion = SolidUnion(Breps=[sdiff_2, cap_5])  # -> graft(Result)
pframes_2 = PerpFrames(Curve=[rotax_2.Geometry, rotax.Geometry], Count=10, Align=True)  # -> Frames, Parameters
ln_2 = Line(StartPoint=pt_4, EndPoint=divide_2.Points)
orient_2 = Orient(Geometry=ellipse.Ellipse, Source=PlaneXY(0, 0, 0), Target=pframes_2.Frames)  # -> Geometry, Transform
crv_3 = Curve(merge_2)

number_slider = Slider(2, range=0..100)  # disabled
cir_2 = Circle(Plane=PlaneXY(0, 0, 0), Radius=number_slider)  # disabled
crv_4 = Curve(ellipse.Ellipse)  # disabled
flow = Flow(Geometry=crv_3, Base=cir_2, Target=crv_4, ReverseBase=False, ReverseTarget=False, Stretch=True, Rigid=False)  # disabled
pipe_4 = Pipe(Curve=flow, Radius=1, Caps=0)  # disabled

sunion_2 = SolidUnion(Breps=[sunion, offsrf])
pipe_5 = Pipe(Curve=ln_2, Radius=division, Caps="1")  # -> flatten(Pipe)
loft_3 = Loft(
    Curves=orient_2.Geometry,
    Options={Adjust=False, Closed=True, LoftEnds=0, LoftSimp=0, LoftType=0, Rebuild=10, Refit=0.01})  # -> flatten(Loft)
sunion_3 = SolidUnion(Breps=[pipe_5, loft_3])

# ----
# Bake Me!
merge_5 = Merge(Data2=sunion_3, Data3=geo, Data5=sunion_2)

geo_2 = Geometry(sdiff_2)
geo_3 = Geometry(geo)
geo_4 = Geometry(offsrf)
geo_5 = Geometry(cap_5)

merge_6 = Merge(Data1=geo_4, Data2=geo_2)
merge_7 = Merge(Data1=geo_5, Data2=geo_3)
geo_6 = Geometry(pipe_5)
geo_7 = Geometry(loft_3)
