# Grasshopper definition January21nd2020WickersonStudiosCupolaKlokkenstoelenAlgorithm004.gh (Grasshopper 1.0.7)
# plug-ins: Pufferfish

number_slider = Slider(18, range=0..100)
# Bell Tower, Algorithm 004, Wickerson Studios, 2020
dom = ConstructDomain(DomainStart=0, DomainEnd=1)
dom_2 = ConstructDomain(DomainStart=0, DomainEnd=1)
range = Range(Domain=dom, Steps=number_slider)
range_2 = Range(Domain=dom_2, Steps=number_slider)
graph = GraphMapper(
    range,
    x0=0,
    x1=1,
    y0=0,
    y1=2,
    container_name="Bezier",
    cpx=[0, 1, 0.6767184138, 1],
    cpy=[1, 0.6665341854, 0.1162464619, 0])
eval = Evaluate(F="x+1", x=range)
graph_2 = GraphMapper(
    simplify(range_2),
    x0=0,
    x1=1,
    y0=0,
    y1=1.5,
    container_name="Bezier",
    cpx=[0, 0.3867272735, 1, 1],
    cpy=[0.9931949377, 0.9677484632, 0.6914716959, 0])
pt = ConstructPoint(XCoordinate=eval, YCoordinate=0, ZCoordinate=graph)
eval_2 = Evaluate(F="x+1", x=range_2)
intcrv = Interpolate(Vertices=pt, Degree=3, Periodic=False, KnotStyle=1)  # -> Curve, Length, Domain
pt_2 = ConstructPoint(XCoordinate=eval_2, YCoordinate=0, ZCoordinate=graph_2)
end = EndPoints(Curve=intcrv.Curve)  # -> Start, End
intcrv_2 = Interpolate(Vertices=pt_2, Degree=3, Periodic=False, KnotStyle=1)  # -> Curve, Length, Domain
pl = PlaneNormal(Origin=end.Start, ZAxis=Vector(0, 0, 1))
orient = Orient(Geometry=intcrv_2.Curve, Source=end.End, Target=pl)  # -> Geometry, Transform
join = JoinCurves(Curves=[intcrv.Curve, orient.Geometry], Preserve=False)
series = Series(Start=0, Step=1, Count=10)
rotate = Rotate(Geometry=join, Angle=series, Plane=PlaneXY(0, 0, 0))  # -> Geometry, Transform
loft = Loft(Curves=rotate.Geometry, Options={Adjust=False, Closed=False, LoftEnds=0, LoftSimp=0, LoftType=0, Rebuild=10, Refit=0.01})
offsrf = OffsetSurface(Surface=loft, Distance=Slider(0.17, range=0..1), BothSides=False, CreateSolid=True)
sunion = SolidUnion(Breps=offsrf)
