# Grasshopper definition January25th2020WickersonStudiosCupolaKlokkenstoelenAlgorithm004.gh (Grasshopper 1.0.7)
# plug-ins: Pufferfish, Bifocals, Weaverbird

number_slider = Slider(18, range=0..100)
# Bell Tower, Algorithm 004, Wickerson Studios, 2020
dom = ConstructDomain(DomainStart=0, DomainEnd=1)
dom_2 = ConstructDomain(DomainStart=0, DomainEnd=1)
range = Range(Domain=dom, Steps=number_slider)
range_2 = Range(Domain=dom_2, Steps=number_slider)
graph = GraphMapper(
    range,
    x0=0,
    x1=1,
    y0=0,
    y1=2,
    container_name="Bezier",
    cpx=[0, 1, 0.6767184138, 1],
    cpy=[1, 0.6665341854, 0.1162464619, 0])
eval = Evaluate(F="x+1", x=range)
graph_2 = GraphMapper(
    simplify(range_2),
    x0=0,
    x1=1,
    y0=0,
    y1=1.5,
    container_name="Bezier",
    cpx=[0, 0.3867272735, 1, 1],
    cpy=[0.9931949377, 0.9677484632, 0.6914716959, 0])
pt = ConstructPoint(XCoordinate=eval, YCoordinate=0, ZCoordinate=graph)
eval_2 = Evaluate(F="x+1", x=range_2)
intcrv = Interpolate(Vertices=pt, Degree=3, Periodic=False, KnotStyle=1)  # -> Curve, Length, Domain
pt_2 = ConstructPoint(XCoordinate=eval_2, YCoordinate=0, ZCoordinate=graph_2)
end = EndPoints(Curve=intcrv.Curve)  # -> Start, End
intcrv_2 = Interpolate(Vertices=pt_2, Degree=3, Periodic=False, KnotStyle=1)  # -> Curve, Length, Domain
pl = PlaneNormal(Origin=end.Start, ZAxis=Vector(0, 0, 1))
orient = Orient(Geometry=intcrv_2.Curve, Source=end.End, Target=pl)  # -> Geometry, Transform
join = JoinCurves(Curves=[intcrv.Curve, orient.Geometry], Preserve=False)
series = Series(Start=0, Step=1, Count=10)
rotate = Rotate(Geometry=join, Angle=series, Plane=PlaneXY(0, 0, 0))  # -> Geometry, Transform
loft = Loft(Curves=rotate.Geometry, Options={Adjust=False, Closed=False, LoftEnds=0, LoftSimp=0, LoftType=0, Rebuild=10, Refit=0.01})
offsrf = OffsetSurface(Surface=loft, Distance=Slider(0.17, range=0..1), BothSides=False, CreateSolid=True)
sunion = SolidUnion(Breps=offsrf)

scale_wheels = Slider(6.79, range=0..10)
number_of_spokes = Slider(6, range=2..10)
axle_arc_height = Slider(4, range=-1..4)
well_thickness = Slider(3, range=0.1..3)
wheelband_height = Slider(0.42, range=0.2..1)
tap_hole_height = Slider(5, range=1..5)
spoke_thickness_factor = Slider(3.196, range=1..5)
support_thickness = Slider(0.3, range=0.05..0.3)
scale_well_axle = Slider(4, range=3..4)
axle_thickness = Slider(0.452, range=0..0.7)
support_count = Slider(4, range=0..10)
rotate_wheels = Slider(0.05, range=-0.1..1.11)
wheelband_width = Slider(0.93, range=0..3)

smokestack_height = Slider(5, range=1..11)
smokestackshape = Slider(3, range=0..10)
number_slider_2 = Slider(-3, range=-3..3.001)
C = Slider(-3, range=-3..3.001)

# ----
# Cupola Cart, Algorithm 001, Wickerson Studios, 2020
panel = Panel("1")
Z = UnitZ(Factor=axle_arc_height)
pt_3 = ConstructPoint(XCoordinate=0, YCoordinate=0, ZCoordinate=0)
pt_4 = Point(pt_3)
move = Move(Geometry=pt_4, Motion=Z)  # -> Geometry, Transform
X = UnitX(Factor=scale_well_axle)
addition = Addition(A=scale_well_axle, B="5")
neg = Negative(Value=X)
Y = UnitY(Factor=addition)
merge = Merge(Data1=X, Data2=neg)
neg_2 = Negative(Value=Y)
move_2 = Move(Geometry=pt_3, Motion=merge)  # -> Geometry, Transform
Z_2 = UnitZ(Factor=scale_well_axle)
line = LineSDL(Start=pt_4, Direction=neg_2, Length=addition)
multiplication = Multiplication(A=axle_thickness, B="1.5")
pl_2 = PlaneNormal(Origin=move_2.Geometry, ZAxis=X)
circle = CircleCNR(Center=move_2.Geometry, Normal=pl_2, Radius=scale_wheels)  # -> flatten(Circle)
pipe = Pipe(Curve=line, Radius=multiplication, Caps=0)
Y_2 = UnitY(Factor=1)
neg_3 = Negative(Value=well_thickness)
ellipse = Ellipse(Plane=PlaneXY(0, 0, 0), Radius1=wheelband_height, Radius2=wheelband_width)  # -> Ellipse, Focus1, Focus2
pi = Pi(Factor=rotate_wheels)
item = ListItem(List=circle, Index="1", Wrap=True)
item_2 = ListItem(List=circle, Index="0", Wrap=True)
division = Division(A=wheelband_width, B=spoke_thickness_factor)
line_2 = LineSDL(Start=item, Direction=Y_2, Length=1)
line_3 = LineSDL(Start=item_2, Direction=Y_2, Length=1)
neg_4 = Negative(Value=pi)
Z_3 = UnitZ(Factor=tap_hole_height)
rotax = RotateAxis(Geometry=item_2, Angle=pi, Axis=line_3)  # -> Geometry, Transform
rotax_2 = RotateAxis(Geometry=item, Angle=neg_4, Axis=line_2)  # -> Geometry, Transform
move_3 = Move(Geometry=pipe, Motion=Z_3)  # -> Geometry, Transform
cap = CapHoles(Brep=move_3.Geometry)
merge_2 = Merge(Data1=rotax.Geometry, Data2=rotax_2.Geometry)
pt_5 = Point(graft(move_2.Geometry))
pt_6 = Point(pt_5)
split = SplitList(List=flatten(pt_6), Index=panel)  # -> ListA, ListB
arc = Arc3Pt(PointA=split.ListA, PointB=move.Geometry, PointC=split.ListB)  # -> Arc, Plane, Radius
curvepoint = PointOnCurve(arc.Arc, parameter=0.5)
crv = Curve(reparameterize(arc.Arc))
curvepoint_2 = PointOnCurve(crv, parameter=0.75)
curvepoint_3 = PointOnCurve(crv, parameter=0.25)
cir = Circle(Plane=curvepoint, Radius=scale_well_axle)
pipe_2 = Pipe(Curve=arc.Arc, Radius=axle_thickness, Caps=0)
move_4 = Move(Geometry=cir, Motion=Z_2)  # -> Geometry, Transform
cap_2 = CapHoles(Brep=pipe_2)
merge_3 = Merge(Data1=curvepoint_3, Data2=curvepoint_2)  # -> graft(Result)
divide = DivideCurve(Curve=cir, Count=support_count, Kinks=False)  # -> Points, Tangents, Parameters
merge_4 = Merge(Data1=cir, Data2=move_4.Geometry)  # -> flatten(Result)
geo = Geometry(cap_2)
loft_2 = Loft(Curves=[cir, merge_4], Options={Adjust=False, Closed=False, LoftEnds=0, LoftSimp=0, LoftType=0, Rebuild=10, Refit=0.01})
ln = Line(StartPoint=divide.Points, EndPoint=merge_3)
offset = OffsetSurface(Surface=loft_2, Distance=neg_3, Retrim=True)
cap_3 = CapHoles(Brep=loft_2)  # -> flatten(Brep)
pipe_3 = Pipe(Curve=ln, Radius=support_thickness, Caps=2)
cap_4 = CapHoles(Brep=offset)  # -> flatten(Brep)
sdiff = SolidDifference(BrepsA=cap_3, BrepsB=cap_4)
cap_5 = CapHoles(Brep=pipe_3)
sdiff_2 = SolidDifference(BrepsA=sdiff, BrepsB=cap)
divide_2 = DivideCurve(Curve=merge_2, Count=number_of_spokes, Kinks=False)  # -> Points, Tangents, Parameters
sunion_2 = SolidUnion(Breps=[sdiff_2, cap_5])  # -> graft(Result)
pframes = PerpFrames(Curve=[rotax_2.Geometry, rotax.Geometry], Count=10, Align=True)  # -> Frames, Parameters
ln_2 = Line(StartPoint=pt_5, EndPoint=divide_2.Points)
orient_2 = Orient(Geometry=ellipse.Ellipse, Source=PlaneXY(0, 0, 0), Target=pframes.Frames)  # -> Geometry, Transform
crv_2 = Curve(merge_2)
pipe_4 = Pipe(Curve=ln_2, Radius=division, Caps="1")  # -> flatten(Pipe)
loft_3 = Loft(
    Curves=orient_2.Geometry,
    Options={Adjust=False, Closed=True, LoftEnds=0, LoftSimp=0, LoftType=0, Rebuild=10, Refit=0.01})  # -> flatten(Loft)
sunion_3 = SolidUnion(Breps=[pipe_4, loft_3])
geo_2 = Geometry(sdiff_2)
geo_3 = Geometry(geo)
geo_4 = Geometry()
geo_5 = Geometry(cap_5)

cir_2 = Circle(Plane=PlaneXY(0, 0, 0), Radius=Slider(2, range=0..100))
crv_3 = Curve(ellipse.Ellipse)
flow = Flow(Geometry=crv_2, Base=cir_2, Target=crv_3, ReverseBase=False, ReverseTarget=False, Stretch=True, Rigid=False)
pipe_5 = Pipe(Curve=flow, Radius=1, Caps=0)

number_slider_3 = Slider(1, range=1..3)

# ----
# Bake Me!
merge_5 = Merge(Data2=sunion_3, Data3=geo, Data5=sunion_2)

merge_6 = Merge(Data1=geo_4, Data2=geo_2)
geo_6 = Geometry(loft_3)
merge_7 = Merge(Data1=geo_5, Data2=geo_3)
geo_7 = Geometry(pipe_4)

# ----
# Klokkenstoel Tower, algorithm 004, Wickerson Studios, 2020
number_slider_4 = Slider(5, range=0..10)
curve = Curve(move_4.Geometry)
divide_curve = DivideCurve(Curve=curve, Count=number_slider_4, Kinks=False)  # -> Points, Tangents, Parameters
unit_z = UnitZ(Factor=Slider(17, range=0..100))
move_5 = Move(Geometry=divide_curve.Points, Motion=unit_z)  # -> Geometry, Transform
pi_2 = Pi(Factor=Slider(0.46, range=0..1))
rotate_2 = Rotate(Geometry=move_5.Geometry, Angle=pi_2, Plane=PlaneXY(0, 0, 0))  # -> Geometry, Transform
polyline = PolyLine(Vertices=rotate_2.Geometry, Closed=True)
boundary_surfaces = BoundarySurfaces(Edges=polyline)
area = Area(Geometry=boundary_surfaces)  # -> Area, Centroid
scale = Scale(Geometry=rotate_2.Geometry, Center=area.Centroid, Factor=Slider(1.32, range=0..2))  # -> Geometry, Transform
point = Point(divide_curve.Points)
number_slider_5 = Slider(3, range=1..3)
merge_8 = Merge(Data1=point, Data2=scale.Geometry)  # -> flatten(Result)
number_slider_6 = Slider(0.48, range=0..1)
sort_points = SortPoints(Points=merge_8)  # -> Points, Indices
number_slider_7 = Slider(0.66, range=0..1)
number_slider_8 = Slider(3, range=0..3)
delaunay_mesh = DelaunayMesh(Points=sort_points.Points, Plane=PlaneXY(0, 0, 0))
mesh = Mesh(delaunay_mesh)
point_list = PointList(Points=sort_points.Points)
weaverbird_s_midedge_subdivision = WeaverbirdsMidedgeSubdivision(MeshCurves=mesh, Level=number_slider_5, SmoothNakedEdges=1)
weaverbird_s_split_polygons_subdivision = WeaverbirdsSplitPolygonsSubdivision(MeshCurves=mesh, Level=number_slider_3, SmoothNakedEdges=1)
weaverbird_s_loop_subdivision = WeaverbirdsLoopSubdivision(MeshCurves=mesh, Level=1, SmoothNakedEdges=1)
weaverbird_s_constant_quads_split_subdiv = WeaverbirdsConstantQuadsSplitSubdivision(MeshCurves=mesh, Level=number_slider_5, SmoothNakedEdges=1)
weaverbird_s_sierpinski_triangles_subdiv = WeaverbirdsSierpinskiTrianglesSubdivision(MeshCurves=mesh, Level=number_slider_5)
weaverbird_s_split_triangles_subdivision = WeaverbirdsSplitTrianglesSubdivision(MeshCurves=mesh, Level=number_slider_3)
weaverbird_s_inner_polygons_subdivision = WeaverbirdsInnerPolygonsSubdivision(MeshCurves=mesh, Level=number_slider_5)
weaverbird_s_picture_frame = WeaverbirdsPictureFrame(MeshPolylines=delaunay_mesh, Distance=5, InsetType=0)
weaverbird_s_mesh_window = WeaverbirdsMeshWindow(MeshPolylines=delaunay_mesh, Distance=Slider(2.84, range=0..10), InsetType=0)

# ----
# Orient Bell in Tower
brep = Brep(sunion)
point_2 = Point(area.Centroid)
deconstruct_brep = DeconstructBrep(Brep=brep)  # -> Faces, Edges, Vertices
series_2 = Series(Start=Slider(0, range=0..5), Step=Slider(5, range=1..5), Count=Slider(4, range=1..4))
list_item = ListItem(List=deconstruct_brep.Vertices, Index="4", Wrap=True)
negative = Negative(Value=series_2)
orient_3 = Orient(Geometry=brep, Source=list_item, Target=point_2)  # -> Geometry, Transform
unit_z_2 = UnitZ(Factor=negative)
number_slider_9 = Slider(0.14, range=0..1)
boolean_toggle = BooleanToggle(True)
line_4 = Line(StartPoint=point_2, EndPoint=list_item)
end_points = EndPoints(Curve=line_4)  # -> Start, End
circle_2 = Circle(Plane=end_points.Start, Radius=Slider(5.44, range=0..10))
move_6 = Move(Geometry=orient_3.Geometry, Motion=unit_z_2)  # -> graft(Geometry), Transform
divide_curve_2 = DivideCurve(Curve=circle_2, Count=10, Kinks=False)  # -> Points, Tangents, Parameters
line_5 = Line(StartPoint=divide_curve_2.Points, EndPoint=point_2)
pipe_6 = Pipe(Curve=line_5, Radius=number_slider_9, Caps=boolean_toggle)
pipe_7 = Pipe(Curve=line_4, Radius=number_slider_9, Caps=boolean_toggle)
delaunay_mesh_2 = DelaunayMesh(Points=divide_curve_2.Points, Plane=PlaneXY(0, 0, 0))
merge_9 = Merge(Data1=move_6.Geometry, Data2=pipe_7, Data3=pipe_6)  # -> graft(Result)
weaverbird_s_stellate_cumulation = WeaverbirdsStellateCumulation(MeshPolylines=delaunay_mesh_2, Distance=Slider(1.88, range=0..10))
weaverbird_s_picture_frame_2 = WeaverbirdsPictureFrame(MeshPolylines=weaverbird_s_stellate_cumulation, Distance=5, InsetType=0)
negative_2 = Negative(Value=Slider(2.17, range=0..10))
weaverbird_s_mesh_thicken = WeaverbirdsMeshThicken(MeshCurves=weaverbird_s_picture_frame_2, Distance=negative_2, OffsetType=0)
weaverbird_s_catmull_clark_subdivision = WeaverbirdsCatmullClarkSubdivision(MeshCurves=weaverbird_s_mesh_thicken, Level=Slider(1, range=1..3), SmoothNakedEdges=1)
solid_union = SolidUnion(Breps=merge_9)

negative_3 = Negative(Value=number_slider_6)
negative_4 = Negative(Value=number_slider_6)
negative_5 = Negative(Value=Slider(5.1, range=0..10))

weaverbird_s_mesh_thicken_2 = WeaverbirdsMeshThicken(MeshCurves=weaverbird_s_picture_frame, Distance=negative_3, OffsetType=0)
weaverbird_s_mesh_thicken_3 = WeaverbirdsMeshThicken(MeshCurves=weaverbird_s_mesh_window, Distance=negative_4, OffsetType=0)
weaverbird_s_stellate_cumulation_2 = WeaverbirdsStellateCumulation(MeshPolylines=delaunay_mesh, Distance=negative_5)
weaverbird_s_catmull_clark_subdivision_2 = WeaverbirdsCatmullClarkSubdivision(MeshCurves=weaverbird_s_mesh_thicken_3, Level=number_slider_8, SmoothNakedEdges=1)
weaverbird_s_catmull_clark_subdivision_3 = WeaverbirdsCatmullClarkSubdivision(MeshCurves=weaverbird_s_stellate_cumulation_2, Level=Slider(2, range=0..3), SmoothNakedEdges=1)
weaverbird_s_catmull_clark_subdivision_4 = WeaverbirdsCatmullClarkSubdivision(MeshCurves=weaverbird_s_mesh_thicken_2, Level=number_slider_8, SmoothNakedEdges=1)
