# Grasshopper definition January29th2020SurfaceEditWickersonStudios.gh (Grasshopper 1.0.7)
# plug-ins: Bifocals

uv_point_count = Slider(34, range=0..100)
width = Slider(10, range=0..10)
rectangle = Rectangle(Plane=PlaneXY(0, 0, 0), XSize=uv_point_count, YSize=width, Radius=0)  # -> Rectangle, Length

# ----
# Gene Pool
# for Dispatch Pattern
gene_pool = GenePool(
    Decimals=0,
    Maximum=1,
    Minimum=0,
    Value=[0.1016146117, 0.1933914671, 0.3456139091, 0.2262482751, 0.8090761648, 1, 1, 0.6660769669, 0, 0.7147953914])

divide_surface = DivideSurface(Surface=rectangle.Rectangle, UCount=uv_point_count, VCount=uv_point_count)  # -> flatten(Points), Normals, Parameters
height_map = Slider(2, range=0..2)
dispatch = Dispatch(List=divide_surface.Points, DispatchPattern=gene_pool)  # -> ListA, ListB
construct_domain = ConstructDomain(DomainStart=0, DomainEnd=height_map)
list_length = ListLength(List=dispatch.ListA)  # -> flatten(Length)
range = Range(Domain=construct_domain, Steps=expr("x-1", list_length))
optional_seed_for_jitter_node = Slider(45, range=0..100)
unit_z = UnitZ(Factor=range)
thickness_of_zinc = Slider(1.9, range=0..10)
surface_from_points = SurfaceFromPoints(Points=divide_surface.Points, UCount=expr("x+1", uv_point_count), Interpolate=False)
jitter = Jitter(List=unit_z, Jitter=1, Seed=optional_seed_for_jitter_node)  # -> Values, Indices
unit_z_2 = UnitZ(Factor=thickness_of_zinc)
point_deform = PointDeform(Geometry=surface_from_points, Points=dispatch.ListA, Motion=jitter.Values)

# ---- group: Extrude
# Bake this into RHINO
extrude = Extrude(Base=point_deform, Direction=unit_z_2)
