# Grasshopper definition KarlSingline_003.gh (Grasshopper 1.0.7)
# plug-ins: KUKA|prc - parametric robot control, Bifocals

crv = Curve([<curve referenced from the Rhino model> x42])
topoly = CurveToPolyline(Curve=crv, ToleranceDistance=Slider(0.14, range=0..11), ToleranceAngle=0)  # -> Polyline, Segments
cp = ControlPoints(Curve=topoly.Polyline)  # -> Points, Weights, Knots
xy = XYPlane(Origin=cp.Points)
pt = Point(<point referenced from the Rhino model>)
orient_pln = KUKAPrcOrientPlane(Plane=xy, OrientPoint=pt)
lin_move = KUKAPrcLINearMovement(TargetAsPlane=orient_pln, extaxenabled=False, interpolation="C_DIS")
mesh = Mesh(<mesh referenced from the Rhino model>)
number_slider = Slider(0.32182187, range=0..1)
custom_tool = CustomToolForKUKAPrc(
    CustomToolGeometry=mesh,
    toolid=6,
    toolvala=0,
    toolvalb=-90,
    toolvalc=0,
    toolvalx=0,
    toolvaly=0,
    toolvalz=24,
    valuesset=True)
kr_90_270_r2500 = KUKAQuantecKR90KR270R2500(highresactive=False)
tool_axis_offset = KUKAPrcToolAxisOffset(KUKAPrcCommand=lin_move, OffsetAlongToolaxis=Slider(10, range=0..20), OffsetStart=True, OffsetEnd=True)
play = KUKAPrcPlay(Loop=True, Reset=Toggle(False), savedtime=31.12855372)
kuka_prc = KUKAPrcCORE(
    SimulationSlider=play,
    KUKAPrcCommands=flatten(tool_axis_offset),
    KUKAPrcTool=custom_tool,
    KUKAPrcRobot=kr_90_270_r2500,
    LINstartspeed=0.5,
    PRC_SaveNameExpose=False,
    PTPstartspeed=45,
    acc_cp=nan,
    acc_ptp=-1,
    basea=0,
    baseb=0,
    basec=0,
    baseindex=0,
    basex=0,
    basey=0,
    basez=0,
    camrobformatting="""&ACCESS RVP
&REL 1
&PARAM TEMPLATE = C:\KRC\Roboter\Template\vorgabe
&PARAM EDITMASK = *
[PROJECTNAME]

[SPLITDEFS]

;FOLD INI
;FOLD BASISTECH INI
GLOBAL INTERRUPT DECL 3 WHEN $STOPMESS==TRUE DO IR_STOPM ( )
INTERRUPT ON 3
BAS (#INITMOV,0 )
;ENDFOLD (BASISTECH INI)
;ENDFOLD (INI)

[STARTAXPOS]

[SETPARAMETERS]

[COMMANDS]

END""",
    camrobon=False,
    checkallcolls=False,
    enda01=5,
    enda02=-90,
    enda03=100,
    enda04=5,
    enda05=10,
    enda06=-5,
    ende01=0,
    ende02=0,
    ende03=0,
    ende04=0,
    endindex=0,
    haltatend=False,
    hash=1024,
    initialstatus="110",
    int_advance=3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)  # -> RobotGeometry, AnalysisOutput
