# Grasshopper definition March5th_Sound_WickersonStudios_v002.gh (Grasshopper 1.0.7)
# plug-ins: Firefly.X, Bifocals

sound_capture = SoundCapture(TimePeriod=Slider(0.02, range=0..0.1), StartStopSoundCapture=Toggle(False))  # -> WavePressureSamplesFromLeftChannel, WavePressureSamplesFromRightChannel, Volume
timer = Timer(TimerInterval=20, Target=sound_capture)
number_slider = Slider(2, range=0..10)
data_recorder = DataRecorder(sound_capture.Volume, DataLimit=100, RecordData=True)
curve = Curve(<curve referenced from the Rhino model>)
series = Series(Start=number_slider, Step=number_slider, Count=Slider(77, range=0..100))
divide_curve = DivideCurve(Curve=curve, Count=Slider(100, range=0..100), Kinks=False)  # -> Points, Tangents, Parameters
circle = Circle(Plane=PlaneXY(0, 0, 0), Radius=series)
multiplication = Multiplication(A=data_recorder, B=Slider(0.894, range=0.02..2))
unit_z = UnitZ(Factor=multiplication)
move = Move(Geometry=divide_curve.Points, Motion=unit_z)  # -> Geometry, Transform
move_2 = Move(Geometry=reverse(circle), Motion=unit_z)  # -> Geometry, Transform
polyline = PolyLine(Vertices=move.Geometry, Closed=False)
line = Line(StartPoint=divide_curve.Points, EndPoint=move.Geometry)
loft = Loft(Curves=move_2.Geometry, Options={Adjust=False, Closed=False, LoftEnds=0, LoftSimp=0, LoftType=0, Rebuild=10, Refit=0.01})
panel = Panel(data_recorder)
