# Grasshopper definition March5th_Sound_WickersonStudios_v004.gh (Grasshopper 1.0.7)
# plug-ins: Firefly.X, Bifocals

number_slider = Slider(4, range=0..10)
curve = Curve(<curve referenced from the Rhino model>)
sound_capture = SoundCapture(TimePeriod=Slider(0.02, range=0..0.1), StartStopSoundCapture=Toggle(True))  # -> WavePressureSamplesFromLeftChannel, WavePressureSamplesFromRightChannel, Volume
timer = Timer(TimerInterval=20, Target=sound_capture)
number_slider_2 = Slider(9, range=0..100)
data_recorder = DataRecorder(sound_capture.Volume, DataLimit=10, RecordData=True)
series = Series(Start=number_slider, Step=number_slider, Count=Slider(5, range=0..100))
multiplication = Multiplication(A=data_recorder, B=Slider(1.077, range=0.02..2))
mesh_sphere = MeshSphere(Base=PlaneXY(0, 0, 0), Radius=series, UCount=number_slider_2, VCount=number_slider_2)
divide_curve = DivideCurve(Curve=curve, Count=Slider(10, range=0..100), Kinks=False)  # -> Points, Tangents, Parameters
unit_z = UnitZ(Factor=multiplication)
circle = Circle(Plane=PlaneXY(0, 0, 0), Radius=series)
move = Move(Geometry=divide_curve.Points, Motion=unit_z)  # -> Geometry, Transform
scale = Scale(Geometry=mesh_sphere, Center=Point(0, 0, 0), Factor=multiplication)  # -> Geometry, Transform
move_2 = Move(Geometry=reverse(circle), Motion=unit_z)  # -> Geometry, Transform
deconstruct_mesh = DeconstructMesh(Mesh=scale.Geometry)  # -> Vertices, Faces, Colours, Normals
line = Line(StartPoint=divide_curve.Points, EndPoint=move.Geometry)  # disabled
polyline = PolyLine(Vertices=move.Geometry, Closed=False)  # disabled
loft = Loft(Curves=move_2.Geometry, Options={Adjust=False, Closed=False, LoftEnds=0, LoftSimp=0, LoftType=0, Rebuild=10, Refit=0.01})  # disabled
interpolate = Interpolate(Vertices=move.Geometry, Degree=3, Periodic=False, KnotStyle=1)  # -> Curve, Length, Domain; disabled
panel = Panel(scale.Geometry)
rotate = Rotate(Geometry=deconstruct_mesh.Vertices, Angle=data_recorder, Plane=PlaneXY(0, 0, 0))  # -> Geometry, Transform
param_viewer = ParamViewer(deconstruct_mesh.Vertices)
pipe = Pipe(Curve=line, Radius=Slider(6, range=0..10), Caps=0)
circle_2 = Circle(Plane=rotate.Geometry, Radius=Slider(263, range=0..290))
panel_2 = Panel(data_recorder)
