# Grasshopper definition March5th_Sound_WickersonStudios_v005.gh (Grasshopper 1.0.7)
# plug-ins: Firefly.X, Bifocals

number_slider = Slider(14, range=0..100)
number_slider_2 = Slider(100, range=0..100)
curve = Curve(<curve referenced from the Rhino model>)
sound_capture = SoundCapture(TimePeriod=Slider(0.02, range=0..0.1), StartStopSoundCapture=Toggle(True))  # -> WavePressureSamplesFromLeftChannel, WavePressureSamplesFromRightChannel, Volume
timer = Timer(TimerInterval=20, Target=sound_capture)
data_recorder = DataRecorder(sound_capture.Volume, DataLimit=14, RecordData=True)
panel = Panel(data_recorder)
series = Series(Start=Slider(2, range=0..10), Step=Slider(6, range=0..10), Count=number_slider)
multiplication = Multiplication(A=data_recorder, B=Slider(0.894, range=0.02..2))
divide_curve = DivideCurve(Curve=curve, Count=number_slider, Kinks=False)  # -> Points, Tangents, Parameters
unit_z = UnitZ(Factor=multiplication)
polygon = Polygon(Plane=PlaneXY(0, 0, 0), Radius=series, Segments=Slider(10, range=0..10), FilletRadius=0)  # -> Polygon, Length
circle = Circle(Plane=PlaneXY(0, 0, 0), Radius=series)
move = Move(Geometry=divide_curve.Points, Motion=unit_z)  # -> Geometry, Transform
move_2 = Move(Geometry=polygon.Polygon, Motion=unit_z)  # -> Geometry, Transform
interpolate = Interpolate(Vertices=move.Geometry, Degree=3, Periodic=False, KnotStyle=1)  # -> Curve, Length, Domain
line = Line(StartPoint=divide_curve.Points, EndPoint=move.Geometry)
polyline = PolyLine(Vertices=move.Geometry, Closed=False)
loft = Loft(Curves=move_2.Geometry, Options={Adjust=False, Closed=False, LoftEnds=0, LoftSimp=0, LoftType=0, Rebuild=10, Refit=0.01})
pipe = Pipe(Curve=line, Radius=Slider(2.692, range=0..110), Caps=0)
