# Grasshopper definition March5th_Sound_WickersonStudios_v007.gh (Grasshopper 1.0.7)
# plug-ins: Firefly.X, Bifocals

number_slider = Slider(2, range=0..10)
curve = Curve(<curve referenced from the Rhino model>)
sound_capture = SoundCapture(TimePeriod=Slider(0.02, range=0..0.1), StartStopSoundCapture=Toggle(False))  # -> WavePressureSamplesFromLeftChannel, WavePressureSamplesFromRightChannel, Volume
timer = Timer(TimerInterval=20, Target=sound_capture)
panel = Panel(sound_capture.Volume)
data_recorder = DataRecorder(sound_capture.Volume, DataLimit=12, RecordData=True)
series = Series(Start=number_slider, Step=number_slider, Count=Slider(19, range=0..100))
multiplication = Multiplication(A=data_recorder, B=Slider(0.894, range=0.02..2))
polygon = Polygon(Plane=PlaneXY(0, 0, 0), Radius=3, Segments=6, FilletRadius=0)  # -> Polygon, Length
divide_curve = DivideCurve(Curve=curve, Count=Slider(12, range=0..100), Kinks=False)  # -> Points, Tangents, Parameters
unit_z = UnitZ(Factor=multiplication)
circle = Circle(Plane=PlaneXY(0, 0, 0), Radius=series)
move = Move(Geometry=divide_curve.Points, Motion=unit_z)  # -> Geometry, Transform
polygon_2 = Polygon(Plane=PlaneXY(0, 0, 0), Radius=series, Segments=Slider(3, range=0..10), FilletRadius=0)  # -> Polygon, Length
interpolate = Interpolate(Vertices=move.Geometry, Degree=3, Periodic=False, KnotStyle=1)  # -> Curve, Length, Domain
line = Line(StartPoint=divide_curve.Points, EndPoint=move.Geometry)
polyline = PolyLine(Vertices=move.Geometry, Closed=False)
move_2 = Move(Geometry=reverse(polygon_2.Polygon), Motion=unit_z)  # -> Geometry, Transform
pipe = Pipe(Curve=line, Radius=Slider(6, range=0..10), Caps=0)
loft = Loft(Curves=move_2.Geometry, Options={Adjust=False, Closed=False, LoftEnds=0, LoftSimp=0, LoftType=0, Rebuild=10, Refit=0.01})
geometry = Geometry(loft)
panel_2 = Panel(data_recorder)
