# Grasshopper definition MillingMorel_v001.gh (Grasshopper 1.0.7)
# plug-ins: KUKA|prc - parametric robot control, Bifocals

mesh = Mesh(<mesh referenced from the Rhino model>)
brep = Brep()
contour = Contour(Shape=mesh, Point=Point(0, 0, 0), Direction=Vector(0, 0, 1), Distance=Slider(5, range=0..10))
topoly = CurveToPolyline(Curve=contour, ToleranceDistance=Slider(0.25, range=0..1), ToleranceAngle=0)  # -> Polyline, Segments
cp = ControlPoints(Curve=topoly.Polyline)  # -> Points, Weights, Knots
srf = Surface(<surface referenced from the Rhino model>)
srf_cp = SurfaceClosestPoint(Point=cp.Points, Surface=srf)  # -> Point, UVPoint, Distance
vec2pt = Vector2Pt(PointA=cp.Points, PointB=srf_cp.Point, Unitize=False)  # -> Vector, Length
pl = PlaneNormal(Origin=cp.Points, ZAxis=vec2pt.Vector)
Z = UnitZ(Factor=1)
align = AlignPlane(Plane=pl, Direction=Z)  # -> Plane, Angle
lin_move = KUKAPrcLINearMovement(TargetAsPlane=align.Plane, extaxenabled=False, interpolation="C_DIS")  # -> flatten(KUKAPrcCommand)
kr_90_270_r2500 = KUKAQuantecKR90KR270R2500(highresactive=False)
kuka_prc = KUKAPrcCORE(
    SimulationSlider=0.5,
    KUKAPrcCommands=lin_move,
    KUKAPrcRobot=kr_90_270_r2500,
    LINstartspeed=0.5,
    PRC_SaveNameExpose=False,
    PTPstartspeed=45,
    acc_cp=nan,
    acc_ptp=-1,
    basea=0,
    baseb=0,
    basec=0,
    baseindex=0,
    basex=0,
    basey=0,
    basez=0,
    camrobformatting="""&ACCESS RVP
&REL 1
&PARAM TEMPLATE = C:\KRC\Roboter\Template\vorgabe
&PARAM EDITMASK = *
[PROJECTNAME]

[SPLITDEFS]

;FOLD INI
;FOLD BASISTECH INI
GLOBAL INTERRUPT DECL 3 WHEN $STOPMESS==TRUE DO IR_STOPM ( )
INTERRUPT ON 3
BAS (#INITMOV,0 )
;ENDFOLD (BASISTECH INI)
;ENDFOLD (INI)

[STARTAXPOS]

[SETPARAMETERS]

[COMMANDS]

END""",
    camrobon=False,
    checkallcolls=False,
    enda01=5,
    enda02=-90,
    enda03=100,
    enda04=5,
    enda05=10,
    enda06=-5,
    ende01=0,
    ende02=0,
    ende03=0,
    ende04=0,
    endindex=0,
    haltatend=False,
    hash=1024,
    initialstatus="110",
    int_advance=3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)  # -> RobotGeometry, AnalysisOutput
