# Grasshopper definition MillingMorel_v002Setup.gh (Grasshopper 1.0.7)
# plug-ins: KUKA|prc - parametric robot control, Bifocals

mesh = Mesh(<mesh referenced from the Rhino model>)
brep = Brep()
contour = Contour(Shape=mesh, Point=Point(0, 0, 0), Direction=Vector(0, 0, 1), Distance=Slider(5, range=0..10))
topoly = CurveToPolyline(Curve=contour, ToleranceDistance=Slider(0.25, range=0..1), ToleranceAngle=0)  # -> Polyline, Segments
cp = ControlPoints(Curve=topoly.Polyline)  # -> Points, Weights, Knots
srf = Surface(<surface referenced from the Rhino model>)
srf_cp = SurfaceClosestPoint(Point=cp.Points, Surface=srf)  # -> Point, UVPoint, Distance
vec2pt = Vector2Pt(PointA=cp.Points, PointB=srf_cp.Point, Unitize=False)  # -> Vector, Length
pl = PlaneNormal(Origin=cp.Points, ZAxis=vec2pt.Vector)
Z = UnitZ(Factor=1)
align = AlignPlane(Plane=pl, Direction=Z)  # -> Plane, Angle
lin_move = KUKAPrcLINearMovement(TargetAsPlane=align.Plane, extaxenabled=False, interpolation="C_DIS")  # -> flatten(KUKAPrcCommand)
kr_90_270_r2500 = KUKAQuantecKR90KR270R2500(infiniterot=False)
kuka_prc = KUKAPrcCORE(
    SimulationSlider=0.5,
    KUKAPrcCommands=lin_move,
    KUKAPrcRobot=kr_90_270_r2500,
    PRC_BaseExpose=False,
    PRC_SaveNameExpose=False,
    PRCsettings="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")  # -> RobotGeometry, AnalysisOutput
