# Grasshopper definition MillingSurfaceEdit_v002.gh (Grasshopper 1.0.7)
# plug-ins: KUKA|prc - parametric robot control, Bifocals

# ---- group: Surface Edit
width = Slider(10, range=0..10)
optional_seed_for_jitter_node = Slider(22, range=0..100)
width_2 = Slider(10, range=0..10)
height_map = Slider(2, range=0..2)
thickness_of_zinc = Slider(0.98, range=0..10)

# Optional Gene Pool
# for Dispatch Pattern
gene_pool = GenePool(
    Decimals=0,
    Maximum=1,
    Minimum=0,
    Value=[0.1016146117, 0.1933914671, 0.3456139091, 0.2262482751, 0.8090761648, 0.700994063, 0.7747656041, 0.6660769669, 0.5805381199, 0.7147953914])

# ----
X = UnitX(Factor=1)
Y = UnitY(Factor=1)
mesh = Mesh(<mesh referenced from the Rhino model>)
kr90_kr270_r2700 = QuantecKR90KR270R2700Robot(infiniterot=False)
custom_tool = CustomToolKUKAPrc(
    CustomToolGeometry=mesh,
    toolid=2,
    toolvala=0,
    toolvalb=0,
    toolvalc=0,
    toolvalx=333,
    toolvaly=22,
    toolvalz=77,
    valuesset=True)
play = KUKAPrcPlay(SimulationTime=Slider(0, range=0..3), Loop=False, Reset=Toggle(False), savedtime=423.4718921)

# ---- group: Surface Edit
# Surface Edit for Zahner
# Bake me in to RHINO!
# Parameters to Play with!
rectangle = Rectangle(Plane=PlaneXY(0, 0, 0), XSize=width, YSize=width_2, Radius=0)  # -> Rectangle, Length
divide_surface = DivideSurface(Surface=rectangle.Rectangle, UCount=10, VCount=width)  # -> flatten(Points), Normals, Parameters
construct_domain = ConstructDomain(DomainStart=0, DomainEnd=height_map)
dispatch = Dispatch(List=divide_surface.Points, DispatchPattern=gene_pool)  # -> ListA, ListB
surface_from_points = SurfaceFromPoints(Points=divide_surface.Points, UCount=expr("x+1", width), Interpolate=False)
list_length = ListLength(List=dispatch.ListA)  # -> flatten(Length)
range = Range(Domain=construct_domain, Steps=expr("x-1", list_length))
unit_z = UnitZ(Factor=range)
unit_z_2 = UnitZ(Factor=thickness_of_zinc)
number_slider = Slider(-1, range=-1..1000)
vec = VectorXYZ(XComponent=number_slider, YComponent=number_slider, ZComponent=Slider(77, range=0..100))  # -> Vector, Length

# Optional Jitter
# Node for
# SEED
jitter = Jitter(List=unit_z, Jitter=1, Seed=optional_seed_for_jitter_node)  # -> Values, Indices

point_deform = PointDeform(Geometry=surface_from_points, Points=dispatch.ListA, Motion=jitter.Values)
scale = Scale(Geometry=point_deform, Center=Point(0, 0, 0), Factor=Slider(70, range=0..100))  # -> Geometry, Transform
move = Move(Geometry=scale.Geometry, Motion=vec.Vector)  # -> Geometry, Transform

# ----
geo = Geometry(move.Geometry)
contour = Contour(Shape=geo, Point=Point(0, 0, 0), Direction=X, Distance=Slider(5.9, range=0..10))
dispatch_2 = Dispatch(List=flatten(contour), DispatchPattern=[True, False])  # -> ListA, ListB
flip = FlipCurve(Curve=dispatch_2.ListA)  # -> Curve, Flag
weave = Weave(Pattern=[0, 1], Stream0=flip.Curve, Stream1=dispatch_2.ListB, NullGaps=False)
divide = DivideCurve(Curve=weave, Count=Slider(60, range=0..100), Kinks=False)  # -> Points, Tangents, Parameters
srf_cp = SurfaceClosestPoint(Point=divide.Points, Surface=geo)  # -> Point, UVPoint, Distance
evalsrf = EvaluateSurface(Surface=geo, Point=srf_cp.UVPoint)  # -> Point, Normal, UDirection, VDirection, Frame
lin_move = LINearMovementKUKAPrc(TargetAsPlane=evalsrf.Frame, extaxenabled=False, interpolation="C_DIS")
tool_axis_offset = ToolAxisOffsetKUKAPrc(KUKAPrcCommand=lin_move, OffsetAlongToolaxis=Slider(43, range=0..300), OffsetStart=True, OffsetEnd=True)  # -> flatten(KUKAPrcCommand)
kuka_prc = KUKAPrcCORE(
    SimulationSlider=play,
    KUKAPrcCommands=tool_axis_offset,
    Tool=custom_tool,
    Robot=kr90_kr270_r2700,
    PRC_BaseExpose=False,
    PRC_SaveNameExpose=False,
    PRCsettings="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")  # -> RobotGeometry, AnalysisOutput

# ---- group: Surface Edit
extrude = Extrude(Base=point_deform, Direction=unit_z_2)  # disabled
