# Grasshopper definition MultiRobot_v002NEEDMEMBERSHIP.gh (Grasshopper 1.0.7)
# plug-ins: KUKA|prc - parametric robot control, Bifocals

# ---- group: Robot Holder
y_size = Slider(232, range=1..300)
pt = ConstructPoint(XCoordinate=0, YCoordinate=0, ZCoordinate=0)
rectangle = Rectangle(Plane=PlaneXY(0, 0, 0), XSize=y_size, YSize=y_size, Radius=0)  # -> Rectangle, Length
area = Area(Geometry=rectangle.Rectangle)  # -> Area, Centroid
vec2pt = Vector2Pt(PointA=area.Centroid, PointB=pt, Unitize=False)  # -> Vector, Length
move = Move(Geometry=rectangle.Rectangle, Motion=vec2pt.Vector)  # -> Geometry, Transform
Z = UnitZ(Factor=y_size)
extr = Extrude(Base=move.Geometry, Direction=Z)
cap = CapHoles(Brep=extr)
custom_tool = CustomToolKUKAPrc(CustomToolGeometry=cap, toolid=6, toolvala=0, toolvalb=0, toolvalc=0, toolvalx=0, toolvaly=0, toolvalz=0, valuesset=True)

# ---- group: R1
axis_move = AXISMovementKUKAPrc(
    Axis1=0,
    Axis2=-90,
    Axis3=Slider(13, range=0..200),
    Axis4=0,
    Axis5=Slider(0, range=0..200),
    Axis6=0,
    extaxenabled=False,
    interpolation="C_PTP")
number_slider = Slider(0, range=0..1)
kr90_kr270_r2700 = QuantecKR90KR270R2700Robot(infiniterot=False)

# ----
play = KUKAPrcPlay(SimulationTime=number_slider, Loop=False, Reset=False, savedtime=9.666666667)

# ---- group: R1 (continued)
kuka_prc = KUKAPrcCORE(
    SimulationSlider=play,
    KUKAPrcCommands=axis_move,
    Tool=custom_tool,
    Robot=kr90_kr270_r2700,
    PRC_BaseExpose=False,
    PRC_SaveNameExpose=False,
    PRCsettings="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")  # -> RobotGeometry, AnalysisOutput
