# Grasshopper definition MultiRobot_v003NEEDMEMBERSHIP.gh (Grasshopper 1.0.7)
# plug-ins: KUKA|prc - parametric robot control, Bifocals, FologramForGrasshopper

# ---- group: Robot Holder
y_size = Slider(768, range=1..1300)
pt = ConstructPoint(XCoordinate=0, YCoordinate=0, ZCoordinate=0)
rectangle = Rectangle(Plane=PlaneXY(0, 0, 0), XSize=y_size, YSize=y_size, Radius=0)  # -> Rectangle, Length
area = Area(Geometry=rectangle.Rectangle)  # -> Area, Centroid
vec2pt = Vector2Pt(PointA=area.Centroid, PointB=pt, Unitize=False)  # -> Vector, Length
move = Move(Geometry=rectangle.Rectangle, Motion=vec2pt.Vector)  # -> Geometry, Transform
Z = UnitZ(Factor=y_size)
extr = Extrude(Base=move.Geometry, Direction=Z)
cap = CapHoles(Brep=extr)
custom_tool = CustomToolKUKAPrc(CustomToolGeometry=cap, toolid=6, toolvala=0, toolvalb=0, toolvalc=0, toolvalx=0, toolvaly=0, toolvalz=0, valuesset=True)

# ----
number_slider = Slider(3000, range=3000..4001)
syncparams = SyncParameters(
    augmented_trigger_0_key=number_slider_5,
    augmented_trigger_1_key=number_slider_3,
    augmented_trigger_2_key=number_slider_4,
    augmented_trigger_3_key=y_size,
    augmented_trigger_4_key=number_slider_2,
    augmented_trigger_5_key=number_slider,
    augmented_trigger_6_key=toggle,
    componentVersion=1,
    num_augmented_triggers=7)
Z_2 = UnitZ(Factor=number_slider)
geo = Geometry(cap)
move_2 = Move(Geometry=geo, Motion=Z_2)  # -> Geometry, Transform
debrep = DeconstructBrep(Brep=move_2.Geometry)  # -> Faces, Edges, Vertices
area_2 = Area(Geometry=debrep.Faces)  # -> Area, Centroid
number_slider_2 = Slider(1, range=0..5)
pl = ConstructPlane(Origin=area_2.Centroid, XAxis=Vector(1, 0, 0), YAxis=Vector(0, 1, 0))
item = ListItem(List=flatten(pl), Index=number_slider_2, Wrap=True)
num = Number(expr("x/2", y_size))
num_2 = Number(y_size)
Z_3 = UnitZ(Factor=num_2)
Y = UnitY(Factor=num_2)
X = UnitX(Factor=num_2)

# ---- group: Back
pt_2 = PointOriented(BasePlane=item, UComponent=0, VComponent=num, WComponent=num)

# ----
move_3 = Move(Geometry=pt_2, Motion=expr("x*-1", Y))  # -> Geometry, Transform

# ---- group: bottom
deplane = DeconstructPlane(Plane=item)  # -> Origin, XAxis, YAxis, ZAxis

# ---- group: front
pt_3 = PointOriented(BasePlane=deplane.Origin, UComponent=num, VComponent=0, WComponent=num)

# ----
move_4 = Move(Geometry=pt_3, Motion=expr("x*-1", X))  # -> Geometry, Transform
move_5 = Move(Geometry=deplane.Origin, Motion=Z_3)  # -> Geometry, Transform
rev = Reverse(Vector=deplane.ZAxis)
rev_2 = Reverse(Vector=deplane.ZAxis)
toggle = BooleanToggle(False)
pl_2 = ConstructPlane(Origin=deplane.Origin, XAxis=Vector(1, 0, 0), YAxis=Vector(0, 1, 0))
pl_3 = ConstructPlane(Origin=move_3.Geometry, XAxis=Vector(1, 0, 0), YAxis=deplane.ZAxis)
pl_4 = ConstructPlane(Origin=pt_3, XAxis=deplane.ZAxis, YAxis=Vector(0, 1, 0))
pl_5 = ConstructPlane(Origin=move_5.Geometry, XAxis=Vector(1, 0, 0), YAxis=Vector(0, 1, 0))
pl_6 = ConstructPlane(Origin=move_4.Geometry, XAxis=rev_2, YAxis=Vector(0, 1, 0))
pl_7 = ConstructPlane(Origin=pt_2, XAxis=Vector(1, 0, 0), YAxis=rev)
custom_tool_2 = CustomToolKUKAPrc(
    CustomToolGeometry=pl_4,
    toolid=6,
    toolvala=0,
    toolvalb=0,
    toolvalc=0,
    toolvalx=0,
    toolvaly=0,
    toolvalz=0,
    valuesset=False)
custom_tool_3 = CustomToolKUKAPrc(
    CustomToolGeometry=pl_3,
    toolid=6,
    toolvala=0,
    toolvalb=0,
    toolvalc=0,
    toolvalx=0,
    toolvaly=0,
    toolvalz=0,
    valuesset=False)
custom_tool_4 = CustomToolKUKAPrc(
    CustomToolGeometry=pl_5,
    toolid=6,
    toolvala=0,
    toolvalb=0,
    toolvalc=0,
    toolvalx=0,
    toolvaly=0,
    toolvalz=0,
    valuesset=False)
custom_tool_5 = CustomToolKUKAPrc(
    CustomToolGeometry=pl_7,
    toolid=6,
    toolvala=0,
    toolvalb=0,
    toolvalc=0,
    toolvalx=0,
    toolvaly=0,
    toolvalz=0,
    valuesset=False)
custom_tool_6 = CustomToolKUKAPrc(
    CustomToolGeometry=[pl_2, pl_7, pl_4, pl_5],
    toolid=6,
    toolvala=0,
    toolvalb=0,
    toolvalc=0,
    toolvalx=0,
    toolvaly=0,
    toolvalz=0,
    valuesset=False)
custom_tool_7 = CustomToolKUKAPrc(
    CustomToolGeometry=pl_6,
    toolid=6,
    toolvala=0,
    toolvalb=0,
    toolvalc=0,
    toolvalx=0,
    toolvaly=0,
    toolvalz=0,
    valuesset=False)
axis_move = AXISMovementKUKAPrc(Axis1=pl_2, Axis2=-90, Axis3=90, Axis4=0, Axis5=0, Axis6=0, extaxenabled=False, interpolation="C_PTP")
lin_move = LINearMovementKUKAPrc(TargetAsPlane=pl_7, extaxenabled=False, interpolation="C_DIS")
kr90_kr270_r2500 = QuantecKR90KR270R2500Robot(infiniterot=False)
lin_move_2 = LINearMovementKUKAPrc(TargetAsPlane=pl_4, extaxenabled=False, interpolation="C_DIS")
lin_move_3 = LINearMovementKUKAPrc(TargetAsPlane=pl_5, extaxenabled=False, interpolation="C_DIS")
lin_move_4 = LINearMovementKUKAPrc(TargetAsPlane=pl_3, extaxenabled=False, interpolation="C_DIS")
lin_move_5 = LINearMovementKUKAPrc(TargetAsPlane=pl_6, extaxenabled=False, interpolation="C_DIS")
kr6_10_r1100_2 = AgilusKR610R11002Robot(infiniterot=False)
kr90_kr150_r3700k = QuantecKR90KR150R3700KRobot(infiniterot=False)
kr5_arc_hw = KR5ArcHWRobot(infiniterot=False)
kr3_r540 = AgilusKR3R540Robot(infiniterot=False)
kr480_r3330 = FortecKR480R3330MTRobot(infiniterot=False)

# ---- group: R1
number_slider_3 = Slider(13, range=0..200)
number_slider_4 = Slider(0, range=0..200)
axis_move_2 = AXISMovementKUKAPrc(
    Axis1=0,
    Axis2=-90,
    Axis3=number_slider_3,
    Axis4=0,
    Axis5=number_slider_4,
    Axis6=0,
    extaxenabled=False,
    interpolation="C_PTP")
number_slider_5 = Slider(0, range=0..1)
kr90_kr270_r2700 = QuantecKR90KR270R2700Robot(infiniterot=False)

# ----
play = KUKAPrcPlay(SimulationTime=number_slider_5, Loop=False, Reset=toggle, savedtime=51.85185385)

# ---- group: R1 (continued)
kuka_prc = KUKAPrcCORE(
    SimulationSlider=play,
    KUKAPrcCommands=axis_move_2,
    Tool=custom_tool,
    Robot=kr90_kr270_r2700,
    PRC_BaseExpose=False,
    PRC_SaveNameExpose=False,
    PRCsettings="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")  # -> RobotGeometry, AnalysisOutput

# ----
kuka_prc_2 = KUKAPrcCORE(
    SimulationSlider=play,
    KUKAPrcCommands=axis_move,
    Tool=custom_tool_6,
    Robot=kr90_kr270_r2500,
    PRC_BaseExpose=False,
    PRC_SaveNameExpose=False,
    PRCsettings="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")  # -> RobotGeometry, AnalysisOutput
kuka_prc_3 = KUKAPrcCORE(
    SimulationSlider=play,
    KUKAPrcCommands=lin_move,
    Tool=custom_tool_5,
    Robot=kr6_10_r1100_2,
    PRC_BaseExpose=False,
    PRC_SaveNameExpose=False,
    PRCsettings="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")  # -> RobotGeometry, AnalysisOutput
kuka_prc_4 = KUKAPrcCORE(
    SimulationSlider=play,
    KUKAPrcCommands=lin_move_2,
    Tool=custom_tool_2,
    Robot=kr3_r540,
    PRC_BaseExpose=False,
    PRC_SaveNameExpose=False,
    PRCsettings="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")  # -> RobotGeometry, AnalysisOutput
kuka_prc_5 = KUKAPrcCORE(
    SimulationSlider=play,
    KUKAPrcCommands=lin_move_3,
    Tool=custom_tool_4,
    Robot=kr5_arc_hw,
    PRC_BaseExpose=False,
    PRC_SaveNameExpose=False,
    PRCsettings="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")  # -> RobotGeometry, AnalysisOutput
kuka_prc_6 = KUKAPrcCORE(
    SimulationSlider=play,
    KUKAPrcCommands=lin_move_4,
    Tool=custom_tool_3,
    Robot=kr90_kr150_r3700k,
    PRC_BaseExpose=False,
    PRC_SaveNameExpose=False,
    PRCsettings="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")  # -> RobotGeometry, AnalysisOutput
kuka_prc_7 = KUKAPrcCORE(
    SimulationSlider=play,
    KUKAPrcCommands=lin_move_5,
    Tool=custom_tool_7,
    Robot=kr480_r3330,
    PRC_BaseExpose=False,
    PRC_SaveNameExpose=False,
    PRCsettings="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")  # -> RobotGeometry, AnalysisOutput
