# Grasshopper definition MultiRobot_v003ROBOTSUNITED_Final_v002.gh (Grasshopper 1.0.7)
# plug-ins: Robots, KUKA|prc - parametric robot control, Bifocals, FologramForGrasshopper

# ---- group: Robot Holder
y_size = Slider(768, range=1..1300)
pt = ConstructPoint(XCoordinate=0, YCoordinate=0, ZCoordinate=0)
rectangle = Rectangle(Plane=PlaneXY(0, 0, 0), XSize=y_size, YSize=y_size, Radius=0)  # -> Rectangle, Length
area = Area(Geometry=rectangle.Rectangle)  # -> Area, Centroid
vec2pt = Vector2Pt(PointA=area.Centroid, PointB=pt, Unitize=False)  # -> Vector, Length
move = Move(Geometry=rectangle.Rectangle, Motion=vec2pt.Vector)  # -> Geometry, Transform
Z = UnitZ(Factor=y_size)
extr = Extrude(Base=move.Geometry, Direction=Z)
cap = CapHoles(Brep=extr)
custom_tool = CustomToolKUKAPrc(CustomToolGeometry=cap, toolid=6, toolvala=0, toolvalb=0, toolvalc=0, toolvalx=0, toolvaly=0, toolvalz=0, valuesset=True)

# ----
syncparams = SyncParameters(
    augmented_trigger_0_key=number_slider_8,
    augmented_trigger_10_key=list_3,
    augmented_trigger_14_key=number_slider,
    augmented_trigger_15_key=list,
    augmented_trigger_16_key=toolpath_preview,
    augmented_trigger_17_key=number_slider_3,
    augmented_trigger_18_key=list_2,
    augmented_trigger_19_key=toolpath_preview_2,
    augmented_trigger_1_key=number_slider_6,
    augmented_trigger_2_key=number_slider_7,
    augmented_trigger_3_key=y_size,
    augmented_trigger_4_key=number_slider_5,
    augmented_trigger_5_key=number_slider_4,
    augmented_trigger_6_key=toggle,
    augmented_trigger_8_key=toolpath_preview_3,
    augmented_trigger_9_key=number_slider_2,
    componentVersion=1,
    num_augmented_triggers=20)
toggle = BooleanToggle(False)

curve = Curve(<curve referenced from the Rhino model>)
number_slider = Slider(23, range=0..100)
divide_curve = DivideCurve(Curve=reparameterize(curve), Count=10, Kinks=False)  # -> Points, Tangents, Parameters
sync_object = SyncObject(
    GM=curve,
    AlwaysIncludeTextureCoordinates=False,
    Clickable=False,
    DefaultCurveThicknessMillimeters=2.5,
    DefaultGlossPercent=0,
    DefaultMaterialColor=RGB(255, 255, 255),
    DefaultSpecularPercent=0,
    Interactive=False,
    hasSerializedData=True)
pipe = Pipe(Curve=curve, Radius=number_slider, Caps=0)
plane_normal = PlaneNormal(Origin=divide_curve.Points, ZAxis=divide_curve.Tangents)
sync_object_2 = SyncObject(
    GM=pipe,
    AlwaysIncludeTextureCoordinates=False,
    Clickable=False,
    DefaultCurveThicknessMillimeters=2.5,
    DefaultGlossPercent=0,
    DefaultMaterialColor=RGB(255, 255, 255),
    DefaultSpecularPercent=0,
    Interactive=False,
    hasSerializedData=True)
create_target = CreateTarget(Plane=plane_normal, IsCartesian=True)

curve_2 = Curve(<curve referenced from the Rhino model>)
number_slider_2 = Slider(15, range=0..100)
divide_curve_2 = DivideCurve(Curve=reparameterize(curve_2), Count=10, Kinks=False)  # -> Points, Tangents, Parameters
sync_object_3 = SyncObject(
    GM=curve_2,
    AlwaysIncludeTextureCoordinates=False,
    Clickable=False,
    DefaultCurveThicknessMillimeters=2.5,
    DefaultGlossPercent=0,
    DefaultMaterialColor=RGB(255, 255, 255),
    DefaultSpecularPercent=0,
    Interactive=False,
    hasSerializedData=True)
pipe_2 = Pipe(Curve=curve_2, Radius=number_slider_2, Caps=0)
plane_normal_2 = PlaneNormal(Origin=divide_curve_2.Points, ZAxis=divide_curve_2.Tangents)
sync_object_4 = SyncObject(
    GM=pipe_2,
    AlwaysIncludeTextureCoordinates=False,
    Clickable=False,
    DefaultCurveThicknessMillimeters=2.5,
    DefaultGlossPercent=0,
    DefaultMaterialColor=RGB(255, 255, 255),
    DefaultSpecularPercent=0,
    Interactive=False,
    hasSerializedData=True)
create_target_2 = CreateTarget(Plane=plane_normal_2, IsCartesian=True)

curve_3 = Curve(<curve referenced from the Rhino model>)
number_slider_3 = Slider(23, range=0..100)
divide_curve_3 = DivideCurve(Curve=reparameterize(curve_3), Count=10, Kinks=False)  # -> Points, Tangents, Parameters
sync_object_5 = SyncObject(
    GM=curve_3,
    AlwaysIncludeTextureCoordinates=False,
    Clickable=False,
    DefaultCurveThicknessMillimeters=2.5,
    DefaultGlossPercent=0,
    DefaultMaterialColor=RGB(255, 255, 255),
    DefaultSpecularPercent=0,
    Interactive=False,
    hasSerializedData=True)
pipe_3 = Pipe(Curve=curve_3, Radius=number_slider_3, Caps=0)
plane_normal_3 = PlaneNormal(Origin=divide_curve_3.Points, ZAxis=divide_curve_3.Tangents)
sync_object_6 = SyncObject(
    GM=pipe_3,
    AlwaysIncludeTextureCoordinates=False,
    Clickable=False,
    DefaultCurveThicknessMillimeters=2.5,
    DefaultGlossPercent=0,
    DefaultMaterialColor=RGB(255, 255, 255),
    DefaultSpecularPercent=0,
    Interactive=False,
    hasSerializedData=True)
create_target_3 = CreateTarget(Plane=plane_normal_3, IsCartesian=True)

toolpath_preview = Slider(0, range=0..3)
toolpath_preview_2 = Slider(0, range=0..3)
toolpath_preview_3 = Slider(0, range=0..3)

number_slider_4 = Slider(3201, range=3000..3201)
Z_2 = UnitZ(Factor=number_slider_4)
geo = Geometry(cap)
move_2 = Move(Geometry=geo, Motion=Z_2)  # -> Geometry, Transform
debrep = DeconstructBrep(Brep=move_2.Geometry)  # -> Faces, Edges, Vertices
area_2 = Area(Geometry=debrep.Faces)  # -> Area, Centroid
number_slider_5 = Slider(1, range=0..5)
pl = ConstructPlane(Origin=area_2.Centroid, XAxis=Vector(1, 0, 0), YAxis=Vector(0, 1, 0))
item = ListItem(List=flatten(pl), Index=number_slider_5, Wrap=True)
num = Number(expr("x/2", y_size))
num_2 = Number(y_size)
Z_3 = UnitZ(Factor=num_2)
Y = UnitY(Factor=num_2)
X = UnitX(Factor=num_2)

# ---- group: Back
pt_2 = PointOriented(BasePlane=item, UComponent=0, VComponent=num, WComponent=num)

# ---- group: bottom
deplane = DeconstructPlane(Plane=item)  # -> Origin, XAxis, YAxis, ZAxis

# ---- group: front
pt_3 = PointOriented(BasePlane=deplane.Origin, UComponent=num, VComponent=0, WComponent=num)

# ----
move_3 = Move(Geometry=pt_2, Motion=expr("x*-1", Y))  # -> Geometry, Transform
move_4 = Move(Geometry=pt_3, Motion=expr("x*-1", X))  # -> Geometry, Transform
move_5 = Move(Geometry=deplane.Origin, Motion=Z_3)  # -> Geometry, Transform
rev = Reverse(Vector=deplane.ZAxis)
rev_2 = Reverse(Vector=deplane.ZAxis)
pl_2 = ConstructPlane(Origin=move_3.Geometry, XAxis=Vector(1, 0, 0), YAxis=deplane.ZAxis)
pl_3 = ConstructPlane(Origin=pt_3, XAxis=deplane.ZAxis, YAxis=Vector(0, 1, 0))
pl_4 = ConstructPlane(Origin=deplane.Origin, XAxis=Vector(1, 0, 0), YAxis=Vector(0, 1, 0))
pl_5 = ConstructPlane(Origin=move_5.Geometry, XAxis=Vector(1, 0, 0), YAxis=Vector(0, 1, 0))
pl_6 = ConstructPlane(Origin=move_4.Geometry, XAxis=rev_2, YAxis=Vector(0, 1, 0))
pl_7 = ConstructPlane(Origin=pt_2, XAxis=Vector(1, 0, 0), YAxis=rev)

# ---- group: Robot Configuration
list = ValueList({"AA-KR60", "AA-KR30", "AA-KR60_KR30", "AARCH IRB120", "AARCH IRB6620", "AAU-Utzon-UR10", "Automata", "Bartlett-IRB120", "Bartlett-IRB1600", "Bartlett-KR6"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}, selected="AARCH IRB6620")
load_robot = LoadRobotSystem(Name=list, Base=pl_7)

list_2 = ValueList({"AA-KR60", "AA-KR30", "AA-KR60_KR30", "AARCH IRB120", "AARCH IRB6620", "AAU-Utzon-UR10", "Automata", "Bartlett-IRB120", "Bartlett-IRB1600", "Bartlett-KR6"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}, selected="CMU dFab IRB4400-60")
load_robot_2 = LoadRobotSystem(Name=list_2, Base=pl_5)

# ----
pflip = FlipPlane(Plane=pl_4, ReverseX=False, ReverseY=False, SwapAxes=True)

# ---- group: Robot Configuration
list_3 = ValueList({"AA-KR60", "AA-KR30", "AA-KR60_KR30", "AARCH IRB120", "AARCH IRB6620", "AAU-Utzon-UR10", "Automata", "Bartlett-IRB120", "Bartlett-IRB1600", "Bartlett-KR6"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}, selected="AAU-Utzon-UR10")
load_robot_3 = LoadRobotSystem(Name=list_3, Base=pflip)

# ----
create_program = CreateProgram(Name="DefaultProgram", RobotSystem=load_robot_3, Targets1=create_target_2, StepSize=1)  # -> Program, Code, Duration, Warnings, Errors
create_program_2 = CreateProgram(Name="DefaultProgram", RobotSystem=load_robot, Targets1=create_target, StepSize=1)  # -> Program, Code, Duration, Warnings, Errors
create_program_3 = CreateProgram(Name="DefaultProgram", RobotSystem=load_robot_2, Targets1=create_target_3, StepSize=1)  # -> Program, Code, Duration, Warnings, Errors
program_simulation = ProgramSimulation(Program=create_program_2.Program, Time=toolpath_preview, Normalized=True)  # -> SystemMeshes, JointRotations, Plane, Index, Time, Program, Errors
program_simulation_2 = ProgramSimulation(Program=create_program.Program, Time=toolpath_preview_3, Normalized=True)  # -> SystemMeshes, JointRotations, Plane, Index, Time, Program, Errors
program_simulation_3 = ProgramSimulation(Program=create_program_3.Program, Time=toolpath_preview_2, Normalized=True)  # -> SystemMeshes, JointRotations, Plane, Index, Time, Program, Errors
cull_index = CullIndex(List=program_simulation.SystemMeshes, Indices=-1, Wrap=True)
cull_index_2 = CullIndex(List=program_simulation_3.SystemMeshes, Indices=-1, Wrap=True)
cull_index_3 = CullIndex(List=program_simulation_2.SystemMeshes, Indices=-1, Wrap=True)
sync_object_7 = SyncObject(
    GM=cull_index,
    AlwaysIncludeTextureCoordinates=False,
    Clickable=False,
    DefaultCurveThicknessMillimeters=2.5,
    DefaultGlossPercent=0,
    DefaultMaterialColor=RGB(255, 255, 255),
    DefaultSpecularPercent=0,
    Interactive=False,
    hasSerializedData=True)
sync_object_8 = SyncObject(
    GM=cull_index_2,
    AlwaysIncludeTextureCoordinates=False,
    Clickable=False,
    DefaultCurveThicknessMillimeters=2.5,
    DefaultGlossPercent=0,
    DefaultMaterialColor=RGB(255, 255, 255),
    DefaultSpecularPercent=0,
    Interactive=False,
    hasSerializedData=True)
sync_object_9 = SyncObject(
    GM=cull_index_3,
    AlwaysIncludeTextureCoordinates=False,
    Clickable=False,
    DefaultCurveThicknessMillimeters=2.5,
    DefaultGlossPercent=0,
    DefaultMaterialColor=RGB(255, 255, 255),
    DefaultSpecularPercent=0,
    Interactive=False,
    hasSerializedData=True)

# ---- group: R1
number_slider_6 = Slider(13, range=0..200)
number_slider_7 = Slider(0, range=0..200)
axis_move = AXISMovementKUKAPrc(
    Axis1=0,
    Axis2=-90,
    Axis3=number_slider_6,
    Axis4=0,
    Axis5=number_slider_7,
    Axis6=0,
    extaxenabled=False,
    interpolation="C_PTP")
number_slider_8 = Slider(0, range=0..1)
kr90_kr270_r2700 = QuantecKR90KR270R2700Robot(infiniterot=False)

# ----
play = KUKAPrcPlay(SimulationTime=number_slider_8, Loop=False, Reset=toggle, savedtime=51.85185385)

# ---- group: R1 (continued)
kuka_prc = KUKAPrcCORE(
    SimulationSlider=play,
    KUKAPrcCommands=axis_move,
    Tool=custom_tool,
    Robot=kr90_kr270_r2700,
    PRC_BaseExpose=False,
    PRC_SaveNameExpose=False,
    PRCsettings="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")  # -> RobotGeometry, AnalysisOutput
