# Grasshopper definition OMDec17_2016ImageSampler.gh (Grasshopper 1.0.7)
# plug-ins: Bifocals

number_slider = Slider(0.116, range=0..1)
recgrid = Rectangular(
    Plane=PlaneXY(0, 0, 0),
    SizeX=number_slider,
    SizeY=number_slider,
    ExtentX=Slider(327, range=0..1000),
    ExtentY=Slider(253, range=0..1000))  # -> Cells, Points
image = ImageSampler(
    recgrid.Points,
    FilePath="C:\Users\Sculpture\Documents\2020Grasshopper\ScreenShots2019\BlackandWhiteMax.PNG",
    Filter="Value",
    Interpolate=True,
    Umax=40,
    Umin=0,
    Vmax=30,
    Vmin=0,
    Wrap=0)
division = Division(A=image, B=Slider(21.625, range=0..100))
circle = CircleCNR(Center=recgrid.Points, Normal=Vector(0, 0, 1), Radius=division)
boundary = BoundarySurfaces(Edges=circle)
