# Grasshopper definition OMFeb17_2017ParametricStadium.gh (Grasshopper 1.0.7)
# plug-ins: Bifocals

# Load Rhino .3dm file surface
srf = Surface(<surface referenced from the Rhino model>)
sph = Sphere(Base=PlaneXY(0, 0, 0), Radius=Slider(7, range=0..100))
pop3d = Populate3D(Region=sph, Count=Slider(40, range=0..100), Seed=1)
pt = ConstructPoint(XCoordinate=0, YCoordinate=0, ZCoordinate=0)
vec2pt = Vector2Pt(PointA=pt, PointB=pop3d, Unitize=False)  # -> Vector, Length
pl = PlaneNormal(Origin=pt, ZAxis=vec2pt.Vector)
sec = BrepPlane(Brep=srf, Plane=pl)  # -> Curves, Points
