# Grasshopper definition OMOct19_2016TwistingTower.gh (Grasshopper 1.0.7)
# plug-ins: Bifocals

number_slider = Slider(0, range=0..10)
number_slider_2 = Slider(52, range=0..100)
number_slider_3 = Slider(38, range=0..100)
number_slider_4 = Slider(1, range=0..1)
number_slider_5 = Slider(2, range=0..10)
series = Series(Start=number_slider, Step=Slider(3.3, range=0..10), Count=number_slider_2)
subtraction = Subtraction(A=number_slider_3, B=number_slider_4)
ellipse = Ellipse(Plane=PlaneXY(0, 0, 0), Radius1=Slider(22, range=0..100), Radius2=Slider(10, range=0..100))  # -> Ellipse, Focus1, Focus2
division = Division(A=Slider(100, range=0..100), B=subtraction)
Z = UnitZ(Factor=series)
subtraction_2 = Subtraction(A=number_slider_2, B=number_slider_4)
dom = ConstructDomain(DomainStart=Slider(1, range=0..1), DomainEnd=Slider(4, range=0..10))
area = Area(Geometry=ellipse.Ellipse)  # -> Area, Centroid
rad = Radians(Degrees=division)
range = Range(Domain=dom, Steps=subtraction_2)
line = LineSDL(Start=area.Centroid, Direction=Z, Length=number_slider_3)
move = Move(Geometry=ellipse.Ellipse, Motion=Z)  # -> Geometry, Transform
series_2 = Series(Start=number_slider, Step=rad, Count=number_slider_2)
graph = GraphMapper(
    range,
    x0=1,
    x1=4,
    y0=0,
    y1=1,
    container_name="Sine",
    Equation_px=[0.04001606256, 0.3047971725],
    Equation_py=[0.3603387475, 0.6732620001])
graph_2 = GraphMapper(
    range,
    x0=0,
    x1=1,
    y0=0,
    y1=1,
    container_name="Sine",
    Equation_px=[0.04001606256, 0.3014375865],
    Equation_py=[0.3603387475, 0.7258424759])
rotax = RotateAxis(Geometry=move.Geometry, Angle=series_2, Axis=line)  # -> Geometry, Transform
X = UnitX(Factor=Slider(90, range=0..100))
move_2 = Move(Geometry=rotax.Geometry, Motion=X)  # -> Geometry, Transform
area_2 = Area(Geometry=move_2.Geometry)  # -> Area, Centroid
area_3 = Area(Geometry=rotax.Geometry)  # -> Area, Centroid
multiplication = Multiplication(A=graph_2, B=number_slider_5)
multiplication_2 = Multiplication(A=graph, B=number_slider_5)
scale = Scale(Geometry=rotax.Geometry, Center=area_3.Centroid, Factor=multiplication_2)  # -> Geometry, Transform
scale_2 = Scale(Geometry=move_2.Geometry, Center=area_2.Centroid, Factor=multiplication)  # -> Geometry, Transform
boundary = BoundarySurfaces(Edges=scale_2.Geometry)
boundary_2 = BoundarySurfaces(Edges=scale.Geometry)
geo = Geometry([boundary, boundary_2])
edges = BrepEdges(Brep=geo)  # -> flatten(Naked), Interior, NonManifold
split = SplitList(List=edges.Naked, Index=number_slider_2)  # -> ListA, ListB
area_4 = Area(Geometry=split.ListB)  # -> Area, Centroid
area_5 = Area(Geometry=split.ListA)  # -> Area, Centroid
scale_3 = Scale(Geometry=split.ListB, Center=area_4.Centroid, Factor=Slider(0.53, range=0..1))  # -> Geometry, Transform
scale_4 = Scale(Geometry=split.ListA, Center=area_5.Centroid, Factor=Slider(0.63, range=0..1))  # -> Geometry, Transform
Z_2 = UnitZ(Factor=Slider(1.9, range=0..10))
Z_3 = UnitZ(Factor=Slider(0.22, range=0..1))
loft = Loft(
    Curves=scale_3.Geometry,
    Options={Adjust=False, Closed=False, LoftEnds=0, LoftSimp=0, LoftType=0, Rebuild=10, Refit=0.01})
loft_2 = Loft(
    Curves=scale_4.Geometry,
    Options={Adjust=False, Closed=False, LoftEnds=0, LoftSimp=0, LoftType=0, Rebuild=10, Refit=0.01})
crv = Curve(edges.Naked)
extr = Extrude(Base=crv, Direction=Z_2)
join = BrepJoin(Breps=[loft_2, loft])  # -> Breps, Closed
extr_2 = Extrude(Base=geo, Direction=Z_3)
