# Grasshopper definition OMSept13_2016.gh (Grasshopper 1.0.7)
# plug-ins: Bifocals

number_slider = Slider(132, range=0..1000)

xz_plane = XZPlane(Origin=Point(0, 0, 0))
radians = Radians(Degrees="180")
arc = Arc(Plane=xz_plane, Radius=Slider(35, range=0..100), Angle=radians)  # -> Arc, Length
end_points = EndPoints(Curve=arc.Arc)  # -> Start, End
ellipse = Ellipse(Plane=end_points.Start, Radius1=Slider(7, range=0..100), Radius2=Slider(24, range=0..100))  # -> Ellipse, Focus1, Focus2
sweep1 = Sweep1(Rail=arc.Arc, Sections=ellipse.Ellipse, Miter=1)
divide_domain² = DivideDomain²(Domain=sweep1, UCount=Slider(33, range=0..100), VCount=Slider(33, range=0..100))
construct_domain = ConstructDomain(DomainStart=Slider(-6, range=-6..7), DomainEnd=Slider(0, range=0..10))
list_length = ListLength(List=divide_domain²)
random = Random(Range=construct_domain, Number=list_length, Seed=Slider(20, range=0..100))
center_box = CenterBox(Base=PlaneXY(0, 0, 0), X=1, Y=1, Z=1)
surface_box = SurfaceBox(Surface=sweep1, Domain=divide_domain², Height=random)
bounding_box = BoundingBox(Content=center_box, Plane=PlaneXY(0, 0, 0))  # -> Box, Box_2
box_morph = BoxMorph(Geometry=center_box, Reference=bounding_box.Box, Target=surface_box)
custom_preview = CustomPreview(Geometry=box_morph, Material=ColourSwatch(SwatchColor=RGB(97, 178, 255)))
