# Grasshopper definition OMSept13_2016CurveAttractor.gh (Grasshopper 1.0.7)
# plug-ins: Bifocals

crv = Curve(<curve referenced from the Rhino model>)
series = Series(Start=0, Step=Slider(7, range=0..10), Count=Slider(15, range=0..100))
X = UnitX(Factor=series)
polygon = Polygon(Plane=PlaneXY(0, 0, 0), Radius=3, Segments=Slider(4, range=0..10), FilletRadius=0)  # -> Polygon, Length
move = Move(Geometry=polygon.Polygon, Motion=X)  # -> Geometry, Transform
Y = UnitY(Factor=series)
crossref = CrossReference(ListA=move.Geometry, ListB=Y, CrossMode=1)  # -> ListA, ListB
move_2 = Move(Geometry=crossref.ListA, Motion=crossref.ListB)  # -> Geometry, Transform
area = Area(Geometry=move_2.Geometry)  # -> Area, Centroid
crv_cp = CurveClosestPoint(Point=area.Centroid, Curve=crv)  # -> Point, Parameter, Distance
bnd = Bounds(Numbers=crv_cp.Distance)
dom = ConstructDomain(DomainStart=Slider(0.01, range=0..0.01), DomainEnd=Slider(1.2, range=0..10))
remap = RemapNumbers(Value=crv_cp.Distance, Source=bnd, Target=dom)  # -> Mapped, Clipped
multiplication = Multiplication(A=remap.Mapped, B=Slider(21, range=0..100))
gradient = Gradient(
    LowerLimit=0,
    UpperLimit=1,
    Parameter=remap.Mapped,
    stops=[0: RGB(234, 38, 0), 0.265: RGB(234, 126, 0), 0.538: RGB(254, 244, 84), 0.75: RGB(173, 203, 249), 1: RGB(75, 107, 169)])
scale = Scale(Geometry=move_2.Geometry, Center=area.Centroid, Factor=remap.Mapped)  # -> Geometry, Transform
Z = UnitZ(Factor=multiplication)
extr = Extrude(Base=scale.Geometry, Direction=Z)
preview = CustomPreview(Geometry=extr, Material=gradient)
