# Grasshopper definition OMSept13_2016Tower.gh (Grasshopper 1.0.7)
# plug-ins: Bifocals

pt = ConstructPoint(XCoordinate=0, YCoordinate=0, ZCoordinate=0)
pt_2 = ConstructPoint(XCoordinate=0, YCoordinate=0, ZCoordinate=Slider(50, range=0..100))
cir = Circle(Plane=[pt, pt_2], Radius=[Slider(27, range=0..100), Slider(9, range=0..10)])
divide = DivideCurve(Curve=cir, Count=Slider(18, range=0..100), Kinks=False)  # -> Points, Tangents, Parameters
bang = ExplodeTree(Data=divide.Points)  # -> Branch0, Branch1
shift = ShiftList(List=bang.Branch1, Shift=Slider(5, range=-5..10), Wrap=True)
shift_2 = ShiftList(List=bang.Branch1, Shift=Slider(-5, range=-5..10), Wrap=True)
ln = Line(StartPoint=bang.Branch0, EndPoint=shift_2)
ln_2 = Line(StartPoint=bang.Branch0, EndPoint=shift)
divide_2 = DivideCurve(Curve=ln_2, Count=10, Kinks=False)  # -> Points, Tangents, Parameters
flip = FlipMatrix(Data=divide_2.Points)
intcrv = Interpolate(Vertices=flip, Degree=3, Periodic=Toggle(True), KnotStyle=1)  # -> Curve, Length, Domain
boundary = BoundarySurfaces(Edges=intcrv.Curve)
pipe = Pipe(Curve=[intcrv.Curve, ln_2, ln], Radius=Slider(0.3, range=0..1), Caps=0)
join = BrepJoin(Breps=[boundary, pipe])  # -> Breps, Closed
