# Grasshopper definition OMSept25_2016LunchBox.gh (Grasshopper 1.0.7)
# plug-ins: Bifocals, LunchBox

xz = XZPlane(Origin=Point(0, 0, 0))
rad = Radians(Degrees="180")
arc = Arc(Plane=xz, Radius=Slider(22, range=0..100), Angle=rad)  # -> Arc, Length
Y = UnitY(Factor=Slider(33, range=0..100))
move = Move(Geometry=arc.Arc, Motion=Y)  # -> Geometry, Transform
scale_nu = ScaleNU(Geometry=arc.Arc, Plane=PlaneXY(0, 0, 0), ScaleX=Slider(2.3, range=1..3), ScaleY=1, ScaleZ=Slider(1.3, range=1..3))  # -> Geometry, Transform
scale_nu_2 = ScaleNU(
    Geometry=move.Geometry,
    Plane=PlaneXY(0, 0, 0),
    ScaleX=Slider(2.06, range=1..3),
    ScaleY=Slider(1.66, range=1..3),
    ScaleZ=Slider(1.93, range=1..3))  # -> Geometry, Transform
pt = Point(<point referenced from the Rhino model>)
loft = Loft(
    Curves=[scale_nu.Geometry, scale_nu_2.Geometry],
    Options={Adjust=False, Closed=False, LoftEnds=0, LoftSimp=0, LoftType=0, Rebuild=10, Refit=0.01})
sph = Sphere(Base=pt, Radius=Slider(3, range=0..10))
preview = CustomPreview(Geometry=sph, Material=ColourSwatch(SwatchColor=RGB(241, 202, 136)))
hex = HexagonCells(Surface=loft, UDivisions=Slider(21, range=0..100), VDivisions=Slider(25, range=0..100), TParameter=0.25)  # -> HexagonCells, Centers
dist = Distance(PointA=hex.Centers, PointB=pt)
dom = ConstructDomain(DomainStart=Slider(0.2, range=0..1), DomainEnd=Slider(1.4, range=0..1.4))
bnd = Bounds(Numbers=dist)
remap = RemapNumbers(Value=dist, Source=bnd, Target=dom)  # -> Mapped, Clipped
scale = Scale(Geometry=hex.HexagonCells, Center=hex.Centers, Factor=Slider(0.8, range=0..1))  # -> Geometry, Transform
scale_2 = Scale(Geometry=scale.Geometry, Center=hex.Centers, Factor=remap.Mapped)  # -> Geometry, Transform
srf_cp = SurfaceClosestPoint(Point=hex.Centers, Surface=loft)  # -> Point, UVPoint, Distance
evalsrf = EvaluateSurface(Surface=loft, Point=srf_cp.UVPoint)  # -> Point, Normal, UDirection, VDirection, Frame
multiplication = Multiplication(A=evalsrf.Normal, B=Slider(5.2, range=0..10))
move_2 = Move(Geometry=scale_2.Geometry, Motion=multiplication)  # -> Geometry, Transform
merge = Merge(Data1=graft(hex.HexagonCells), Data2=graft(scale.Geometry))
merge_2 = Merge(Data1=graft(scale.Geometry), Data2=graft(move_2.Geometry))
loft_2 = Loft(Curves=merge, Options={Adjust=False, Closed=False, LoftEnds=0, LoftSimp=0, LoftType=0, Rebuild=10, Refit=0.01})
loft_3 = Loft(Curves=merge_2, Options={Adjust=False, Closed=False, LoftEnds=0, LoftSimp=0, LoftType=0, Rebuild=10, Refit=0.01})
join = BrepJoin(Breps=[loft_2, loft_3])  # -> Breps, Closed
preview_2 = CustomPreview(
    Geometry=loft_2,
    Material={diffuse=RGB(221, 160, 221), emission=RGB(66, 48, 66), shine=0.5, specular=RGB(255, 255, 255), transparency=0})
preview_3 = CustomPreview(Geometry=loft_3, Material=ColourSwatch(SwatchColor=RGB(130, 198, 255)))
