# Grasshopper definition OMSept25_2016Structure.gh (Grasshopper 1.0.7)
# plug-ins: Bifocals

number_slider = Slider(8, range=0..10)
srf = Surface(<surface referenced from the Rhino model>)
divide = DivideDomain²(Domain=srf, UCount=number_slider, VCount=number_slider)
md_slider = MDSlider(SliderMode=0, slider_value=Point(0.5, 0.5, 0.5), x_domain=Domain(0, 1), y_domain=Domain(0, 1), z_domain=Domain(0, 1))
subsrf = Isotrim(Surface=srf, Domain=divide)
debrep = DeconstructBrep(Brep=subsrf)  # -> Faces, Edges, Vertices
evalsrf = EvaluateSurface(Surface=reparameterize(debrep.Faces), Point=md_slider)  # -> Point, Normal, UDirection, VDirection, Frame
rev = Reverse(Vector=evalsrf.Normal)
line = LineSDL(Start=evalsrf.Point, Direction=rev, Length=Slider(2.7, range=0..10))
end = EndPoints(Curve=line)  # -> Start, End
pt = Point(flatten(end.End))
partition = PartitionList(List=pt, Size=number_slider)
flip = FlipMatrix(Data=partition)
intcrv = Interpolate(Vertices=flip, Degree=3, Periodic=False, KnotStyle=1)  # -> Curve, Length, Domain
intcrv_2 = Interpolate(Vertices=partition, Degree=3, Periodic=False, KnotStyle=1)  # -> Curve, Length, Domain
ln = Line(StartPoint=end.End, EndPoint=debrep.Vertices)
crv = Curve(debrep.Edges)
pipe = Pipe(Curve=[intcrv.Curve, intcrv_2.Curve, ln, crv], Radius=Slider(0.3, range=0..2), Caps=0)
