# Grasshopper definition PickandPlace_v002Morel.gh (Grasshopper 1.0.7)
# plug-ins: KUKA|prc - parametric robot control, Bifocals

# ---- group: Place Location
pt = ConstructPoint(
    XCoordinate=Slider(1400, range=0..2500),
    YCoordinate=Slider(-80, range=-1000..2500),
    ZCoordinate=Slider(680, range=0..2500))

# ---- group: Pick Up Origin
pt_2 = ConstructPoint(
    XCoordinate=Slider(850, range=0..1000),
    YCoordinate=Slider(-1000, range=-1000..-999),
    ZCoordinate=Slider(0, range=0..100))

# ----
rectangle = Rectangle(Plane=pt_2, XSize=Slider(230, range=0..1000), YSize=Slider(110, range=0..1000), Radius=0)  # -> Rectangle, Length
boxrec = BoxRectangle(Rectangle=rectangle.Rectangle, Height=Slider(76, range=0..100))
debrep = DeconstructBrep(Brep=boxrec)  # -> Faces, Edges, Vertices
item = ListItem(List=debrep.Faces, Index=Slider(5, range=0..5), Wrap=True)
area = Area(Geometry=item)  # -> Area, Centroid
pickup = XYPlane(Origin=area.Centroid)
xy = XYPlane(Origin=pt)
orient = Orient(Geometry=boxrec, Source=pickup, Target=xy)  # -> Geometry, Transform
Z = UnitZ(Factor=Slider(650, range=0..1000))
move = Move(Geometry=pickup, Motion=Z)  # -> Geometry, Transform
move_2 = Move(Geometry=xy, Motion=Z)  # -> Geometry, Transform
ptp_move = KUKAPrcPTPMovement(TargetAsPlane=move.Geometry, extaxenabled=False, interpolation="C_PTP")
ptp_move_2 = KUKAPrcPTPMovement(TargetAsPlane=move_2.Geometry, extaxenabled=False, interpolation="C_PTP")
lin_move = KUKAPrcLINearMovement(TargetAsPlane=pickup, extaxenabled=False, interpolation="C_DIS")
lin_move_2 = KUKAPrcLINearMovement(TargetAsPlane=xy, extaxenabled=False, interpolation="C_DIS")
mesh_sphere = MeshSphere(Base=PlaneXY(0, 0, 0), Radius=Slider(39, range=0..100), UCount=10, VCount=20)
cmd_weave = CommandWeaver(
    Command1=ptp_move,
    Command2=lin_move,
    Command3=ptp_move,
    Command4=ptp_move_2,
    Command5=lin_move_2,
    Command6=ptp_move_2,
    enabletree=False)
mesh = Mesh(mesh_sphere)
custom_tool = CustomToolForKUKAPrc(
    CustomToolGeometry=mesh,
    toolid=8,
    toolvala=0,
    toolvalb=-90,
    toolvalc=0,
    toolvalx=0,
    toolvaly=0,
    toolvalz=20,
    valuesset=True)
kr_90_270_r2500 = KUKAQuantecKR90KR270R2500(highresactive=False)
play = KUKAPrcPlay(Loop=False, Reset=False, savedtime=6.138944717)
kuka_prc = KUKAPrcCORE(
    SimulationSlider=play,
    KUKAPrcCommands=cmd_weave,
    KUKAPrcTool=custom_tool,
    KUKAPrcRobot=kr_90_270_r2500,
    LINstartspeed=0.5,
    PRC_SaveNameExpose=False,
    PTPstartspeed=45,
    acc_cp=nan,
    acc_ptp=-1,
    basea=0,
    baseb=0,
    basec=0,
    baseindex=0,
    basex=0,
    basey=0,
    basez=0,
    camrobformatting="""&ACCESS RVP
&REL 1
&PARAM TEMPLATE = C:\KRC\Roboter\Template\vorgabe
&PARAM EDITMASK = *
[PROJECTNAME]

[SPLITDEFS]

;FOLD INI
;FOLD BASISTECH INI
GLOBAL INTERRUPT DECL 3 WHEN $STOPMESS==TRUE DO IR_STOPM ( )
INTERRUPT ON 3
BAS (#INITMOV,0 )
;ENDFOLD (BASISTECH INI)
;ENDFOLD (INI)

[STARTAXPOS]

[SETPARAMETERS]

[COMMANDS]

END""",
    camrobon=False,
    checkallcolls=False,
    enda01=5,
    enda02=-90,
    enda03=100,
    enda04=5,
    enda05=10,
    enda06=-5,
    ende01=0,
    ende02=0,
    ende03=0,
    ende04=0,
    endindex=0,
    haltatend=False,
    hash=1024,
    initialstatus="110",
    int_advance=3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)  # -> RobotGeometry, AnalysisOutput
