# Grasshopper definition PickandPlace_v004MorelFinal.gh (Grasshopper 1.0.7)
# plug-ins: KUKA|prc - parametric robot control, Bifocals

# ---- group: Place Location
pt = ConstructPoint(
    XCoordinate=Slider(1400, range=0..2500),
    YCoordinate=Slider(-80, range=-1000..2500),
    ZCoordinate=Slider(680, range=0..2500))

# ----
mesh = Mesh(<mesh referenced from the Rhino model>)
series = Series(Start=0, Step=Slider(110, range=0..1000), Count=Slider(3, range=0..10))
series_2 = Series(Start=0, Step=Slider(230, range=0..1000), Count=Slider(3, range=0..10))
Y = UnitY(Factor=expr("x*-1", series))
Y_2 = UnitY(Factor=series_2)
move = Move(Geometry=mesh, Motion=Y)  # -> Geometry, Transform
move_2 = Move(Geometry=pt, Motion=Y_2)  # -> Geometry, Transform
item = ListItem(List=move_2.Geometry, Index=Slider(0, range=0..2), Wrap=True)
item_2 = ListItem(List=move_2.Geometry, Index=Slider(1, range=0..2), Wrap=True)
item_3 = ListItem(List=move_2.Geometry, Index=Slider(2, range=0..2), Wrap=True)
Z = UnitZ(Factor=Slider(76, range=0..100))
volume = Volume(Geometry=move.Geometry)  # -> Volume, flatten(Centroid)
move_3 = Move(Geometry=item_2, Motion=Z)  # -> Geometry, Transform
xy = XYPlane(Origin=[item, item_3, move_3.Geometry])
pickup = XYPlane(Origin=volume.Centroid)
rad = Radians(Degrees=Slider(92, range=0..360))
prot = RotatePlane(Plane=xy, Angle=rad)
Z_2 = UnitZ(Factor=Slider(650, range=0..1000))
move_4 = Move(Geometry=prot, Motion=Z_2)  # -> Geometry, Transform
move_5 = Move(Geometry=pickup, Motion=Z_2)  # -> Geometry, Transform
orient = Orient(Geometry=move.Geometry, Source=pickup, Target=prot)  # -> Geometry, Transform
lng = ListLength(List=move_5.Geometry)
set_digital = KUKAPrcSetDigitalOut(
    DigitalOut1=False,
    DigitalOut2=False,
    DigitalOut3=Toggle(True),
    DigitalOut4=False,
    DigitalOut5=False,
    DigitalOut6=False,
    DigitalOut7=False,
    DigitalOut8=False,
    ContinuousMovement=False)
set_digital_2 = KUKAPrcSetDigitalOut(
    DigitalOut1=False,
    DigitalOut2=False,
    DigitalOut3=Toggle(False),
    DigitalOut4=False,
    DigitalOut5=False,
    DigitalOut6=False,
    DigitalOut7=False,
    DigitalOut8=False,
    ContinuousMovement=False)
ptp_move = KUKAPrcPTPMovement(TargetAsPlane=move_5.Geometry, extaxenabled=False, interpolation="C_PTP")
ptp_move_2 = KUKAPrcPTPMovement(TargetAsPlane=move_4.Geometry, extaxenabled=False, interpolation="C_PTP")
lin_move = KUKAPrcLINearMovement(TargetAsPlane=prot, extaxenabled=False, interpolation="C_DIS")
lin_move_2 = KUKAPrcLINearMovement(TargetAsPlane=pickup, extaxenabled=False, interpolation="C_DIS")
wait = KUKAPrcWait(KUKAPrcWait=1)
wait_2 = KUKAPrcWait(KUKAPrcWait=1)
msphere = MeshSphere(Base=PlaneXY(0, 0, 0), Radius=Slider(50, range=0..100), UCount=10, VCount=20)
dup = DuplicateData(Data=set_digital, Number=lng, Order=True)
mesh_2 = Mesh(msphere)
dup_2 = DuplicateData(Data=set_digital_2, Number=lng, Order=True)
dup_3 = DuplicateData(Data=wait_2, Number=lng, Order=True)
dup_4 = DuplicateData(Data=wait, Number=lng, Order=True)
cmd_weave = CommandWeaver(
    Command1=ptp_move,
    Command2=lin_move_2,
    Command3=dup,
    Command4=dup_4,
    Command5=ptp_move,
    Command6=ptp_move_2,
    Command7=lin_move,
    Command8=dup_2,
    Command9=dup_3,
    Command10=ptp_move_2,
    enabletree=False)
kr_90_270_r2500 = KUKAQuantecKR90KR270R2500(highresactive=False)
custom_tool = CustomToolForKUKAPrc(
    CustomToolGeometry=mesh_2,
    toolid=8,
    toolvala=0,
    toolvalb=-90,
    toolvalc=0,
    toolvalx=0,
    toolvaly=0,
    toolvalz=20,
    valuesset=True)
play = KUKAPrcPlay(Loop=False, Reset=False, savedtime=27.93330457)
kuka_prc = KUKAPrcCORE(
    SimulationSlider=play,
    KUKAPrcCommands=cmd_weave,
    KUKAPrcTool=custom_tool,
    KUKAPrcRobot=kr_90_270_r2500,
    LINstartspeed=0.5,
    PRC_SaveNameExpose=False,
    PTPstartspeed=45,
    acc_cp=nan,
    acc_ptp=-1,
    basea=0,
    baseb=0,
    basec=0,
    baseindex=0,
    basex=0,
    basey=0,
    basez=0,
    camrobformatting="""&ACCESS RVP
&REL 1
&PARAM TEMPLATE = C:\KRC\Roboter\Template\vorgabe
&PARAM EDITMASK = *
[PROJECTNAME]

[SPLITDEFS]

;FOLD INI
;FOLD BASISTECH INI
GLOBAL INTERRUPT DECL 3 WHEN $STOPMESS==TRUE DO IR_STOPM ( )
INTERRUPT ON 3
BAS (#INITMOV,0 )
;ENDFOLD (BASISTECH INI)
;ENDFOLD (INI)

[STARTAXPOS]

[SETPARAMETERS]

[COMMANDS]

END""",
    camrobon=False,
    checkallcolls=False,
    enda01=5,
    enda02=-90,
    enda03=100,
    enda04=5,
    enda05=10,
    enda06=-5,
    ende01=0,
    ende02=0,
    ende03=0,
    ende04=0,
    endindex=0,
    haltatend=False,
    hash=1024,
    initialstatus="110",
    int_advance=3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)  # -> RobotGeometry, AnalysisOutput
