# Grasshopper definition RWTH001.gh (Grasshopper 1.0.7)

geo = Geometry(<brep referenced from the Rhino model>)
X = UnitX(Factor=Slider(10, range=0..10))
move = Move(Geometry=geo, Motion=X)  # -> Geometry, Transform
panel = Panel(move.Geometry)
