# Grasshopper definition RWTH003.gh (Grasshopper 1.0.7)

number_slider = Slider(4, range=0..10)
crv = Curve(<curve referenced from the Rhino model>)
divlength = DivideLength(Curve=crv, Length=number_slider)  # -> Points, Tangents, Parameters
divide = DivideCurve(Curve=crv, Count=number_slider, Kinks=False)  # -> Points, Tangents, Parameters
divdist = DivideDistance(Curve=crv, Distance=Slider(11, range=0..100))  # -> Points, Tangents, Parameters
shatter = Shatter(Curve=divlength.Points, Parameters=divide.Parameters)
pline = PolyLine(Vertices=divlength.Points, Closed=Toggle(False))
explode = Explode(Curve=pline, Recursive=True)  # -> Segments, Vertices
len = Length(Curve=explode.Segments)
panel = Panel(len)
