# Grasshopper definition RWTH005.5.gh (Grasshopper 1.0.7)

geo = Geometry(<brep referenced from the Rhino model>)
crv = Curve(<curve referenced from the Rhino model>)
edges = BrepEdges(Brep=geo)  # -> Naked, Interior, NonManifold
geo_2 = Geometry(<brep referenced from the Rhino model>)
divide = DivideCurve(Curve=crv, Count=Slider(9, range=0..10), Kinks=False)  # -> Points, Tangents, Parameters
divide_2 = DivideDomain²(Domain=geo, UCount=Slider(6, range=0..10), VCount=Slider(5, range=0..10))
item = ListItem(List=edges.Naked, Index=0, Wrap=True)
subsrf = Isotrim(Surface=geo, Domain=divide_2)
srf_cp = SurfaceClosestPoint(Point=divide.Points, Surface=geo_2)  # -> Point, UVPoint, Distance
iso = IsoCurve(Surface=geo_2, UVPoint=srf_cp.UVPoint)  # -> UIsocurve, VIsocurve
panel = Panel(subsrf)
srfsplit = SurfaceSplit(Surface=geo_2, Curves=iso.VIsocurve)
