# Grasshopper definition RWTH005.gh (Grasshopper 1.0.7)

geo = Geometry(<brep referenced from the Rhino model>)
crv = Curve(<curve referenced from the Rhino model>)
divide = DivideCurve(Curve=crv, Count=Slider(5, range=0..10), Kinks=False)  # -> Points, Tangents, Parameters
divide_2 = DivideDomain²(Domain=geo, UCount=Slider(6, range=0..10), VCount=Slider(5, range=0..10))
shatter = Shatter(Curve=crv, Parameters=divide.Parameters)
subsrf = Isotrim(Surface=geo, Domain=divide_2)
Z = UnitZ(Factor=Slider(5, range=0..10))
extr = Extrude(Base=shatter, Direction=Z)
panel = Panel(subsrf)
arrlinear = LinearArray(Geometry=extr, Direction=Z, Count=Slider(5, range=0..10))  # -> Geometry, Transform
