# Grasshopper definition SimpleParticles_v002.gh (Grasshopper 1.0.7)
# plug-ins: FlexHopper

# ----
# Random Points
number_slider = Slider(112.793, range=0.001..200)
dom = ConstructDomain(DomainStart=expr("x*-1", number_slider), DomainEnd=number_slider)
random = Random(Range=dom, Number=expr("x*3", Slider(515, range=1..10000)), Seed=Slider(7, range=0..50))
partition = PartitionList(List=random, Size=3)
item = ListItem(List=partition, Index=0, Wrap=True)  # -> Item, Item1, Item2
addition = Addition(A=item.Item2, B=number_slider)
pt = ConstructPoint(XCoordinate=item.Item, YCoordinate=item.Item1, ZCoordinate=addition)  # -> flatten(Point)

particles = ParticlesFromPoints(Positions=pt, SelfCollision=Toggle(True))
xy = XYPlane(Origin=Point(0, 0, 0))
sph = Sphere(Base=PlaneXY(0, 0, 0), Radius=Slider(65, range=0..100))
scene = FlexScene(Particles=flatten(particles))
collgeometry = FlexCollisionGeometry(CollisionPlanes=flatten(xy), CollisionSpheres=flatten(sph))
opts = FlexSolverOptions(
    TimeStep=Slider(0.05, range=0..1),
    SubSteps=3,
    NumIterations=3,
    SceneMode=Slider(0, range=0..2),
    FixedNumberOfIteration=-1,
    MemoryRequirements=[131072, 96, 65536, 65536, 65536, 65536, 65536, 196608, 131972],
    StabilityScale=1)
flex = FlexEngine(FlexCollisionGeometry=collgeometry, FlexScene=flatten(scene), FlexSolverOptions=opts, Reset=Button(), Go=Toggle(True))  # -> FlexObject, Information
panel = Panel(flex.Information)
allparts = GetAllParticles(FlexObject=flex.FlexObject, N=1)  # -> Points, Vector
