# Grasshopper definition SimpleParticles_v003.gh (Grasshopper 1.0.7)
# plug-ins: FlexHopper

# ----
# Random Points
number_slider = Slider(185.744, range=0.001..200)
dom = ConstructDomain(DomainStart=expr("x*-1", number_slider), DomainEnd=number_slider)
random = Random(Range=dom, Number=expr("x*3", Slider(2050, range=1..10000)), Seed=Slider(7, range=0..50))
partition = PartitionList(List=random, Size=3)
item = ListItem(List=partition, Index=0, Wrap=True)  # -> Item, Item1, Item2
addition = Addition(A=item.Item2, B=number_slider)
pt = ConstructPoint(XCoordinate=item.Item, YCoordinate=item.Item1, ZCoordinate=addition)  # -> flatten(Point)

number_slider_2 = Slider(3.64, range=0.001..5)
particles = ParticlesFromPoints(Positions=pt, SelfCollision=Toggle(True))
number_slider_3 = Slider(65, range=0..100)
parameters = FlexParametersFromValues(
    Gravity=Vector(0, 0, -9.81),
    Radius=number_slider_2,
    SolidRestDistance=number_slider_2,
    FluidRestDistance=0.1,
    CollisionDistance=Slider(2.165, range=0.001..5),
    ParticleCollisionMargin=0.5,
    ShapeCollisionMargin=0.5,
    MaxSpeed=3.402823466e+38,
    MaxAcceleration=100,
    DynamicFriction=0,
    StaticFriction=0,
    ParticleFriction=0,
    Restitution=0,
    Adhesion=0,
    SleepThreshold=0,
    ShockPropagation=0,
    Dissipation=0,
    Damping=0,
    Fluid=True,
    Viscosity=0,
    Cohesion=0.025,
    SurfaceTension=0,
    SolidPressure=1,
    FreeSurfaceDrag=0,
    Buoyancy=1,
    PlasticThreshold=0,
    PlasticCreep=0,
    Wind=Vector(0, 0, 0),
    Drag=0,
    Lift=0,
    RelaxationMode=True,
    RelaxationFactor=1)
xy = XYPlane(Origin=Point(0, 0, 0))
geo = Geometry([<mesh referenced from the Rhino model> x4])
scene = FlexScene(Particles=flatten(particles))
collgeometry = FlexCollisionGeometry(CollisionPlanes=flatten(xy), CollisionMeshes=flatten(geo))
opts = FlexSolverOptions(
    TimeStep=Slider(0.05, range=0..1),
    SubSteps=3,
    NumIterations=3,
    SceneMode=Slider(0, range=0..2),
    FixedNumberOfIteration=-1,
    MemoryRequirements=[131072, 96, 65536, 65536, 65536, 65536, 65536, 196608, 131972],
    StabilityScale=1)
flex = FlexEngine(
    FlexParams=parameters,
    FlexCollisionGeometry=collgeometry,
    FlexScene=flatten(scene),
    FlexSolverOptions=opts,
    Reset=Button(),
    Go=Toggle(True))  # -> FlexObject, Information
panel = Panel(flex.Information)
allparts = GetAllParticles(FlexObject=flex.FlexObject, N=1)  # -> Points, Vector
bake = InstantBake(Objects=flatten(allparts.Points), LayerName="Default", ClearLayer=False)
