# Grasshopper definition SimpleParticles_v004.gh (Grasshopper 1.0.7)
# plug-ins: FlexHopper

# ----
# Random Points
number_slider = Slider(185.744, range=0.001..200)
dom = ConstructDomain(DomainStart=expr("x*-1", number_slider), DomainEnd=number_slider)
random = Random(Range=dom, Number=expr("x*3", Slider(345, range=1..10000)), Seed=Slider(7, range=0..50))
partition = PartitionList(List=random, Size=3)
item = ListItem(List=partition, Index=0, Wrap=True)  # -> Item, Item1, Item2
addition = Addition(A=item.Item2, B=number_slider)
pt = ConstructPoint(XCoordinate=item.Item, YCoordinate=item.Item1, ZCoordinate=addition)  # -> flatten(Point)

number_slider_2 = Slider(20, range=0.01..20)
number_slider_3 = Slider(2.185, range=0.01..10)
number_slider_4 = Slider(3.615, range=0..30)
number_slider_5 = Slider(4, range=0..10)
number_slider_6 = Slider(0, range=0..10)
parameters = FlexParametersFromValues(
    Gravity=Vector(0, 0, -9.81),
    Radius=number_slider_2,
    SolidRestDistance=number_slider_3,
    FluidRestDistance=0.1,
    CollisionDistance=number_slider_4,
    ParticleCollisionMargin=number_slider_5,
    ShapeCollisionMargin=number_slider_6,
    MaxSpeed=3.402823466e+38,
    MaxAcceleration=100,
    DynamicFriction=Slider(0, range=0..10),
    StaticFriction=0,
    ParticleFriction=0,
    Restitution=0,
    Adhesion=0,
    SleepThreshold=0,
    ShockPropagation=0,
    Dissipation=0,
    Damping=0,
    Fluid=True,
    Viscosity=0,
    Cohesion=0.025,
    SurfaceTension=0,
    SolidPressure=1,
    FreeSurfaceDrag=0,
    Buoyancy=1,
    PlasticThreshold=0,
    PlasticCreep=0,
    Wind=Vector(0, 0, 0),
    Drag=0,
    Lift=0,
    RelaxationMode=True,
    RelaxationFactor=1)
particles = ParticlesFromPoints(Positions=pt, SelfCollision=Toggle(True))
scene = FlexScene(Particles=flatten(particles))
xy = XYPlane(Origin=Point(0, 0, 0))
geo = Geometry([<mesh referenced from the Rhino model> x4])
collgeometry = FlexCollisionGeometry(CollisionPlanes=flatten(xy), CollisionMeshes=flatten(geo))
opts = FlexSolverOptions(
    TimeStep=Slider(0.05, range=0..1),
    SubSteps=3,
    NumIterations=3,
    SceneMode=Slider(0, range=0..2),
    FixedNumberOfIteration=-1,
    MemoryRequirements=[131072, 96, 65536, 65536, 65536, 65536, 65536, 196608, 131972],
    StabilityScale=1)
flex = FlexEngine(
    FlexParams=parameters,
    FlexCollisionGeometry=collgeometry,
    FlexScene=flatten(scene),
    FlexSolverOptions=opts,
    Reset=Button(),
    Go=Toggle(True))  # -> FlexObject, Information
preview_spheres = BooleanToggle(True)
panel = Panel(flex.Information)
allparts = GetAllParticles(FlexObject=flex.FlexObject, N=1)  # -> Points, Vector
gate = StreamGate(Stream=flex.FlexObject, Gate=preview_spheres)  # -> Target0, Target1
bake = InstantBake(Objects=flatten(allparts.Points), LayerName="Default", ClearLayer=False)  # disabled
allparts_2 = GetAllParticles(N=1)  # -> Points, Vector
particles_2 = GetParticleDescription(N=1)

# ----
# Visualisation
allparts_3 = GetAllParticles(FlexObject=gate.Target1, N=1)  # -> Points, Vector
detail = Slider(4, range=2..8)
msphereex = MeshSphereEx(Base=allparts_3.Points, Radius=expr("x*0.5", number_slider_2), Count=detail)
msphereex_2 = MeshSphereEx(Base=allparts_3.Points, Radius=expr("x*0.5", number_slider_3), Count=detail)
msphereex_3 = MeshSphereEx(Base=allparts_3.Points, Radius=number_slider_4, Count=detail)
msphereex_4 = MeshSphereEx(Base=allparts_3.Points, Radius=number_slider_5, Count=detail)
msphereex_5 = MeshSphereEx(Base=allparts_3.Points, Radius=number_slider_6, Count=detail)
preview = CustomPreview(Geometry=msphereex, Shader=ColourSwatch(SwatchColor=RGBA(0, 187, 255, 169)))
preview_2 = CustomPreview(Geometry=msphereex_2, Shader=ColourSwatch(SwatchColor=RGBA(255, 0, 0, 200)))
preview_3 = CustomPreview(Geometry=msphereex_3, Shader=ColourSwatch(SwatchColor=RGBA(255, 82, 82, 98)))
preview_4 = CustomPreview(Geometry=msphereex_4, Shader=ColourSwatch(SwatchColor=RGB(255, 251, 0)))
preview_5 = CustomPreview(Geometry=msphereex_5, Shader=ColourSwatch(SwatchColor=RGBA(255, 253, 122, 84)))

swatch = ColourSwatch(SwatchColor=RGB(58, 164, 240))
