# Grasshopper definition SpringConstraints_v001.gh (Grasshopper 1.0.7)
# plug-ins: FlexHopper, Bifocals

numsprings = Slider(12, range=1..100)
numsprings_2 = Slider(30, range=1..100)  # disabled
series = Series(Start=0, Step=1, Count=expr("x+1", numsprings_2))  # disabled
series_2 = Series(Start=0, Step=1, Count=expr("x+1", numsprings))
shift = ShiftList(List=series, Shift=1, Wrap=False)  # disabled

# ----
# Connect neighbors
# (controls elasticity)
shift_2 = ShiftList(List=series_2, Shift=1, Wrap=False)
weave = Weave(Pattern=[0, 1], Stream0=series_2, Stream1=shift_2, NullGaps=False)
split = SplitList(List=reverse(weave), Index=1)  # -> ListA, reverse(ListB)
springs = SpringConstraints(SpringPairIndices=flatten(split.ListB), SpringStiffness=Slider(0.95, range=0..0.99))

# ----
# Connect next but one neighbors
# (controls bending / crumbling)
shift_3 = ShiftList(List=series_2, Shift=2, Wrap=False)
weave_2 = Weave(Pattern=[0, 1], Stream0=series_2, Stream1=shift_3, NullGaps=False)
springs_2 = SpringConstraints(SpringPairIndices=flatten(weave_2), SpringStiffness=Slider(0.99, range=0..0.99))

range = Range(Domain=Domain(0, 20), Steps=numsprings)
weave_3 = Weave(Pattern=[0, 1], Stream0=series, Stream1=shift, NullGaps=False)  # disabled
number_slider = Slider(0.427, range=-2..1)  # disabled
number_slider_2 = Slider(0.551, range=0..2)  # disabled
split_2 = SplitList(List=reverse(weave_3), Index=1)  # -> ListA, reverse(ListB); disabled
pt = ConstructPoint(XCoordinate=range, YCoordinate=0, ZCoordinate=50)
toggle = BooleanToggle(False)
panel = Panel("0")  # disabled
panel_2 = Panel(split_2.ListB)  # disabled
range_2 = Range(Domain=Domain(0, 20), Steps=numsprings_2)  # disabled
toggle_2 = BooleanToggle(False)  # disabled
particles = ParticlesFromPoints(Positions=pt, SelfCollision=toggle, IsFluid=toggle)

# ----
# Connect us!
springs_3 = ConstraintsSprings(SpringPairIndices=panel_2, TargetSpringLength=number_slider, SpringStiffness=number_slider_2)  # disabled
anchor = ConstraintsAnchors(AnchorIndex=panel)  # disabled

anchor_2 = Anchor(AnchorIndex="0")
pt_2 = ConstructPoint(XCoordinate=range_2, YCoordinate=0, ZCoordinate=50)  # disabled
number_slider_3 = Slider(10, range=1..10)  # disabled
number_slider_4 = Slider(0.1, range=0..0.1)  # disabled
number_slider_5 = Slider(2, range=1..10)  # disabled
particles_2 = ParticlesFromPoints(Positions=pt_2, SelfCollision=toggle_2, IsFluid=toggle_2)  # disabled
button = Button()  # disabled
toggle_3 = BooleanToggle(True)  # disabled
scene = FlexScene(Particles=flatten(particles_2), LocalConstraints=flatten([springs_3, anchor]))  # disabled
opts = FlexSolverOptions(
    TimeStep=number_slider_4,
    SubSteps=number_slider_5,
    NumIterations=number_slider_3,
    SceneMode=0,
    FixedNumberOfIteration=-1,
    MemoryRequirements=[131072, 96, 65536, 65536, 65536, 65536, 65536, 196608, 131972],
    StabilityScale=1)  # disabled
panel_3 = Panel(springs)
flex = FlexEngine(FlexScene=flatten(scene), FlexSolverOptions=opts, Reset=button, Go=toggle_3)  # -> FlexObject, Information; disabled
scene_2 = FlexScene(Particles=flatten(particles), LocalConstraints=flatten([springs, springs_2, anchor_2]))
allsprings = GetAllSprings(FlexObject=flex.FlexObject, N=1)  # disabled
allparts = GetAllParticles(FlexObject=flex.FlexObject, N=1)  # -> Points, Vector; disabled
flex_2 = FlexEngine(FlexScene=flatten(scene_2), Reset=Button(), Go=Toggle(False))  # -> FlexObject, Information
mesh = Mesh(<mesh referenced from the Rhino model>)
allparts_2 = GetAllParticles(FlexObject=flex_2.FlexObject, N=1)  # -> Points, Vector
allsprings_2 = GetAllSprings(FlexObject=flex_2.FlexObject, N=1)
pl = ConstructPlane(Origin=allparts_2.Points, XAxis=Vector(1, 0, 0), YAxis=Vector(0, 1, 0))
orient = Orient(Geometry=mesh, Source=PlaneXY(0, 0, 0), Target=pl)  # -> Geometry, Transform
