# Grasshopper definition VitruvianMan_v001.gh (Grasshopper 1.0.7)
# plug-ins: Bifocals

# ---- group: straightArms
crv = Curve([<curve referenced from the Rhino model> x2])
curvepoint = PointOnCurve(crv, parameter=0.5)
pl = ConstructPlane(Origin=curvepoint, XAxis=crv, YAxis=Vector(0, 1, 0))

# ---- group: Raised Arms
crv_2 = Curve([<curve referenced from the Rhino model> x2])
curvepoint_2 = PointOnCurve(crv_2, parameter=0.5)
pl_2 = ConstructPlane(Origin=curvepoint_2, XAxis=crv_2, YAxis=Vector(0, 1, 0))

# ---- group: StraightLeg
crv_3 = Curve(<curve referenced from the Rhino model>)
curvepoint_3 = PointOnCurve(crv_3, parameter=0.5)
pl_3 = ConstructPlane(Origin=curvepoint_3, XAxis=crv_3, YAxis=Vector(0, 1, 0))

# ---- group: Raised Legs
crv_4 = Curve([<curve referenced from the Rhino model> x2])
curvepoint_4 = PointOnCurve(crv_4, parameter=0.5)
pl_4 = ConstructPlane(Origin=curvepoint_4, XAxis=crv_4, YAxis=Vector(0, 1, 0))
