# Grasshopper definition WickersonStudiosFireflySwordPlayAR_v001.gh (Grasshopper 1.0.7)
# plug-ins: Firefly.X, Bifocals, FologramForGrasshopper

number_slider = Slider(68, range=0..100)
number_slider_2 = Slider(4, range=0..100)
sound_capture = SoundCapture(TimePeriod=Slider(0.02, range=0..0.1), StartStopSoundCapture=Toggle(True))  # -> WavePressureSamplesFromLeftChannel, WavePressureSamplesFromRightChannel, Volume
number_slider_3 = Slider(65, range=0..100)
center_box = CenterBox(Base=PlaneXY(0, 0, 0), X=number_slider, Y=number_slider, Z=number_slider)
webcam_video_stream = WebCamVideoStream()
timer = Timer(TimerInterval=20, Target=sound_capture)
populate_3d = Populate3D(Region=center_box, Count=number_slider_2, Seed=Slider(15, range=0..100))
populate_3d_2 = Populate3D(Region=center_box, Count=number_slider_2, Seed=1)
center_box_2 = CenterBox(Base=PlaneXY(0, 0, 0), X=number_slider_3, Y=number_slider_3, Z=number_slider_3)
color_correction = ColorCorrection(
    BitmapToModify=webcam_video_stream,
    AlphaMultiplier=1,
    RedMultiplier=Slider(0, range=0..100),
    GreenMultiplier=Slider(4, range=0..100),
    BlueMultiplier=Slider(2, range=0..100))
data_recorder = DataRecorder(sound_capture.Volume, DataLimit=12, RecordData=True)
nurbs_curve = NurbsCurve(Vertices=populate_3d, Degree=3, Periodic=False)  # -> Curve, Length, Domain
nurbs_curve_2 = NurbsCurve(Vertices=populate_3d_2, Degree=3, Periodic=False)  # -> Curve, Length, Domain
multiplication = Multiplication(A=data_recorder, B=Slider(0.528, range=0.02..2))
populate_3d_3 = Populate3D(Region=center_box_2, Count=Slider(3, range=0..100), Seed=multiplication)
video_averages = VideoAverages(BitmapToModify=color_correction, MinimumPointOfBoundingArea=Point(0, 0, 0), MaximumPointOfBoundingArea=Point(1, 1, 0))  # -> AverageColor, AverageMovementVector, CentroidOfMovement, CentroidOfRedPixels, CentroidOfGreenPixels, CentroidOfBluePixels
gene_pool = GenePool(Decimals=3, Maximum=1, Minimum=0, Value=[0, 0.113, 0.317, 0.437, 0.549, 0.62, 0.682, 0.739, 0.803, 0.851, 0.957, 1])
proximity_3d = Proximity3D(Points=populate_3d_3, Group=5)  # -> Links, Topology; disabled
sync_object = SyncObject(
    GM=proximity_3d.Links,
    AlwaysIncludeTextureCoordinates=False,
    Clickable=False,
    DefaultCurveThicknessMillimeters=2.5,
    DefaultGlossPercent=0,
    DefaultMaterialColor=RGB(0, 255, 255),
    DefaultSpecularPercent=0,
    Interactive=False,
    hasSerializedData=True)
create_material = CreateMaterial(Diffuse=video_averages.AverageColor, Specular=RGB(255, 255, 255), Emission=RGB(0, 0, 0), Transparency=0, Shine=0)
nurbs_curve_3 = NurbsCurve(
    Vertices=[video_averages.CentroidOfRedPixels, video_averages.CentroidOfGreenPixels, video_averages.CentroidOfBluePixels, video_averages.AverageColor, video_averages.AverageMovementVector, video_averages.CentroidOfMovement],
    Degree=3,
    Periodic=False)  # -> reparameterize(Curve), Length, Domain
scale = Scale(Geometry=nurbs_curve_3.Curve, Center=Point(0, 0, 0), Factor=Slider(88, range=0..100))  # -> Geometry, Transform
pipe_variable = PipeVariable(Curve=scale.Geometry, Parameters=gene_pool, Radii=multiplication, Caps=2)
colour_rgb = ColourRGB(Alpha=255, Red=0, Green=0, Blue=0)
custom_preview = CustomPreview(Geometry=pipe_variable, Material=create_material)
