# Grasshopper definition WickersonStudiosFireflySwordPlayAR_v002ColourCurveTest.gh (Grasshopper 1.0.7)
# plug-ins: Firefly.X, KUKA|prc - parametric robot control, Bifocals

webcam_video_stream = WebCamVideoStream()
dim_u = Slider(1, range=0..100)
dim_v = Slider(20, range=0..100)
color_correction = ColorCorrection(
    BitmapToModify=webcam_video_stream,
    AlphaMultiplier=1,
    RedMultiplier=Slider(100, range=0..100),
    GreenMultiplier=Slider(36, range=0..100),
    BlueMultiplier=Slider(28, range=0..100))
multiplication = Multiplication(A=dim_u, B=dim_v)
range = Range(Domain=Domain(0, 1), Steps=dim_u)
video_averages = VideoAverages(BitmapToModify=color_correction, MinimumPointOfBoundingArea=Point(0, 0, 0), MaximumPointOfBoundingArea=Point(1, 1, 0))  # -> AverageColor, AverageMovementVector, CentroidOfMovement, CentroidOfRedPixels, CentroidOfGreenPixels, CentroidOfBluePixels
rev = ReverseList(List=range)
subtraction = Subtraction(A=multiplication, B="1")
split = SplitList(List=rev, Index="1")  # -> ListA, ListB
range_2 = Range(Domain=Domain(0, 1), Steps=subtraction)
rev_2 = ReverseList(List=split.ListB)
dup = DuplicateData(Data=rev_2, Number=dim_v, Order=True)
nurbs_curve = NurbsCurve(
    Vertices=[video_averages.CentroidOfRedPixels, video_averages.CentroidOfGreenPixels, video_averages.CentroidOfBluePixels, video_averages.AverageColor, video_averages.AverageMovementVector, video_averages.CentroidOfMovement],
    Degree=3,
    Periodic=False)  # -> reparameterize(Curve), Length, Domain
create_material = CreateMaterial(Diffuse=video_averages.AverageColor, Specular=RGB(255, 255, 255), Emission=RGB(0, 0, 0), Transparency=0, Shine=0)
pt = ConstructPoint(XCoordinate=range_2, YCoordinate=dup, ZCoordinate=0)
scale = Scale(Geometry=nurbs_curve.Curve, Center=Point(0, 0, 0), Factor=Slider(3100, range=0..3100))  # -> Geometry, Transform
eval = EvaluateCurve(Curve=reparameterize(scale.Geometry), Parameter=graft(pt))  # -> Point, Tangent, Angle
custom_preview = CustomPreview(Geometry=scale.Geometry, Material=create_material)
deplane = DeconstructPlane(Plane=eval.Point)  # -> Origin, XAxis, YAxis, ZAxis
pt_2 = Point(Point(118.2418033, 365.6487876, 55.07248368))
mesh = Mesh(<mesh referenced from the Rhino model>)
pl = PlaneNormal(Origin=deplane.Origin, ZAxis=deplane.XAxis)
orient_pln = OrientPlaneKUKAPrc(Plane=pl, OrientPoint=pt_2)
number_slider = Slider(0.2258813, range=0..1)
custom_tool = CustomToolKUKAPrc(
    CustomToolGeometry=mesh,
    toolid=6,
    toolvala=0,
    toolvalb=0,
    toolvalc=0,
    toolvalx=333,
    toolvaly=333,
    toolvalz=88,
    valuesset=True)
kr90_kr270_r3100 = QuantecKR90KR270R3100Robot(infiniterot=False)
lin_move = LINearMovementKUKAPrc(TargetAsPlane=orient_pln, extaxenabled=False, interpolation="C_DIS")  # -> flatten(KUKAPrcCommand)
spindle = GenericSpindleKUKAPrc(ToolLength=100, ToolDiameter=10, ToolNumber=6)
kr3_r540 = AgilusKR3R540Robot(infiniterot=False)
play = KUKAPrcPlay(Loop=False, Reset=Toggle(False), savedtime=33.39032633)
kuka_prc = KUKAPrcCORE(
    SimulationSlider=play,
    KUKAPrcCommands=lin_move,
    Tool=custom_tool,
    Robot=kr90_kr270_r3100,
    PRC_BaseExpose=False,
    PRC_SaveNameExpose=False,
    PRCsettings="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")  # -> RobotGeometry, AnalysisOutput
