# Grasshopper definition WickersonStudiosFireflySwordPlayAR_v003TestPreAR.gh (Grasshopper 1.0.7)
# plug-ins: Firefly.X, KUKA|prc - parametric robot control, Bifocals, FologramForGrasshopper

webcam_video_stream = WebCamVideoStream()
number_slider = Slider(100, range=0..100)
number_slider_2 = Slider(36, range=0..100)
number_slider_3 = Slider(28, range=0..100)
dim_u = Slider(1, range=0..100)
dim_v = Slider(45, range=0..100)
color_correction = ColorCorrection(
    BitmapToModify=webcam_video_stream,
    AlphaMultiplier=1,
    RedMultiplier=number_slider,
    GreenMultiplier=number_slider_2,
    BlueMultiplier=number_slider_3)
multiplication = Multiplication(A=dim_u, B=dim_v)
range = Range(Domain=Domain(0, 1), Steps=dim_u)
video_averages = VideoAverages(BitmapToModify=color_correction, MinimumPointOfBoundingArea=Point(0, 0, 0), MaximumPointOfBoundingArea=Point(1, 1, 0))  # -> AverageColor, AverageMovementVector, CentroidOfMovement, CentroidOfRedPixels, CentroidOfGreenPixels, CentroidOfBluePixels
rev = ReverseList(List=range)
subtraction = Subtraction(A=multiplication, B="1")
split = SplitList(List=rev, Index="1")  # -> ListA, ListB
range_2 = Range(Domain=Domain(0, 1), Steps=subtraction)
number_slider_4 = Slider(2058, range=0..3100)
rev_2 = ReverseList(List=split.ListB)
dup = DuplicateData(Data=rev_2, Number=dim_v, Order=True)
nurbs_curve = NurbsCurve(
    Vertices=[video_averages.CentroidOfRedPixels, video_averages.CentroidOfGreenPixels, video_averages.CentroidOfBluePixels, video_averages.AverageColor, video_averages.AverageMovementVector, video_averages.CentroidOfMovement],
    Degree=3,
    Periodic=False)  # -> reparameterize(Curve), Length, Domain
create_material = CreateMaterial(Diffuse=video_averages.AverageColor, Specular=RGB(255, 255, 255), Emission=RGB(0, 0, 0), Transparency=0, Shine=0)
pt = ConstructPoint(XCoordinate=range_2, YCoordinate=dup, ZCoordinate=0)
scale = Scale(Geometry=nurbs_curve.Curve, Center=Point(0, 0, 0), Factor=number_slider_4)  # -> Geometry, Transform
Z = UnitZ(Factor=number_slider_4)
move = Move(Geometry=scale.Geometry, Motion=Z)  # -> Geometry, Transform
eval = EvaluateCurve(Curve=reparameterize(move.Geometry), Parameter=graft(pt))  # -> Point, Tangent, Angle
custom_preview = CustomPreview(Geometry=move.Geometry, Material=create_material)
deplane = DeconstructPlane(Plane=eval.Point)  # -> Origin, XAxis, YAxis, ZAxis
pt_2 = Point(Point(118.2418033, 365.6487876, 55.07248368))
mesh = Mesh(<mesh referenced from the Rhino model>)
pl = PlaneNormal(Origin=deplane.Origin, ZAxis=deplane.XAxis)
orient_pln = OrientPlaneKUKAPrc(Plane=pl, OrientPoint=pt_2)
number_slider_5 = Slider(0.2258813, range=0..1)
toggle = BooleanToggle(True)
toggle_2 = BooleanToggle(False)
custom_tool = CustomToolKUKAPrc(
    CustomToolGeometry=mesh,
    toolid=6,
    toolvala=0,
    toolvalb=0,
    toolvalc=0,
    toolvalx=1,
    toolvaly=0,
    toolvalz=670,
    valuesset=True)
kr90_kr270_r3100 = QuantecKR90KR270R3100Robot(infiniterot=False)
lin_move = LINearMovementKUKAPrc(TargetAsPlane=orient_pln, extaxenabled=False, interpolation="C_DIS")  # -> flatten(KUKAPrcCommand)
spindle = GenericSpindleKUKAPrc(ToolLength=100, ToolDiameter=10, ToolNumber=6)
kr3_r540 = AgilusKR3R540Robot(infiniterot=False)
play = KUKAPrcPlay(Loop=toggle_2, Reset=toggle, savedtime=21.14074857)
kuka_prc = KUKAPrcCORE(
    SimulationSlider=play,
    KUKAPrcCommands=lin_move,
    Tool=custom_tool,
    Robot=kr90_kr270_r3100,
    PRC_BaseExpose=False,
    PRC_SaveNameExpose=False,
    PRCsettings="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")  # -> RobotGeometry, AnalysisOutput
syncparams = SyncParameters(
    augmented_trigger_0_key=number_slider_4,
    augmented_trigger_1_key=number_slider,
    augmented_trigger_2_key=number_slider_2,
    augmented_trigger_3_key=number_slider_3,
    augmented_trigger_4_key=dim_u,
    augmented_trigger_5_key=dim_v,
    augmented_trigger_6_key=number_slider_5,
    augmented_trigger_7_key=toggle,
    augmented_trigger_8_key=toggle_2,
    componentVersion=1,
    num_augmented_triggers=9)
geo = Geometry(kuka_prc.RobotGeometry)
viewer = ParamViewer(geo)
mesh_2 = Mesh(kuka_prc.RobotGeometry)
panel = Panel(geo)
sync = SyncObject(
    GM=mesh_2,
    AlwaysIncludeTextureCoordinates=False,
    Clickable=False,
    DefaultCurveThicknessMillimeters=2.5,
    DefaultGlossPercent=0,
    DefaultMaterialColor=RGB(255, 255, 255),
    DefaultSpecularPercent=0,
    Interactive=False,
    hasSerializedData=True)
