# Grasshopper definition WickersonStudiosKlokkenstoelSection1of4.gh (Grasshopper 1.0.7)
# plug-ins: Pufferfish, Bifocals, Weaverbird

axle_arc_height = Slider(2.57, range=-3..6)  # disabled
number_of_spokes = Slider(7, range=2..20)  # disabled
well_thickness = Slider(2.31, range=0.1..3)  # disabled
wheelband_height = Slider(1.06, range=0.2..2)  # disabled
tap_hole_height = Slider(4.91, range=1..5)  # disabled
scale_well_axle = Slider(7, range=3..7)  # disabled
scale_wheels = Slider(7.59, range=0..10)  # disabled
spoke_thickness_factor = Slider(2.733, range=1..5)  # disabled
support_thickness = Slider(0.5, range=0.05..0.5)  # disabled
axle_thickness = Slider(0.546, range=0..0.7)  # disabled
support_count = Slider(4, range=0..10)  # disabled
rotate_wheels = Slider(0.08, range=-0.1..0.51)  # disabled
wheelband_width = Slider(8, range=3..8)  # disabled

# ----
# Cupola Cart, Algorithm 001, Wickerson Studios, 2020
fillet_radius = Slider(0.035, range=0..0.1)  # disabled
panel = Panel("1")  # disabled
Z = UnitZ(Factor=axle_arc_height)  # disabled
pt = ConstructPoint(XCoordinate=0, YCoordinate=0, ZCoordinate=0)  # disabled
pt_2 = Point(pt)  # disabled
move = Move(Geometry=pt_2, Motion=Z)  # -> Geometry, Transform; disabled
panel_2 = Panel("5")  # disabled
X = UnitX(Factor=scale_well_axle)  # disabled
addition = Addition(A=scale_well_axle, B=panel_2)  # disabled
neg = Negative(Value=X)  # disabled
Y = UnitY(Factor=addition)  # disabled
merge = Merge(Data1=X, Data2=neg)  # disabled
neg_2 = Negative(Value=Y)  # disabled
move_2 = Move(Geometry=pt, Motion=merge)  # -> Geometry, Transform; disabled
Z_2 = UnitZ(Factor=scale_well_axle)  # disabled
panel_3 = Panel("1.5")  # disabled
line = LineSDL(Start=pt_2, Direction=neg_2, Length=addition)  # disabled
multiplication = Multiplication(A=axle_thickness, B=panel_3)  # disabled
pl = PlaneNormal(Origin=move_2.Geometry, ZAxis=X)  # disabled
circle = CircleCNR(Center=move_2.Geometry, Normal=pl, Radius=scale_wheels)  # -> flatten(Circle); disabled
pipe = Pipe(Curve=line, Radius=multiplication, Caps=0)  # disabled
Y_2 = UnitY(Factor=1)  # disabled
panel_4 = Panel("1")  # disabled
polygon = Polygon(Plane=PlaneXY(0, 0, 0), Radius=wheelband_height, Segments=wheelband_width, FilletRadius=fillet_radius)  # -> Polygon, Length; disabled
panel_5 = Panel("0")  # disabled
neg_3 = Negative(Value=well_thickness)  # disabled
pi = Pi(Factor=rotate_wheels)  # disabled
ellipse = Ellipse(Plane=PlaneXY(0, 0, 0), Radius1=wheelband_height, Radius2=wheelband_width)  # -> Ellipse, Focus1, Focus2; disabled
item = ListItem(List=circle, Index=panel_4, Wrap=True)  # disabled
item_2 = ListItem(List=circle, Index=panel_5, Wrap=True)  # disabled
division = Division(A=wheelband_height, B=spoke_thickness_factor)  # disabled
line_2 = LineSDL(Start=item, Direction=Y_2, Length=1)  # disabled
neg_4 = Negative(Value=pi)  # disabled
line_3 = LineSDL(Start=item_2, Direction=Y_2, Length=1)  # disabled
Z_3 = UnitZ(Factor=tap_hole_height)  # disabled
rotax = RotateAxis(Geometry=item_2, Angle=pi, Axis=line_3)  # -> Geometry, Transform; disabled
rotax_2 = RotateAxis(Geometry=item, Angle=neg_4, Axis=line_2)  # -> Geometry, Transform; disabled
move_3 = Move(Geometry=pipe, Motion=Z_3)  # -> Geometry, Transform; disabled
cap = CapHoles(Brep=move_3.Geometry)  # disabled
merge_2 = Merge(Data1=rotax.Geometry, Data2=rotax_2.Geometry)  # disabled
pt_3 = Point(graft(move_2.Geometry))  # disabled
pt_4 = Point(pt_3)  # disabled
split = SplitList(List=flatten(pt_4), Index=panel)  # -> ListA, ListB; disabled
arc = Arc3Pt(PointA=split.ListA, PointB=move.Geometry, PointC=split.ListB)  # -> Arc, Plane, Radius; disabled
curvepoint = PointOnCurve(arc.Arc, parameter=0.5)  # disabled
crv = Curve(reparameterize(arc.Arc))  # disabled
curvepoint_2 = PointOnCurve(crv, parameter=1)  # disabled
curvepoint_3 = PointOnCurve(crv, parameter=0)  # disabled
cir = Circle(Plane=curvepoint, Radius=scale_well_axle)  # disabled
pipe_2 = Pipe(Curve=arc.Arc, Radius=axle_thickness, Caps=0)  # disabled
move_4 = Move(Geometry=cir, Motion=Z_2)  # -> Geometry, Transform; disabled
cap_2 = CapHoles(Brep=pipe_2)  # disabled
merge_3 = Merge(Data1=curvepoint_3, Data2=curvepoint_2)  # -> graft(Result); disabled
divide = DivideCurve(Curve=cir, Count=support_count, Kinks=False)  # -> Points, Tangents, Parameters; disabled
merge_4 = Merge(Data1=cir, Data2=move_4.Geometry)  # -> flatten(Result); disabled
geo = Geometry(cap_2)  # disabled
loft = Loft(Curves=[cir, merge_4], Options={Adjust=False, Closed=False, LoftEnds=0, LoftSimp=0, LoftType=0, Rebuild=10, Refit=0.01})  # disabled
ln = Line(StartPoint=divide.Points, EndPoint=merge_3)  # disabled
offset = OffsetSurface(Surface=loft, Distance=neg_3, Retrim=True)  # disabled
cap_3 = CapHoles(Brep=loft)  # -> flatten(Brep); disabled
pipe_3 = Pipe(Curve=ln, Radius=support_thickness, Caps=2)  # disabled
cap_4 = CapHoles(Brep=offset)  # -> flatten(Brep); disabled
sdiff = SolidDifference(BrepsA=cap_3, BrepsB=cap_4)  # disabled
cap_5 = CapHoles(Brep=pipe_3)  # disabled
sdiff_2 = SolidDifference(BrepsA=sdiff, BrepsB=cap)  # disabled
divide_2 = DivideCurve(Curve=merge_2, Count=number_of_spokes, Kinks=False)  # -> Points, Tangents, Parameters; disabled
sunion = SolidUnion(Breps=[sdiff_2, cap_5])  # -> graft(Result); disabled
pframes = PerpFrames(Curve=[rotax_2.Geometry, rotax.Geometry], Count=10, Align=True)  # -> Frames, Parameters; disabled
ln_2 = Line(StartPoint=pt_3, EndPoint=divide_2.Points)  # disabled
orient = Orient(Geometry=polygon.Polygon, Source=PlaneXY(0, 0, 0), Target=pframes.Frames)  # -> Geometry, Transform; disabled
crv_2 = Curve(merge_2)  # disabled
panel_6 = Panel("1")  # disabled
pipe_4 = Pipe(Curve=ln_2, Radius=division, Caps=panel_6)  # -> flatten(Pipe); disabled
loft_2 = Loft(Curves=orient.Geometry, Options={Adjust=False, Closed=True, LoftEnds=0, LoftSimp=0, LoftType=0, Rebuild=10, Refit=0.01})  # -> flatten(Loft); disabled
sunion_2 = SolidUnion(Breps=[pipe_4, loft_2])  # disabled
geo_2 = Geometry(sdiff_2)  # disabled
geo_3 = Geometry(geo)  # disabled
geo_4 = Geometry()  # disabled
geo_5 = Geometry(cap_5)  # disabled

# ----
# Klokkenstoel Tower, algorithm 004, Wickerson Studios, 2020
main_mesh_height = Slider(29, range=0..100)  # disabled
main_mesh = Slider(4, range=0..10)  # disabled
main_mesh_rotation = Slider(0.47, range=0..0.51)  # disabled
main_mesh_top_diameter = Slider(1.2, range=0..3)  # disabled
main_mesh_thickness = Slider(1, range=0..1)  # disabled
billows = Slider(2.16, range=-3..10)  # disabled
curve = Curve(move_4.Geometry)  # disabled
billows_geometry = Slider(1, range=0..3)  # disabled
main_mesh_division = Slider(3, range=0..3)  # disabled
divide_curve = DivideCurve(Curve=curve, Count=main_mesh, Kinks=False)  # -> Points, Tangents, Parameters; disabled
unit_z = UnitZ(Factor=main_mesh_height)  # disabled
move_5 = Move(Geometry=divide_curve.Points, Motion=unit_z)  # -> Geometry, Transform; disabled
pi_2 = Pi(Factor=main_mesh_rotation)  # disabled
internal_billows = Slider(10, range=0..10)  # disabled
rotate = Rotate(Geometry=move_5.Geometry, Angle=pi_2, Plane=PlaneXY(0, 0, 0))  # -> Geometry, Transform; disabled
polyline = PolyLine(Vertices=rotate.Geometry, Closed=True)  # disabled
boundary_surfaces = BoundarySurfaces(Edges=polyline)  # disabled
area = Area(Geometry=boundary_surfaces)  # -> Area, Centroid; disabled
scale = Scale(Geometry=rotate.Geometry, Center=area.Centroid, Factor=main_mesh_top_diameter)  # -> Geometry, Transform; disabled
point = Point(divide_curve.Points)  # disabled
number_slider = Slider(3, range=1..3)  # disabled
merge_5 = Merge(Data1=point, Data2=scale.Geometry)  # -> flatten(Result); disabled
sort_points = SortPoints(Points=merge_5)  # -> Points, Indices; disabled
number_slider_2 = Slider(1, range=1..3)  # disabled
delaunay_mesh = DelaunayMesh(Points=sort_points.Points, Plane=PlaneXY(0, 0, 0))  # disabled
mesh = Mesh(delaunay_mesh)  # disabled
point_list = PointList(Points=sort_points.Points)  # disabled
weaverbird_s_midedge_subdivision = WeaverbirdsMidedgeSubdivision(MeshCurves=mesh, Level=number_slider, SmoothNakedEdges=1)  # disabled
weaverbird_s_split_polygons_subdivision = WeaverbirdsSplitPolygonsSubdivision(MeshCurves=mesh, Level=number_slider_2, SmoothNakedEdges=1)  # disabled
weaverbird_s_loop_subdivision = WeaverbirdsLoopSubdivision(MeshCurves=mesh, Level=1, SmoothNakedEdges=1)  # disabled
weaverbird_s_constant_quads_split_subdiv = WeaverbirdsConstantQuadsSplitSubdivision(MeshCurves=mesh, Level=number_slider, SmoothNakedEdges=1)  # disabled
weaverbird_s_sierpinski_triangles_subdiv = WeaverbirdsSierpinskiTrianglesSubdivision(MeshCurves=mesh, Level=number_slider)  # disabled
weaverbird_s_split_triangles_subdivision = WeaverbirdsSplitTrianglesSubdivision(MeshCurves=mesh, Level=number_slider_2)  # disabled
weaverbird_s_inner_polygons_subdivision = WeaverbirdsInnerPolygonsSubdivision(MeshCurves=mesh, Level=number_slider)  # disabled
weaverbird_s_picture_frame = WeaverbirdsPictureFrame(MeshPolylines=delaunay_mesh, Distance=5, InsetType=0)  # disabled
weaverbird_s_mesh_window = WeaverbirdsMeshWindow(MeshPolylines=delaunay_mesh, Distance=internal_billows, InsetType=0)  # disabled
negative = Negative(Value=main_mesh_thickness)  # disabled
negative_2 = Negative(Value=main_mesh_thickness)  # disabled
negative_3 = Negative(Value=billows)  # disabled
weaverbird_s_mesh_thicken = WeaverbirdsMeshThicken(MeshCurves=weaverbird_s_mesh_window, Distance=negative, OffsetType=0)  # disabled
weaverbird_s_mesh_thicken_2 = WeaverbirdsMeshThicken(MeshCurves=weaverbird_s_picture_frame, Distance=negative_2, OffsetType=0)  # disabled
weaverbird_s_stellate_cumulation = WeaverbirdsStellateCumulation(MeshPolylines=delaunay_mesh, Distance=negative_3)  # disabled
weaverbird_s_catmull_clark_subdivision = WeaverbirdsCatmullClarkSubdivision(MeshCurves=weaverbird_s_mesh_thicken, Level=main_mesh_division, SmoothNakedEdges=1)  # disabled
weaverbird_s_catmull_clark_subdivision_2 = WeaverbirdsCatmullClarkSubdivision(MeshCurves=weaverbird_s_mesh_thicken_2, Level=main_mesh_division, SmoothNakedEdges=1)  # disabled

# ----
# Bell Tower, Algorithm 004, Wickerson Studios, 2020
number_slider_3 = Slider(0.13, range=0..1)
number_slider_4 = Slider(15, range=0..100)
dom = ConstructDomain(DomainStart=0, DomainEnd=1)
dom_2 = ConstructDomain(DomainStart=0, DomainEnd=1)
range = Range(Domain=dom, Steps=number_slider_4)
range_2 = Range(Domain=dom_2, Steps=number_slider_4)
graph = GraphMapper(
    range,
    x0=0,
    x1=1,
    y0=0,
    y1=2,
    container_name="Bezier",
    cpx=[0, 0.1291844696, 0.3071455061, 1],
    cpy=[1, 0.4545068741, 0, 0])
eval = Evaluate(F="x+1", x=range)
graph_2 = GraphMapper(
    simplify(range_2),
    x0=0,
    x1=1,
    y0=0,
    y1=1.5,
    container_name="Bezier",
    cpx=[0, 0.1753288209, 1, 1],
    cpy=[0.9931949377, 1, 0.6188043356, 0])
pt_5 = ConstructPoint(XCoordinate=eval, YCoordinate=0, ZCoordinate=graph)
eval_2 = Evaluate(F="x+1", x=range_2)
intcrv = Interpolate(Vertices=pt_5, Degree=3, Periodic=False, KnotStyle=1)  # -> Curve, Length, Domain
pt_6 = ConstructPoint(XCoordinate=eval_2, YCoordinate=0, ZCoordinate=graph_2)
end = EndPoints(Curve=intcrv.Curve)  # -> Start, End
intcrv_2 = Interpolate(Vertices=pt_6, Degree=3, Periodic=False, KnotStyle=1)  # -> Curve, Length, Domain
pl_2 = PlaneNormal(Origin=end.Start, ZAxis=Vector(0, 0, 1))
orient_2 = Orient(Geometry=intcrv_2.Curve, Source=end.End, Target=pl_2)  # -> Geometry, Transform
join = JoinCurves(Curves=[intcrv.Curve, orient_2.Geometry], Preserve=False)
series = Series(Start=0, Step=1, Count=10)
rotate_2 = Rotate(Geometry=join, Angle=series, Plane=PlaneXY(0, 0, 0))  # -> Geometry, Transform
loft_3 = Loft(
    Curves=rotate_2.Geometry,
    Options={Adjust=False, Closed=False, LoftEnds=0, LoftSimp=0, LoftType=0, Rebuild=10, Refit=0.01})
offsrf = OffsetSurface(Surface=loft_3, Distance=number_slider_3, BothSides=False, CreateSolid=True)
sunion_3 = SolidUnion(Breps=offsrf)
area_2 = Area(Geometry=loft_3)  # -> Area, Centroid
scale_2 = Scale(Geometry=sunion_3, Center=area_2.Centroid, Factor=Slider(2, range=0..2))  # -> Geometry, Transform

# ----
# Orient Bell in Tower
canopy_count = Slider(4, range=0..10)  # disabled
brep = Brep(scale_2.Geometry)  # disabled
point_2 = Point(area.Centroid)  # disabled
bell_heigth = Slider(1.276, range=0..5)  # disabled
rope_diameter = Slider(0.18, range=-0.01..0.5)  # disabled
canopy_diameter = Slider(8, range=0..10)  # disabled
canopy_shape = Slider(2.38, range=0..10)  # disabled
canopy_movement_z = Slider(-0.28, range=-10..10.01)  # disabled
canopy_mesh = Slider(3, range=1..3)  # disabled
bell_step = Slider(5, range=1..5)  # disabled
bells = Slider(4, range=1..6)  # disabled
deconstruct_brep = DeconstructBrep(Brep=brep)  # -> Faces, Edges, Vertices; disabled
series_2 = Series(Start=bell_heigth, Step=bell_step, Count=bells)  # disabled
panel_7 = Panel("4")  # disabled
list_item = ListItem(List=deconstruct_brep.Vertices, Index=panel_7, Wrap=True)  # disabled
orient_3 = Orient(Geometry=brep, Source=list_item, Target=point_2)  # -> Geometry, Transform; disabled
negative_4 = Negative(Value=series_2)  # disabled
unit_z_2 = UnitZ(Factor=negative_4)  # disabled
boolean_toggle = BooleanToggle(True)  # disabled
line_4 = Line(StartPoint=point_2, EndPoint=list_item)  # disabled
end_points = EndPoints(Curve=line_4)  # -> Start, End; disabled
circle_2 = Circle(Plane=end_points.Start, Radius=canopy_diameter)  # disabled
divide_curve_2 = DivideCurve(Curve=circle_2, Count=canopy_count, Kinks=False)  # -> Points, Tangents, Parameters; disabled
line_5 = Line(StartPoint=divide_curve_2.Points, EndPoint=point_2)  # disabled
pipe_5 = Pipe(Curve=line_5, Radius=rope_diameter, Caps=boolean_toggle)  # disabled
move_6 = Move(Geometry=orient_3.Geometry, Motion=unit_z_2)  # -> graft(Geometry), Transform; disabled
pipe_6 = Pipe(Curve=line_4, Radius=rope_diameter, Caps=boolean_toggle)  # disabled
delaunay_mesh_2 = DelaunayMesh(Points=divide_curve_2.Points, Plane=PlaneXY(0, 0, 0))  # disabled
weaverbird_s_stellate_cumulation_2 = WeaverbirdsStellateCumulation(MeshPolylines=delaunay_mesh_2, Distance=canopy_shape)  # disabled
merge_6 = Merge(Data2=pipe_6, Data3=pipe_5)  # -> graft(Result); disabled
weaverbird_s_picture_frame_2 = WeaverbirdsPictureFrame(MeshPolylines=weaverbird_s_stellate_cumulation_2, Distance=5, InsetType=0)  # disabled
negative_5 = Negative(Value=canopy_movement_z)  # disabled
weaverbird_s_mesh_thicken_3 = WeaverbirdsMeshThicken(MeshCurves=weaverbird_s_picture_frame_2, Distance=negative_5, OffsetType=0)  # disabled
geometry = Geometry(move_6.Geometry)  # disabled
solid_union = SolidUnion(Breps=merge_6)  # disabled
weaverbird_s_catmull_clark_subdivision_3 = WeaverbirdsCatmullClarkSubdivision(MeshCurves=weaverbird_s_mesh_thicken_3, Level=canopy_mesh, SmoothNakedEdges=1)  # disabled

number_slider_5 = Slider(29, range=0..100)  # disabled
cir_2 = Circle(Plane=PlaneXY(0, 0, 0), Radius=number_slider_5)  # disabled
crv_3 = Curve(ellipse.Ellipse)  # disabled
flow = Flow(Geometry=crv_2, Base=cir_2, Target=crv_3, ReverseBase=False, ReverseTarget=False, Stretch=True, Rigid=False)  # disabled
pipe_7 = Pipe(Curve=flow, Radius=1, Caps=0)  # disabled

# ----
# Bake Me!
merge_7 = Merge(Data2=sunion_2, Data3=geo, Data5=sunion)  # disabled

merge_8 = Merge(Data1=geo_4, Data2=geo_2)  # disabled
geo_6 = Geometry(loft_2)  # disabled
merge_9 = Merge(Data1=geo_5, Data2=geo_3)  # disabled
geo_7 = Geometry(pipe_4)  # disabled
