# Grasshopper definition WickersonStudiosTrigCurtain.gh (Grasshopper 1.0.7)
# plug-ins: Pufferfish, Bifocals

series = Series(Start=Slider(0, range=0..1), Step=Slider(7, range=0..10), Count=Slider(18, range=-1..30))
sine = Sine(Value=series)
cosine = Cosine(Value=series)
multiplication = Multiplication(A=sine, B=Slider(8, range=0..10))
multiplication_2 = Multiplication(A=cosine, B=Slider(10, range=0..10))
construct_point = ConstructPoint(XCoordinate=series, YCoordinate=multiplication, ZCoordinate=multiplication_2)
ghpython_script = GhPythonScript()  # -> Out, A
unit_z = UnitZ(Factor=Slider(68, range=0..100))
interpolate = Interpolate(Vertices=construct_point, Degree=3, Periodic=False, KnotStyle=1)  # -> Curve, Length, Domain
yz_plane = YZPlane(Origin=Point(0, 0, 0))
radians = Radians(Degrees=Slider(1, range=1..360))
move = Move(Geometry=interpolate.Curve, Motion=unit_z)  # -> Geometry, Transform
rotate = Rotate(Geometry=interpolate.Curve, Angle=radians, Plane=yz_plane)  # -> Geometry, Transform
loft = Loft(
    Curves=[move.Geometry, rotate.Geometry],
    Options={Adjust=False, Closed=False, LoftEnds=0, LoftSimp=0, LoftType=0, Rebuild=10, Refit=0.01})
offset_surface = OffsetSurface(Surface=loft, Distance=Slider(10, range=0..10), BothSides=False, CreateSolid=True)
