# Grasshopper definition WireCutter_v001.gh (Grasshopper 1.0.7)
# plug-ins: KUKA|prc - parametric robot control, Bifocals

geo = Geometry(<brep referenced from the Rhino model>)
edges = BrepEdges(Brep=geo)  # -> Naked, Interior, NonManifold
item = ListItem(List=edges.Interior, Index=Slider(9, range=0..11), Wrap=True)
item_2 = ListItem(List=edges.Interior, Index=Slider(11, range=0..11), Wrap=True)
divide = DivideCurve(Curve=[item, item_2], Count=Slider(20, range=1..24), Kinks=False)  # -> Points, Tangents, Parameters
bang = ExplodeTree(Data=divide.Points)  # -> Branch0, Branch1
ln = Line(StartPoint=bang.Branch0, EndPoint=reverse(bang.Branch1))
eval = EvaluateLength(Curve=ln, Length=Slider(0.5, range=0..1), Normalized=True)  # -> Point, Tangent, Parameter
X = UnitX(Factor=Slider(200, range=0..1000))
pl = ConstructPlane(Origin=eval.Point, XAxis=Vector(1, 0, 0), YAxis=eval.Tangent)
item_3 = ListItem(List=pl, Index=0, Wrap=True)
move = Move(Geometry=item_3, Motion=X)  # -> Geometry, Transform
merge = Merge(Data1=move.Geometry, Data2=pl)
geo_2 = Geometry(<brep referenced from the Rhino model>)
lin_move = LINearMovementKUKAPrc(TargetAsPlane=merge, extaxenabled=False, interpolation="C_DIS")
play = KUKAPrcPlay(SimulationTime=Slider(9, range=0..10), Loop=False, Reset=Toggle(False), savedtime=9)
kr90_kr270_r2500 = QuantecKR90KR270R2500Robot(infiniterot=False)
custom_tool = CustomToolKUKAPrc(
    CustomToolGeometry=geo_2,
    toolid=10,
    toolvala=29,
    toolvalb=-7,
    toolvalc=93,
    toolvalx=0,
    toolvaly=220,
    toolvalz=200,
    valuesset=True)
kuka_prc = KUKAPrcCORE(
    SimulationSlider=play,
    KUKAPrcCommands=lin_move,
    Tool=custom_tool,
    Robot=kr90_kr270_r2500,
    PRC_BaseExpose=False,
    PRC_SaveNameExpose=False,
    PRCsettings="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")  # -> RobotGeometry, AnalysisOutput
